# Grasshopper definition Der3.gh (Grasshopper 1.0.7)

number_slider = Slider(0, range=0..10)
number_slider_2 = Slider(51, range=0..100)
number_slider_3 = Slider(0.7, range=0..10)
number_slider_4 = Slider(100, range=0..100)
number_slider_5 = Slider(84, range=0..100)

ellipse = Ellipse(Plane=PlaneXY(0, 0, 0), Radius1=number_slider_2, Radius2=Slider(167, range=0..1000))  # -> Ellipse, Focus1, Focus2
division = Division(A=number_slider_2, B=number_slider_3)
Z = UnitZ(Factor=division)
panel = Panel("""0.25
0.75""")
move = Move(Geometry=ellipse.Ellipse, Motion=Z)  # -> Geometry, Transform
shatter = Shatter(Curve=reparameterize(ellipse.Ellipse), Parameters=panel)
scale_nu = ScaleNU(Geometry=move.Geometry, Plane=PlaneXY(0, 0, 0), ScaleX=number_slider_3, ScaleY=1, ScaleZ=1)  # -> Geometry, Transform
crv = Curve()
item = ListItem(List=shatter, Index="1", Wrap=True)
divide = DivideCurve(Curve=item, Count=number_slider_4, Kinks=False)  # -> Points, Tangents, Parameters

# ----
# point move
panel_2 = Panel("1")
dom = ConstructDomain(DomainStart="0", DomainEnd=panel_2)
range = Range(Domain=dom, Steps=expr("x", number_slider_4))
graph = GraphMapper(
    range,
    x0=0,
    x1=1,
    y0=0,
    y1=1,
    container_name="Bezier",
    cpx=[0, 0.2310296446, 0.4641282558, 1],
    cpy=[0, 0.3966440558, 0.8060603142, 0.6956959963])
Z_2 = UnitZ(Factor=1)
multiplication = Multiplication(A=graph, B=Slider(58, range=0..100))
amp = Amplitude(Vector=Z_2, Amplitude=multiplication)
neg = Negative(Value=amp)
move_2 = Move(Geometry=divide.Points, Motion=neg)  # -> Geometry, Transform

shatter_2 = Shatter(Curve=reparameterize(scale_nu.Geometry), Parameters=panel)
# line 02 center
intcrv = Interpolate(Vertices=move_2.Geometry, Degree=3, Periodic=False, KnotStyle=1)  # -> Curve, Length, Domain
item_2 = ListItem(List=shatter_2, Index="1", Wrap=True)
mirror = Mirror(Geometry=intcrv.Curve, Plane=PlaneYZ(0, 0, 0))  # -> Geometry, Transform
mirror_2 = Mirror(Geometry=item_2, Plane=PlaneYZ(0, 0, 0))  # -> Geometry, Transform
# line 02
# line 01 center
join = JoinCurves(Curves=flatten([mirror.Geometry, intcrv.Curve]), Preserve=False)
# line 01
join_2 = JoinCurves(Curves=flatten([mirror_2.Geometry, item_2]), Preserve=False)
crv_2 = Curve(intcrv.Curve)
crv_3 = Curve(mirror.Geometry)
divide_2 = DivideCurve(Curve=join, Count=number_slider_4, Kinks=False)  # -> Points, Tangents, Parameters
divide_3 = DivideCurve(Curve=join_2, Count=number_slider_4, Kinks=False)  # -> Points, Tangents, Parameters

# ----
# XYZ
deplane = DeconstructPlane(Plane=PlaneXY(0, 0, 0))  # -> Origin, XAxis, YAxis, ZAxis
neg_2 = Negative(Value=deplane.YAxis)
pl = ConstructPlane(Origin=deplane.Origin, XAxis=neg_2, YAxis=deplane.ZAxis)

intcrv_2 = Interpolate(Vertices=divide_3.Points, Degree=3, Periodic=True, KnotStyle=1)  # -> Curve, Length, Domain
intcrv_3 = Interpolate(Vertices=divide_2.Points, Degree=3, Periodic=True, KnotStyle=1)  # -> Curve, Length, Domain

yz = YZPlane(Origin=Point(0, 0, 0))
project = Project(Geometry=crv_2, Plane=yz)  # -> Geometry, Transform
pframes = PerpFrames(Curve=project.Geometry, Count="2", Align=True)  # -> Frames, Parameters
item_3 = ListItem(List=pframes.Frames, Index="1", Wrap=True)
deplane_2 = DeconstructPlane(Plane=item_3)  # -> Origin, XAxis, YAxis, ZAxis
vec = Vector(deplane_2.XAxis)

curvepoint = PointOnCurve(intcrv_3.Curve, parameter=0.25)
curvepoint_2 = PointOnCurve(intcrv_3.Curve, parameter=0.75)
curvepoint_3 = PointOnCurve(intcrv_2.Curve, parameter=0.25)
dom_2 = ConstructDomain(DomainStart="0", DomainEnd="1")

pdecon = Deconstruct(Point=curvepoint)  # -> XComponent, YComponent, ZComponent
pt = ConstructPoint(XCoordinate=0, YCoordinate=0, ZCoordinate=pdecon.ZComponent)

pdecon_2 = Deconstruct(Point=curvepoint_3)  # -> XComponent, YComponent, ZComponent
pt_2 = ConstructPoint(XCoordinate=0, YCoordinate=0, ZCoordinate=pdecon_2.ZComponent)

dom_3 = Domain(DomainStart=Slider(0, range=0..100), DomainEnd=Slider(43, range=0..180))
ln = Line(StartPoint=curvepoint_3, EndPoint=curvepoint)
dom_4 = Domain(DomainStart=Slider(0, range=0..100), DomainEnd=Slider(74, range=0..180))
divide_4 = DivideCurve(Curve=ln, Count=number_slider_4, Kinks=False)  # -> Points, Tangents, Parameters
X = UnitX(Factor=1)
panel_3 = Panel("""0
1
2""")
X_2 = UnitX(Factor=1)
panel_4 = Panel("""0
1
2""")
X_3 = UnitX(Factor=1)
panel_5 = Panel("""0
1
2""")
crv_4 = Curve(intcrv_2.Curve)
pt_3 = Point(pt_2)
pt_4 = Point(pt)
panel_6 = Panel("""0
1
2
3
4
5
6
7""")
panel_7 = Panel("""0
1
2
3
4""")
crv_5 = Curve(mirror.Geometry)
crv_6 = Curve(mirror_2.Geometry)
ln_2 = Line(StartPoint=pt_3, EndPoint=pt_4)

# ----
# MOVE SCALE
Z_3 = UnitZ(Factor=1)
amp_2 = Amplitude(Vector=Z_3, Amplitude=number_slider)
move_3 = Move(Geometry=crv_4, Motion=amp_2)  # -> Geometry, Transform

item_4 = ListItem(List=flatten(move_3.Geometry), Index="2", Wrap=True)
item_5 = ListItem(List=flatten(move_3.Geometry), Index="1", Wrap=True)
item_6 = ListItem(List=flatten(move_3.Geometry), Index="3", Wrap=True)
flip = FlipCurve(Curve=crv_6)  # -> Curve, Flag
flip_2 = FlipCurve(Curve=crv_5)  # -> Curve, Flag
panel_8 = Panel("""0
1
2""")
weave = Weave(Pattern=panel_8, Stream0=item_5, Stream1=item_4, Stream2=item_6, NullGaps=False)
item_7 = ListItem(List=flatten(move_3.Geometry), Index=0, Wrap=True)
crv_7 = Curve(intcrv_2.Curve)
crv_8 = Curve(intcrv_3.Curve)

# ----
# TEST
panel_9 = Panel("8")
panel_10 = Panel("""0
0.5""")
panel_11 = Panel("""0
0.5""")

range_2 = Range(Domain=dom_2, Steps=expr("x-2", panel_9))
graph_2 = GraphMapper(
    range_2,
    x0=0,
    x1=1,
    y0=0,
    y1=1,
    container_name="Bezier",
    cpx=[0, 0.3210714459, 0.7329313755, 1],
    cpy=[0.307641983, 0.6031900644, 0.5845611095, 0.3039249778])
remap = RemapNumbers(Value=graph_2, Source=Domain(0, 1), Target=dom_3)  # -> Mapped, Clipped
graph_3 = GraphMapper(
    range_2,
    x0=0,
    x1=1,
    y0=0,
    y1=1,
    container_name="Bezier",
    cpx=[0, 0.3210714459, 0.7329313755, 1],
    cpy=[0.3115199208, 0.6031900644, 0.5845611095, 0.2230595946])
remap_2 = RemapNumbers(Value=graph_3, Source=Domain(0, 1), Target=dom_4)  # -> Mapped, Clipped

dom_5 = ConstructDomain(DomainStart="0", DomainEnd="1")
range_3 = Range(Domain=dom_5, Steps=expr("x", number_slider_4))
graph_4 = GraphMapper(
    range_3,
    x0=0,
    x1=1,
    y0=0,
    y1=1,
    container_name="Bezier",
    cpx=[0, 0.2318537086, 0.7583169341, 1],
    cpy=[0, 0.2776080966, 0.2769328952, 0])
multiplication_2 = Multiplication(A=graph_4, B=number_slider_5)

neg_3 = Negative(Value=multiplication_2)

amp_3 = Amplitude(Vector=X, Amplitude=neg_3)
neg_4 = Negative(Value=amp_3)
# line 01a
move_4 = Move(Geometry=divide_4.Points, Motion=neg_4)  # -> Geometry, Transform

# ----
# Section 03
# Section 02
intcrv_4 = Interpolate(Vertices=move_4.Geometry, Degree=3, Periodic=False, KnotStyle=1)  # -> Curve, Length, Domain

number_slider_6 = Slider(44, range=-20..100)
number_slider_7 = Slider(17, range=-100..100)

curvepoint_4 = PointOnCurve(intcrv_2.Curve, parameter=0.5)
curvepoint_5 = PointOnCurve(intcrv_3.Curve, parameter=0.5)
Y = UnitY(Factor=1)
ln_3 = Line(StartPoint=curvepoint_4, EndPoint=curvepoint_5)
divide_5 = DivideCurve(Curve=ln_3, Count=number_slider_4, Kinks=False)  # -> Points, Tangents, Parameters

multiplication_3 = Multiplication(A=graph_4, B=number_slider_5)
amp_4 = Amplitude(Vector=Y, Amplitude=multiplication_3)

move_5 = Move(Geometry=divide_5.Points, Motion=amp_4)  # -> Geometry, Transform
# Section 01
intcrv_5 = Interpolate(Vertices=move_5.Geometry, Degree=3, Periodic=False, KnotStyle=1)  # -> Curve, Length, Domain

curvepoint_6 = PointOnCurve(intcrv_2.Curve, parameter=1)
curvepoint_7 = PointOnCurve(intcrv_3.Curve, parameter=1)
Y_2 = UnitY(Factor=1)
ln_4 = Line(StartPoint=curvepoint_6, EndPoint=curvepoint_7)
divide_6 = DivideCurve(Curve=ln_4, Count=number_slider_4, Kinks=False)  # -> Points, Tangents, Parameters

panel_12 = Panel(remap_2.Mapped)

curvepoint_8 = PointOnCurve(intcrv_2.Curve, parameter=0.401)
curvepoint_9 = PointOnCurve(intcrv_3.Curve, parameter=0.397)
ln_5 = Line(StartPoint=curvepoint_8, EndPoint=curvepoint_9)
divide_7 = DivideCurve(Curve=ln_5, Count=number_slider_4, Kinks=False)  # -> Points, Tangents, Parameters

curvepoint_10 = PointOnCurve(intcrv_2.Curve, parameter=0.091)
curvepoint_11 = PointOnCurve(intcrv_3.Curve, parameter=0.094)
ln_6 = Line(StartPoint=curvepoint_10, EndPoint=curvepoint_11)
divide_8 = DivideCurve(Curve=ln_6, Count=number_slider_4, Kinks=False)  # -> Points, Tangents, Parameters

multiplication_4 = Multiplication(A=graph_4, B=number_slider_5)

expression = Expression(x=multiplication_4, Expression="-x/2")

amp_5 = Amplitude(Vector=Y_2, Amplitude=expression)

move_6 = Move(Geometry=divide_6.Points, Motion=amp_5)  # -> Geometry, Transform
intcrv_6 = Interpolate(Vertices=move_6.Geometry, Degree=3, Periodic=False, KnotStyle=1)  # -> Curve, Length, Domain

multiplication_5 = Multiplication(A=graph_4, B=number_slider_5)

multiplication_6 = Multiplication(A=multiplication_5, B=Slider(0.66, range=0..1))

amp_6 = Amplitude(Vector=X_2, Amplitude=multiplication_6)

move_7 = Move(Geometry=divide_7.Points, Motion=amp_6)  # -> Geometry, Transform
intcrv_7 = Interpolate(Vertices=move_7.Geometry, Degree=3, Periodic=False, KnotStyle=1)  # -> Curve, Length, Domain

multiplication_7 = Multiplication(A=graph_4, B=number_slider_5)

multiplication_8 = Multiplication(A=multiplication_7, B=Slider(0.66, range=0..1))

amp_7 = Amplitude(Vector=X_3, Amplitude=multiplication_8)

move_8 = Move(Geometry=divide_8.Points, Motion=amp_7)  # -> Geometry, Transform
intcrv_8 = Interpolate(Vertices=move_8.Geometry, Degree=3, Periodic=False, KnotStyle=1)  # -> Curve, Length, Domain

number_slider_8 = Slider(30, range=0..100)

number_slider_9 = Slider(30, range=0..100)

reb = RebuildCurve(Curve=intcrv_3.Curve, Degree=3, Count=number_slider_9, Tangents=False)
reb_2 = RebuildCurve(Curve=intcrv_2.Curve, Degree=3, Count=number_slider_9, Tangents=False)
crv_9 = Curve(reb)
crv_10 = Curve(reb_2)

crv_11 = Curve(crv_10)
shatter_3 = Shatter(Curve=reparameterize(crv_11), Parameters=panel_10)
shatter_4 = Shatter(Curve=reparameterize(crv_9), Parameters=panel_11)
item_8 = ListItem(List=shatter_3, Index=0, Wrap=True)
item_9 = ListItem(List=shatter_3, Index="1", Wrap=True)
item_10 = ListItem(List=shatter_4, Index=0, Wrap=True)
item_11 = ListItem(List=shatter_4, Index="1", Wrap=True)
pframes_2 = PerpFrames(Curve=item_9, Count=panel_9, Align=True)  # -> Frames, Parameters
pframes_3 = PerpFrames(Curve=item_11, Count=panel_9, Align=True)  # -> Frames, Parameters

flip_3 = FlipCurve(Curve=item_10)  # -> Curve, Flag
flip_4 = FlipCurve(Curve=item_8)  # -> Curve, Flag
cull_i = CullIndex(List=pframes_3.Frames, Indices=["0", panel_9], Wrap=True)
cull_i_2 = CullIndex(List=pframes_2.Frames, Indices=["0", panel_9], Wrap=True)
deplane_3 = DeconstructPlane(Plane=cull_i_2)  # -> Origin, XAxis, YAxis, ZAxis
neg_5 = Negative(Value=deplane_3.YAxis)
amp_8 = Amplitude(Vector=neg_5, Amplitude=remap.Mapped)
item_12 = ListItem(List=shatter_4, Index=0, Wrap=True)
item_13 = ListItem(List=shatter_4, Index="1", Wrap=True)
item_14 = ListItem(List=shatter_3, Index=0, Wrap=True)
item_15 = ListItem(List=shatter_3, Index="1", Wrap=True)

pframes_4 = PerpFrames(Curve=flip_4.Curve, Count=panel_9, Align=True)  # -> Frames, Parameters
pframes_5 = PerpFrames(Curve=flip_3.Curve, Count=panel_9, Align=True)  # -> Frames, Parameters

cull_i_3 = CullIndex(List=pframes_5.Frames, Indices=["0", panel_9], Wrap=True)
cull_i_4 = CullIndex(List=pframes_4.Frames, Indices=["0", panel_9], Wrap=True)
deplane_4 = DeconstructPlane(Plane=cull_i_4)  # -> Origin, XAxis, YAxis, ZAxis
amp_9 = Amplitude(Vector=deplane_4.YAxis, Amplitude=remap.Mapped)
bzspan = BezierSpan(StartPoint=deplane_4.Origin, StartTangent=amp_9, EndPoint=deplane_3.Origin, EndTangent=amp_8)  # -> Curve, Length, Domain
item_16 = ListItem(List=bzspan.Curve, Index="3", Wrap=True)

pframes_6 = PerpFrames(Curve=item_16, Count="2", Align=True)  # -> Frames, Parameters
item_17 = ListItem(List=pframes_6.Frames, Index="1", Wrap=True)

deplane_5 = DeconstructPlane(Plane=item_17)  # -> Origin, XAxis, YAxis, ZAxis
multiplication_9 = Multiplication(A=number_slider_6, B=deplane_5.YAxis)

deplane_6 = DeconstructPlane(Plane=item_17)  # -> Origin, XAxis, YAxis, ZAxis

neg_6 = Negative(Value=deplane_6.YAxis)

multiplication_10 = Multiplication(A=number_slider_6, B=neg_6)

deplane_7 = DeconstructPlane(Plane=cull_i_3)  # -> Origin, XAxis, YAxis, ZAxis
deplane_8 = DeconstructPlane(Plane=cull_i)  # -> Origin, XAxis, YAxis, ZAxis

neg_7 = Negative(Value=deplane_7.YAxis)

amp_10 = Amplitude(Vector=neg_7, Amplitude=remap_2.Mapped)
amp_11 = Amplitude(Vector=deplane_8.YAxis, Amplitude=remap_2.Mapped)
points = PointList(Points=cull_i_3, Size="30")

bzspan_2 = BezierSpan(StartPoint=deplane_7.Origin, StartTangent=amp_10, EndPoint=deplane_8.Origin, EndTangent=amp_11)  # -> Curve, Length, Domain

crv_12 = Curve(bzspan_2.Curve)
item_18 = ListItem(List=crv_12, Index="3", Wrap=True)
crv_13 = Curve(item_18)
crv_14 = Curve(item_18)

pframes_7 = PerpFrames(Curve=crv_13, Count="2", Align=True)  # -> Frames, Parameters
item_19 = ListItem(List=pframes_7.Frames, Index="1", Wrap=True)

pframes_8 = PerpFrames(Curve=crv_14, Count="2", Align=True)  # -> Frames, Parameters
item_20 = ListItem(List=pframes_8.Frames, Index="1", Wrap=True)

deplane_9 = DeconstructPlane(Plane=item_20)  # -> Origin, XAxis, YAxis, ZAxis
multiplication_11 = Multiplication(A=Slider(44, range=-20..100), B=deplane_9.YAxis)

neg_8 = Negative(Value=deplane_9.YAxis)

deplane_10 = DeconstructPlane(Plane=item_19)  # -> Origin, XAxis, YAxis, ZAxis

neg_9 = Negative(Value=deplane_10.YAxis)

multiplication_12 = Multiplication(A=Slider(44, range=-20..100), B=neg_9)

crv_15 = Curve(item_14)
crv_16 = Curve(item_15)

crv_17 = Curve(item_12)
# NET MESH
crv_18 = Curve(item_13)

reb_3 = RebuildCurve(Curve=bzspan.Curve, Degree=3, Count=number_slider_8, Tangents=False)

crv_19 = Curve(intcrv_5.Curve)
crv_20 = Curve(intcrv_4.Curve)
crv_21 = Curve(intcrv_6.Curve)
crv_22 = Curve(intcrv_7.Curve)
crv_23 = Curve(intcrv_8.Curve)

crv_24 = Curve(crv_19)
crv_25 = Curve(crv_21)

pframes_9 = PerpFrames(Curve=crv_25, Count="2", Align=True)  # -> Frames, Parameters
item_21 = ListItem(List=pframes_9.Frames, Index="0", Wrap=True)

pframes_10 = PerpFrames(Curve=crv_24, Count="2", Align=True)  # -> Frames, Parameters
item_22 = ListItem(List=pframes_10.Frames, Index="2", Wrap=True)

pframes_11 = PerpFrames(Curve=crv_25, Count="2", Align=True)  # -> Frames, Parameters
item_23 = ListItem(List=pframes_11.Frames, Index="2", Wrap=True)

pframes_12 = PerpFrames(Curve=crv_24, Count="2", Align=True)  # -> Frames, Parameters
item_24 = ListItem(List=pframes_12.Frames, Index="0", Wrap=True)

deplane_11 = DeconstructPlane(Plane=item_21)  # -> Origin, XAxis, YAxis, ZAxis
multiplication_13 = Multiplication(A=number_slider_7, B=deplane_11.ZAxis)
bzspan_3 = BezierSpan(
    StartPoint=deplane_6.Origin,
    StartTangent=multiplication_10,
    EndPoint=deplane_11.Origin,
    EndTangent=expr("-x", multiplication_13))  # -> Curve, Length, Domain

deplane_12 = DeconstructPlane(Plane=item_24)  # -> Origin, XAxis, YAxis, ZAxis
neg_10 = Negative(Value=deplane_11.ZAxis)
neg_11 = Negative(Value=deplane_12.ZAxis)
multiplication_14 = Multiplication(A=number_slider_7, B=deplane_12.ZAxis)
bzspan_4 = BezierSpan(
    StartPoint=deplane_5.Origin,
    StartTangent=multiplication_9,
    EndPoint=deplane_12.Origin,
    EndTangent=expr("-x", multiplication_14))  # -> Curve, Length, Domain
join_3 = JoinCurves(Curves=flatten([bzspan_3.Curve, bzspan_4.Curve]), Preserve=False)
crv_26 = Curve(join_3)

weave_2 = Weave(Pattern=panel_4, Stream0=crv_15, Stream1=crv_26, Stream2=crv_16, NullGaps=False)

reb_4 = RebuildCurve(Curve=weave_2, Degree=3, Count=number_slider_8, Tangents=False)

mirror_3 = Mirror(Geometry=crv_23, Plane=PlaneYZ(0, 0, 0))  # -> Geometry, Transform
mirror_4 = Mirror(Geometry=crv_20, Plane=PlaneYZ(0, 0, 0))  # -> Geometry, Transform
mirror_5 = Mirror(Geometry=crv_22, Plane=PlaneYZ(0, 0, 0))  # -> Geometry, Transform
crv_27 = Curve(flatten(mirror_3.Geometry))
crv_28 = Curve(flatten(mirror_4.Geometry))
crv_29 = Curve(flatten(mirror_5.Geometry))

crv_30 = Curve(crv_20)
crv_31 = Curve(crv_19)
crv_32 = Curve(crv_21)
weave_3 = Weave(Pattern=panel_7, Stream0=crv_31, Stream1=crv_22, Stream2=crv_30, Stream3=crv_23, Stream4=crv_32, NullGaps=False)

weave_4 = Weave(
    Pattern=panel_6,
    Stream0=crv_31,
    Stream1=crv_22,
    Stream2=crv_30,
    Stream3=crv_23,
    Stream4=crv_32,
    Stream5=crv_27,
    Stream6=crv_28,
    Stream7=crv_29,
    NullGaps=False)

number_slider_10 = Slider(60, range=0..100)
reb_5 = RebuildCurve(Curve=[crv_7, crv_8], Degree=3, Count=number_slider_10, Tangents=False)
reb_6 = RebuildCurve(Curve=weave_4, Degree=3, Count=number_slider_10, Tangents=False)

swp2 = Sweep2(Rail1=flip.Curve, Rail2=flip_2.Curve, Sections=weave_3, SameHeight=False)
mirror_6 = Mirror(Geometry=swp2, Plane=PlaneYZ(0, 0, 0))  # -> Geometry, Transform

join_4 = BrepJoin(Breps=flatten([swp2, mirror_6.Geometry]))  # -> Breps, Closed
railrev = RailRevolution(Curve=item_4, Rail=item_7, Axis=ln_2, Scale=False)

deplane_13 = DeconstructPlane(Plane=item_22)  # -> Origin, XAxis, YAxis, ZAxis

neg_12 = Negative(Value=deplane_13.ZAxis)
vec_2 = Vector(neg_12)
rotate = Rotate(Geometry=vec_2, Angle=degrees(1.570796327), Plane=deplane_13.Origin)  # -> Geometry, Transform

multiplication_15 = Multiplication(A=Slider(44, range=-100..100), B=neg_12)
# Buttom line
bzspan_5 = BezierSpan(
    StartPoint=deplane_10.Origin,
    StartTangent=multiplication_12,
    EndPoint=deplane_13.Origin,
    EndTangent=expr("-x", multiplication_15))  # -> Curve, Length, Domain

deplane_14 = DeconstructPlane(Plane=item_23)  # -> Origin, XAxis, YAxis, ZAxis

neg_13 = Negative(Value=deplane_14.ZAxis)

multiplication_16 = Multiplication(A=Slider(44, range=-100..100), B=neg_13)
bzspan_6 = BezierSpan(
    StartPoint=deplane_9.Origin,
    StartTangent=multiplication_11,
    EndPoint=deplane_14.Origin,
    EndTangent=expr("-x", multiplication_16))  # -> Curve, Length, Domain

crv_33 = Curve(bzspan_5.Curve)
crv_34 = Curve(bzspan_6.Curve)

crv_35 = Curve([crv_33, crv_34])
join_5 = JoinCurves(Curves=flatten(crv_35), Preserve=False)
crv_36 = Curve(join_5)

weave_5 = Weave(Pattern=panel_5, Stream0=crv_17, Stream1=crv_36, Stream2=crv_18, NullGaps=False)

reb_7 = RebuildCurve(Curve=weave_5, Degree=3, Count=number_slider_9, Tangents=False)
reb_8 = RebuildCurve(Curve=bzspan_2.Curve, Degree=3, Count=number_slider_9, Tangents=False)
netsurf = NetworkSurface(CurvesU=reverse(reb_7), CurvesV=reb_8, Continuity=2)

Z_4 = UnitZ(Factor=1)

neg_14 = Negative(Value=Z_4)

amp_12 = Amplitude(Vector=neg_14, Amplitude=number_slider)

netsurf_2 = NetworkSurface(CurvesU=reverse(reb_5), CurvesV=reb_6, Continuity=2)
netsurf_3 = NetworkSurface(CurvesU=reverse(reb_4), CurvesV=reb_3, Continuity=2)
move_9 = Move(Geometry=netsurf, Motion=amp_12)  # -> Geometry, Transform

edges = BrepEdges(Brep=netsurf_2)  # -> Naked, Interior, NonManifold
edges_2 = BrepEdges(Brep=netsurf_2)  # -> Naked, Interior, NonManifold
item_25 = ListItem(List=edges.Naked, Index="1", Wrap=True)
item_26 = ListItem(List=edges_2.Naked, Index=0, Wrap=True)
