# Grasshopper definition OM Mesh TO SURFACE.gh (Grasshopper 1.0.7)
# plug-ins: MeshEdit Components, Pufferfish, LunchBox, Weaverbird, TT Toolbox

number_slider = Slider(5, range=5..10)
wbicosahedron = WeaverbirdsMeshMeshIcosahedron(Plane=PlaneXY(0, 0, 0), Radius=number_slider)
number_slider_2 = Slider(0.687, range=0..5)
number_slider_3 = Slider(0.85, range=0..5)
wbicosahedron_2 = WeaverbirdsMeshMeshIcosahedron(Plane=PlaneXY(0, 0, 0), Radius=number_slider)
sph = Sphere(Base=PlaneXY(0, 0, 0), Radius=number_slider)
number_slider_4 = Slider(14, range=0..20)
wbtriangles = WeaverbirdsSplitTrianglesSubdivision(MeshCurves=wbicosahedron, Level="1")
expression = Expression(x=number_slider_4, Expression="x+1")

# ----
# VERTEX
demesh = DeconstructMesh(Mesh=wbtriangles)  # -> Vertices, Faces, Colours, Normals
pt = Point(flatten(demesh.Vertices))
cullduppoints = RemoveDuplicatePoints(InputPoints=pt, Tolerance=0.001)  # -> OutputPoints, FirstPointIndexes
pull = PullPoint(Point=cullduppoints.OutputPoints, Geometry=pt, ClosestOnly=True)  # -> ClosestPoint, Distance
smaller = SmallerThan(FirstNumber=pull.Distance, SecondNumber=0)  # -> SmallerThan, OrEqualTo
cull = CullPattern(List=cullduppoints.OutputPoints, CullPattern=smaller.OrEqualTo)
pt_2 = Point(cull)

explode = MeshExplode(Mesh=wbtriangles, Interpolate=False)
wbtriangles_2 = WeaverbirdsSplitTrianglesSubdivision(MeshCurves=wbicosahedron_2, Level="2")
# CURVE
crv = Curve(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)
crv_2 = Curve(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)
item = ListItem(List=explode, Index=number_slider_4, Wrap=True)

demesh_2 = DeconstructMesh(Mesh=item)  # -> Vertices, Faces, Colours, Normals
item_2 = ListItem(List=demesh_2.Vertices, Index="1", Wrap=True)
item_3 = ListItem(List=demesh_2.Vertices, Index="2", Wrap=True)
item_4 = ListItem(List=demesh_2.Vertices, Index="3", Wrap=True)
pl_3pt = Plane3Pt(PointA=item_2, PointB=item_3, PointC=item_4)

culln = CullNth(List=explode, CullFrequency=expression)
number_slider_5 = Slider(0, range=0..10)
panel = Panel(""".25
.05""")
panel_2 = Panel("""0
1""")
demesh_3 = DeconstructMesh(Mesh=wbtriangles_2)  # -> Vertices, Faces, Colours, Normals

number_slider_6 = Slider(30, range=0..100)
xy = XYPlane(Origin=Point(0, 0, 0))
project = Project(Geometry=crv, Plane=xy)  # -> Geometry, Transform
divide = DivideCurve(Curve=project.Geometry, Count=number_slider_6, Kinks=False)  # -> Points, Tangents, Parameters
Z = UnitZ(Factor=1)
line = LineSDL(Start=divide.Points, Direction=Z, Length=Slider(2, range=0..10))
ccx = CurveCurve(CurveA=crv, CurveB=line)  # -> Points, ParamsA, ParamsB
pdecon = Deconstruct(Point=flatten(ccx.Points))  # -> XComponent, YComponent, ZComponent
bnd = Bounds(Numbers=pdecon.ZComponent)
remap = RemapNumbers(Value=pdecon.ZComponent, Source=bnd, Target=Domain(0, 1))  # -> Mapped, Clipped

number_slider_7 = Slider(1.214, range=0..5)
range = Range(Domain=Domain(0, 1), Steps=number_slider_6)
pull_2 = PullPoint(Point=demesh_3.Vertices, Geometry=sph, ClosestOnly=True)  # -> ClosestPoint, Distance
faceb = FaceBoundaries(Mesh=culln)
number_slider_8 = Slider(0.7, range=0..1)
faceb_2 = FaceBoundaries(Mesh=item)

demesh_4 = DeconstructMesh(Mesh=wbtriangles)  # -> Vertices, Faces, Colours, Normals
cp = ControlPoints(Curve=faceb_2)  # -> Points, Weights, Knots
cullduppoints_2 = RemoveDuplicatePoints(InputPoints=flatten(cp.Points), Tolerance="1")  # -> OutputPoints, FirstPointIndexes
# HAND
cullduppoints_3 = RemoveDuplicatePoints(InputPoints=flatten(demesh_4.Vertices), Tolerance="1")  # -> OutputPoints, FirstPointIndexes
pt_3 = Point(cullduppoints_2.OutputPoints)
pull_3 = PullPoint(Point=cullduppoints_3.OutputPoints, Geometry=pt_3, ClosestOnly=True)  # -> ClosestPoint, Distance
larger = LargerThan(FirstNumber=pull_3.Distance, SecondNumber=0)  # -> LargerThan, OrEqualTo
cull_2 = CullPattern(List=cullduppoints_3.OutputPoints, CullPattern=larger.LargerThan)

pt_4 = Point(cull_2)
Z_2 = UnitZ(Factor=number_slider)  # disabled
area = MeshArea(Mesh=item)  # -> Area, Centroid
cullduppoints_4 = RemoveDuplicatePoints(InputPoints=cp.Points, Tolerance=0.001)  # -> OutputPoints, FirstPointIndexes
panel_3 = Panel("""0
1
2""")
conmesh = ConstructMesh(Vertices=pull_2.ClosestPoint, Faces=demesh_3.Faces)
pt_5 = Point(pl_3pt)
neg = Negative(Value=Z_2)  # disabled
dom = ConstructDomain(DomainStart="0", DomainEnd="1")
item_5 = ListItem(List=flatten(cullduppoints_4.OutputPoints), Index=panel_3, Wrap=True)
planesrf = PlaneSurface(Plane=PlaneXY(0, 0, 0), XSize=Domain(-10, 10), YSize=Domain(-10, 10))  # disabled
planar = PlanarSrf()
planar_2 = PlanarSrf()
move2pt = MoveToPoint(Geometry=pl_3pt, PointA=pt_5, PointB=area.Centroid)  # -> Moved, Vector, Transform
pt_6 = Point(move2pt.Moved)
polygon = Polygon(Plane=move2pt.Moved, Radius=number_slider_7, Segments=Slider(12, range=0..100), FilletRadius=0)  # -> Polygon, Length
multiplication = Multiplication(A=remap.Mapped, B=number_slider_8)
multiplication_2 = Multiplication(A=number_slider_2, B=1.6)
explode_2 = MeshExplode(Mesh=conmesh, Interpolate=False)  # disabled
pt_7 = Point(item_5)
pt_8 = Point(pt_7)
move = Move(Geometry=planesrf, Motion=neg)  # -> Geometry, Transform; disabled
scale = Scale(Geometry=polygon.Polygon, Center=move2pt.Moved, Factor=number_slider_2)  # -> Geometry, Transform
crv_3 = Curve(scale.Geometry)
cp_2 = ControlPoints(Curve=crv_3)  # -> Points, Weights, Knots
dispatch = Dispatch(List=cp_2.Points, DispatchPattern=[True, False])  # -> ListA, ListB
pt_9 = Point(dispatch.ListA)
pt_10 = Point(dispatch.ListB)
explode_3 = Explode(Curve=crv_3, Recursive=True)  # -> Segments, Vertices
ln = Line(StartPoint=pt_9, EndPoint=pt_6)
ln_2 = Line(StartPoint=pt_10, EndPoint=pt_6)
curvepoint = PointOnCurve(explode_3.Segments, parameter=0.5)
curvepoint_2 = PointOnCurve(ln, parameter=0.711)
curvepoint_3 = PointOnCurve(ln_2, parameter=0.393)
ln_3 = Line(StartPoint=pt_9, EndPoint=curvepoint_2)
ln_4 = Line(StartPoint=pt_10, EndPoint=curvepoint_3)
area_2 = MeshArea(Mesh=explode_2)  # -> Area, Centroid; disabled
cullduplines = RemoveDuplicateLines(InputLines=ln_3, Tolerance=".1")  # -> OutputLines, FirstLineIndexes
end = EndPoints(Curve=ln_4)  # -> Start, End
end_2 = EndPoints(Curve=cullduplines.OutputLines)  # -> Start, End
ln_5 = Line(StartPoint="0,0,0", EndPoint=pt_2)
curvepoint_4 = PointOnCurve(ln_5, parameter=0.843)
cp_3 = ControlPoints(Curve=polygon.Polygon)  # -> Points, Weights, Knots
amp = Amplitude(Vector=ln_5, Amplitude=1)
cp_4 = ControlPoints(Curve=scale.Geometry)  # -> Points, Weights, Knots
scale_2 = Scale(Geometry=scale.Geometry, Center=move2pt.Moved, Factor=multiplication_2)  # -> Geometry, Transform
pt_11 = Point(end_2.End)
pull_4 = PullPoint(Point=area_2.Centroid, Geometry=move.Geometry, ClosestOnly=True)  # -> ClosestPoint, Distance; disabled
pt_12 = Point(end.End)
division = Division(A=number_slider_7, B=15)
ln_6 = Line(StartPoint=cp_3.Points, EndPoint=cp_4.Points)
merge = Merge(Data1=flatten(pt_11), Data2=flatten(pt_12), Data3=flatten(curvepoint))
expression_2 = Expression(x="6", Expression="3*x")
larger_2 = LargerThan(FirstNumber=pull_4.Distance, SecondNumber=number_slider)  # -> LargerThan, OrEqualTo; disabled
offcrv = OffsetCurve(Curve=ln_6, Plane=move2pt.Moved, Distance=division, BothSides="1", Kinks=0, CapType=1)
alongcrv = SortAlongCurve(Points=merge, Curve=crv_3)  # -> Points, Indices
cull_3 = CullPattern(List=explode_2, CullPattern=larger_2.LargerThan)  # disabled
pline = PolyLine(Vertices=alongcrv.Points, Closed="1")
merge_2 = Merge(Data1=flatten(offcrv), Data2=flatten(scale_2.Geometry))

ln_7 = Line(StartPoint="0,0,0", EndPoint=cull_2)
ln_8 = Line(StartPoint="0,0,0", EndPoint=pt_7)
expression_3 = Expression(x=number_slider, Expression="0.6666*x")
amp_2 = Amplitude(Vector=ln_7, Amplitude=1)
amp_3 = Amplitude(Vector=ln_8, Amplitude=1)
division_2 = Division(A=expression_3, B=3)
line_2 = LineSDL(Start=cull_2, Direction=amp_2, Length=expression_3)
division_3 = Division(A=expression_3, B=3)
line_3 = LineSDL(Start=pt_7, Direction=amp_3, Length=division_2)
division_4 = Division(A=expression_3, B=3)

vec = Vector(amp_2)
pln = Plane(line_2)
pln_2 = Plane(line_3)
vec_2 = Vector(amp_3)
expression_4 = Expression(x=division_2, Expression="1.3333*x")
amp_4 = Amplitude(Vector=ln_7, Amplitude=1)
expression_5 = Expression(x=division_2, Expression="1.3333*x*1.6666")
pl = ConstructPlane(Origin=amp_3, XAxis=amp_3, YAxis=Vector(0, 1, 0))
amp_5 = Amplitude(Vector=graft(pl), Amplitude=multiplication)
line_4 = LineSDL(Start=curvepoint_4, Direction=amp, Length=expression_5)
wbfacepolys = WeaverbirdsFacePolylines(Mesh=cull_3)  # disabled

crv_4 = Curve(flatten(merge_2))
# MOUTH
crv_5 = Curve(flatten(polygon.Polygon))
number_slider_9 = Slider(0.25, range=0..1)
deplane = DeconstructPlane(Plane=move2pt.Moved)  # -> Origin, XAxis, YAxis, ZAxis
runion = RegionUnion(Curves=crv_4)
rint = RegionIntersection(CurvesA=crv_5, CurvesB=runion)
merge_3 = Merge(Data1=flatten(pline), Data2=flatten(rint))
rdiff = RegionDifference(CurvesA=polygon.Polygon, CurvesB=rint, Plane=move2pt.Moved)
division_5 = Division(A=number_slider_9, B=2)
amp_6 = Amplitude(Vector=deplane.ZAxis, Amplitude=number_slider_9)
boundary = BoundarySurfaces(Edges=merge_3)
amp_7 = Amplitude(Vector=deplane.ZAxis, Amplitude=division_5)
extr = Extrude(Base=rdiff, Direction=amp_7)

expression_6 = Expression(x=number_slider, y=number_slider_9, Expression="x-y")
wbicosahedron_3 = WeaverbirdsMeshMeshIcosahedron(Plane=PlaneXY(0, 0, 0), Radius=expression_6)
wbtriangles_3 = WeaverbirdsSplitTrianglesSubdivision(MeshCurves=wbicosahedron_3, Level="1")
explode_4 = MeshExplode(Mesh=wbtriangles_3, Interpolate=False)
item_6 = ListItem(List=explode_4, Index=number_slider_4, Wrap=True)
culln_2 = CullNth(List=explode_4, CullFrequency=expression)
faceb_3 = FaceBoundaries(Mesh=explode_4)
faceb_4 = FaceBoundaries(Mesh=culln_2)
faceb_5 = FaceBoundaries(Mesh=item_6)
number_slider_10 = Slider(0.85, range=0..1)  # disabled
panel_4 = Panel("""20
22
31
32
33
34
35""")  # disabled
boundary_2 = BoundarySurfaces(Edges=wbfacepolys)  # disabled
area_3 = Area(Geometry=boundary_2)  # -> Area, Centroid; disabled
ext = ExtendCurve(Curve=line_2, Type=0, Start=division_3, End="0")
curvepoint_5 = PointOnCurve(ext, parameter=0.884)
line_5 = LineSDL(Start=curvepoint_5, Direction=amp_4, Length=expression_4)
panel_5 = Panel(remap.Mapped)
ext_2 = ExtendCurve(Curve=line_3, Type=0, Start=division_4, End="0")
cull_i = CullIndex(List=flatten(boundary_2), Indices=panel_4, Wrap=True)  # -> graft(List); disabled
item_7 = ListItem(List=flatten(boundary_2), Index=panel_4, Wrap=True)  # -> graft(Item); disabled
boundary_3 = BoundarySurfaces(Edges=faceb_5)
points = PointList(Points=flatten(area_3.Centroid), Size=number_slider_10)  # disabled
number_slider_11 = Slider(0.37, range=0..1)  # disabled

area_4 = Area(Geometry=boundary_3)  # -> Area, Centroid
srf_cp = SurfaceClosestPoint(Point=area_4.Centroid, Surface=boundary_3)  # -> Point, UVPoint, Distance
evalsrf = EvaluateSurface(Surface=boundary_3, Point=srf_cp.UVPoint)  # -> Point, Normal, UDirection, VDirection, Frame

srf_cp_2 = SurfaceClosestPoint()  # -> Point, UVPoint, Distance
cap = CapHoles(Brep=extr)
extr_2 = Extrude(Base=boundary, Direction=amp_6)
crv_6 = Curve(cull_i)  # disabled
crv_7 = Curve(item_7)  # disabled
number_slider_12 = Slider(0.85, range=0.3..0.85)  # disabled
area_5 = Area(Geometry=crv_7)  # -> Area, Centroid; disabled
edges = BrepEdges(Brep=boundary_3)  # -> Naked, Interior, NonManifold
fillet = Fillet(Curve=crv_6, Radius=number_slider_11)  # disabled
move2pt_2 = MoveToPoint(Geometry=pline, PointA=move2pt.Moved, PointB=evalsrf.Point)  # -> Moved, Vector, Transform
area_6 = Area(Geometry=crv_6)  # -> Area, Centroid; disabled
scale_3 = Scale(Geometry=crv_7, Center=area_5.Centroid, Factor=Slider(0.85, range=0.3..0.85))  # -> Geometry, Transform; disabled
scale_4 = Scale(Geometry=fillet, Center=area_6.Centroid, Factor=number_slider_12)  # -> Geometry, Transform; disabled
faceb_6 = FaceBoundaries(Mesh=explode_4)
srfsplit = SurfaceSplit(Surface=item_7, Curves=scale_3.Geometry)  # disabled
explode_5 = Explode(Curve=faceb_6, Recursive=True)  # -> Segments, Vertices
dispatch_2 = Dispatch(List=srfsplit, DispatchPattern=[True, False])  # -> ListA, ListB; disabled
srfsplit_2 = SurfaceSplit(Surface=cull_i, Curves=scale_4.Geometry)  # disabled
cullduplines_2 = RemoveDuplicateLines(InputLines=flatten(explode_5.Segments), Tolerance=0.001)  # -> OutputLines, FirstLineIndexes
dispatch_3 = Dispatch(List=srfsplit_2, DispatchPattern=[True, False])  # -> ListA, ListB; disabled
boundary_4 = BoundarySurfaces(Edges=flatten(faceb_3))

geo = Geometry(dispatch_2.ListA)  # disabled
geo_2 = Geometry(dispatch_2.ListB)  # disabled

boundary_5 = BoundarySurfaces(Edges=faceb_4)
boundary_6 = BoundarySurfaces(Edges=[edges.Naked, move2pt_2.Moved])

geo_3 = Geometry(dispatch_3.ListA)  # disabled
geo_4 = Geometry(dispatch_3.ListB)  # disabled

join = BrepJoin(Breps=flatten([boundary_5, boundary_6]))  # -> Breps, Closed
move2pt_3 = MoveToPoint(Geometry=[extr_2, cap], PointA=move2pt.Moved, PointB=evalsrf.Point)  # -> Moved, Vector, Transform
pipe = Pipe(Curve=cullduplines_2.OutputLines, Radius=".1", Caps=0)

srf = Surface(reparameterize(boundary_4))
crv_8 = Curve([<curve referenced from the Rhino model> x4])
# TEST PATTERM
edges_2 = BrepEdges(Brep=graft(srf))  # -> Naked, Interior, NonManifold
boundary_7 = BoundarySurfaces(Edges=crv_8)
join_2 = JoinCurves(Curves=edges_2.Naked, Preserve=False)
area_7 = Area(Geometry=crv_8)  # -> Area, Centroid
hex = HexagonCells(
    Surface=boundary_7,
    UDivisions=Slider(4, range=0..100),
    VDivisions=Slider(4, range=0..100),
    TParameter=Slider(0.33, range=0..1))  # -> HexagonCells, Centers
srf_cp_3 = SurfaceClosestPoint(Point=area_7.Centroid, Surface=crv_8)  # -> Point, UVPoint, Distance
geo_5 = Geometry(hex.HexagonCells)
evalsrf_2 = EvaluateSurface(Surface=crv_8, Point=srf_cp_3.UVPoint)  # -> Point, Normal, UDirection, VDirection, Frame
panel_6 = Panel("(0;0;0)")
pl_2 = PlaneNormal(Origin=evalsrf_2.Point, ZAxis=evalsrf_2.Normal)
pln_3 = Plane(pl_2)
points_2 = PointList(Points=area_7.Centroid, Size=Slider(1, range=0..1))
rint_2 = RegionIntersection(CurvesA=crv_8, CurvesB=graft(geo_5), Plane=pln_3)
geo_6 = Geometry()

number_slider_13 = Slider(30, range=0..100)
divide_2 = DivideCurve(Curve=ext, Count=number_slider_13, Kinks=False)  # -> Points, Tangents, Parameters
pl_3 = ConstructPlane(Origin=amp_2, XAxis=amp_2, YAxis=Vector(0, 1, 0))

# ----
# HAND 2
expression_7 = Expression(x=number_slider_13, Expression="x/3")
pframes = PerpFrames(Curve=line_5, Count=expression_7, Align=True)  # -> Frames, Parameters
pframes_2 = PerpFrames(Curve=ext_2, Count=number_slider_13, Align=True)  # -> Frames, Parameters
range_2 = Range(Domain=dom, Steps=expr("x-1", expression_7))
# plane
graph = GraphMapper(range_2, x0=0, x1=1, y0=0, y1=1, container_name="Bezier", cpx=[0, 0.28073439, 0, 1], cpy=[0, 0.003471434116, 1, 1])
pframes_3 = PerpFrames(Curve=line_4, Count=expression_7, Align=True)  # -> Frames, Parameters
move_2 = Move(Geometry=pframes_2.Frames, Motion=amp_5)  # -> Geometry, Transform
graph_2 = GraphMapper(range_2, x0=0, x1=1, y0=0, y1=1, container_name="Bezier", cpx=[0, 1, 0.2373137921, 1], cpy=[0, 0.0008535981178, 1, 1])
multiplication_3 = Multiplication(A=graph, B="1.66666*2")

pl_4 = ConstructPlane(Origin=amp, XAxis=amp, YAxis=Vector(0, 1, 0))
amp_8 = Amplitude(Vector=graft(pl_4), Amplitude=multiplication_3)

move_3 = Move(Geometry=pframes_3.Frames, Motion=amp_8)  # -> Geometry, Transform
multiplication_4 = Multiplication(A=graph_2, B="1.66666")
amp_9 = Amplitude(Vector=graft(pl_3), Amplitude=multiplication_4)
intcrv = Interpolate(Vertices=move_2.Geometry, Degree=3, Periodic=False, KnotStyle=1)  # -> Curve, Length, Domain
revsrf = Revolution(Curve=graft(intcrv.Curve), Axis=graft(ext_2), Domain=Domain(0, 6.283185307))
move_4 = Move(Geometry=pframes.Frames, Motion=amp_9)  # -> Geometry, Transform
intcrv_2 = Interpolate(Vertices=move_3.Geometry, Degree=3, Periodic=False, KnotStyle=1)  # -> Curve, Length, Domain
intcrv_3 = Interpolate(Vertices=move_4.Geometry, Degree=3, Periodic=False, KnotStyle=1)  # -> Curve, Length, Domain
vpipe = PipeVariable(Curve=reparameterize(intcrv_3.Curve), Parameters=panel_2, Radii=panel, Caps=2)
pipe_2 = Pipe(Curve=intcrv_2.Curve, Radius=".02", Caps=2)
arrpolar = PolarArray(Geometry=graft(vpipe), Plane=graft(line_5), Count="6", Angle=6.283185307)  # -> Geometry, Transform
srf_2 = Surface(revsrf)
arrpolar_2 = PolarArray(Geometry=graft(pipe_2), Plane=graft(line_4), Count=expression_2, Angle=6.283185307)  # -> Geometry, Transform

xy_2 = XYPlane(Origin=Point(0, 0, 0))
project_2 = Project(Geometry=crv_2, Plane=xy_2)  # -> Geometry, Transform
Z_3 = UnitZ(Factor=1)

reb = RebuildCurve(Curve=project_2.Geometry, Count=Slider(2, range=0..100), Tangents=False)
eval = EvaluateCurve(Curve=reparameterize(reb), Parameter=range)  # -> Point, Tangent, Angle

line_6 = LineSDL(Start=eval.Point, Direction=Z_3, Length=Slider(2, range=0..10))
ccx_2 = CurveCurve(CurveA=crv_2, CurveB=line_6)  # -> Points, ParamsA, ParamsB
pdecon_2 = Deconstruct(Point=flatten(ccx_2.Points))  # -> XComponent, YComponent, ZComponent
bnd_2 = Bounds(Numbers=pdecon_2.ZComponent)
remap_2 = RemapNumbers(Value=pdecon_2.ZComponent, Source=bnd_2, Target=Domain(0, 1))  # -> Mapped, Clipped

multiplication_5 = Multiplication(A=remap_2.Mapped, B=number_slider_8)
amp_10 = Amplitude(Vector=graft(pl_3), Amplitude=multiplication_5)
move_5 = Move(Geometry=divide_2.Points, Motion=amp_10)  # -> Geometry, Transform
intcrv_4 = Interpolate(Vertices=move_5.Geometry, Degree=3, Periodic=False, KnotStyle=1)  # -> Curve, Length, Domain

pframes_4 = PerpFrames(Curve=ext, Count=number_slider_13, Align=True)  # -> Frames, Parameters
move_6 = Move(Geometry=pframes_4.Frames, Motion=amp_10)  # -> Geometry, Transform
intcrv_5 = Interpolate(Vertices=move_6.Geometry, Degree=3, Periodic=False, KnotStyle=1)  # -> Curve, Length, Domain
revsrf_2 = Revolution(Curve=graft(intcrv_5.Curve), Axis=graft(ext), Domain=Domain(0, 6.283185307))

# ----
# plane change
number_slider_14 = Slider(0.68, range=0..1)
expression_8 = Expression(x="6", Expression="2*x+4")
cir = Circle(Plane=pln, Radius=".08")
pl_5 = ConstructPlane(Origin=pt_4, XAxis=pln, YAxis=Vector(0, 1, 0))
rotate = Rotate(Geometry=cir, Angle=degrees("90"), Plane=pl_5)  # -> Geometry, Transform

pl_6 = ConstructPlane(Origin=vec, XAxis=vec, YAxis=Vector(0, 1, 0))
amp_11 = Amplitude(Vector=pl_6, Amplitude=number_slider_14)

deplane_2 = DeconstructPlane(Plane=pl_5)  # -> Origin, XAxis, YAxis, ZAxis
neg_2 = Negative(Value=deplane_2.YAxis)
pl_7 = ConstructPlane(Origin=deplane_2.Origin, XAxis=neg_2, YAxis=deplane_2.ZAxis)

amp_12 = Amplitude(Vector=pl_7, Amplitude=Slider(0.32, range=-2..2))
rotate_2 = Rotate(Geometry=rotate.Geometry, Angle=degrees("90"), Plane=pl_7)  # -> Geometry, Transform
scale_nu = ScaleNU(Geometry=rotate_2.Geometry, Plane=pl_7, ScaleX=1, ScaleY=1, ScaleZ="2")  # -> Geometry, Transform
move_7 = Move(Geometry=scale_nu.Geometry, Motion=amp_12)  # -> Geometry, Transform
move_8 = Move(Geometry=move_7.Geometry, Motion=amp_11)  # -> Geometry, Transform
arrpolar_3 = PolarArray(Geometry=graft(move_8.Geometry), Plane=graft(pln), Count=expression_8, Angle=6.283185307)  # -> Geometry, Transform

srfsplit_3 = SurfaceSplit(Surface=revsrf_2, Curves=arrpolar_3.Geometry)
item_8 = ListItem(List=srfsplit_3, Index=0, Wrap=True)

# ----
# plane change
number_slider_15 = Slider(0.6, range=0..1)
expression_9 = Expression(x="6", Expression="2*x+2")
cir_2 = Circle(Plane=pln_2, Radius=".08")
pl_8 = ConstructPlane(Origin=pt_8, XAxis=pln_2, YAxis=Vector(0, 1, 0))
rotate_3 = Rotate(Geometry=cir_2, Angle=degrees("90"), Plane=pl_8)  # -> Geometry, Transform

expression_10 = Expression(x=".08", Expression="3*x")

pl_9 = ConstructPlane(Origin=vec_2, XAxis=vec_2, YAxis=Vector(0, 1, 0))
amp_13 = Amplitude(Vector=pl_9, Amplitude=number_slider_15)

cir_3 = Circle(Plane=pln_2, Radius=expression_10)

deplane_3 = DeconstructPlane(Plane=pl_8)  # -> Origin, XAxis, YAxis, ZAxis
neg_3 = Negative(Value=deplane_3.YAxis)
pl_10 = ConstructPlane(Origin=deplane_3.Origin, XAxis=neg_3, YAxis=deplane_3.ZAxis)

amp_14 = Amplitude(Vector=pl_10, Amplitude=Slider(0.18, range=-2..2))
rotate_4 = Rotate(Geometry=rotate_3.Geometry, Angle=degrees("90"), Plane=pl_10)  # -> Geometry, Transform
scale_nu_2 = ScaleNU(Geometry=rotate_4.Geometry, Plane=pl_10, ScaleX=1, ScaleY=1, ScaleZ="2")  # -> Geometry, Transform
move_9 = Move(Geometry=scale_nu_2.Geometry, Motion=amp_14)  # -> Geometry, Transform
move_10 = Move(Geometry=move_9.Geometry, Motion=amp_13)  # -> Geometry, Transform
arrpolar_4 = PolarArray(Geometry=graft(move_10.Geometry), Plane=graft(pln_2), Count=expression_9, Angle=6.283185307)  # -> Geometry, Transform

project_3 = Project(Curve=graft(cir_3), Brep=graft(srf_2), Direction=graft(deplane_3.XAxis))
srfsplit_4 = SurfaceSplit(Surface=revsrf, Curves=arrpolar_4.Geometry)
item_9 = ListItem(List=srfsplit_4, Index=0, Wrap=True)
srfsplit_5 = SurfaceSplit(Surface=item_9, Curves=project_3)
item_10 = ListItem(List=srfsplit_5, Index="1", Wrap=True)

boundary_8 = BoundarySurfaces(Edges=faceb)
boundary_9 = BoundarySurfaces(Edges=faceb_2)
# MESH SHELL
edges_3 = BrepEdges(Brep=boundary_8)  # -> Naked, Interior, NonManifold
edges_4 = BrepEdges(Brep=boundary_9)  # -> Naked, Interior, NonManifold
neg_4 = Negative(Value=number_slider_9)

area_8 = Area(Geometry=boundary_8)  # -> Area, Centroid
srf_cp_4 = SurfaceClosestPoint(Point=area_8.Centroid, Surface=boundary_8)  # -> Point, UVPoint, Distance
evalsrf_3 = EvaluateSurface(Surface=boundary_8, Point=srf_cp_4.UVPoint)  # -> Point, Normal, UDirection, VDirection, Frame

area_9 = Area(Geometry=boundary_9)  # -> Area, Centroid
srf_cp_5 = SurfaceClosestPoint(Point=area_9.Centroid, Surface=boundary_9)  # -> Point, UVPoint, Distance
evalsrf_4 = EvaluateSurface(Surface=boundary_9, Point=srf_cp_5.UVPoint)  # -> Point, Normal, UDirection, VDirection, Frame

expression_11 = Expression(x=neg_4, Expression="x")
offsrf = OffsetSurface(Surface=item_8, Distance=expression_11, BothSides=False, CreateSolid=True)

scale_5 = Scale(Geometry=edges_4.Naked, Center=evalsrf_4.Point, Factor=number_slider_3)  # -> Geometry, Transform
scale_6 = Scale(Geometry=edges_3.Naked, Center=evalsrf_3.Point, Factor=number_slider_3)  # -> Geometry, Transform
boundary_10 = BoundarySurfaces(Edges=[edges_3.Naked, scale_6.Geometry])
boundary_11 = BoundarySurfaces(Edges=[scale_5.Geometry, edges_4.Naked])
merge_4 = Merge(Data1=flatten(boundary_10), Data2=flatten(boundary_11))
join_3 = BrepJoin(Breps=merge_4)  # -> Breps, Closed
offsrf_2 = OffsetSurface(Surface=join_3.Breps, Distance=neg_4, BothSides=False, CreateSolid=True)
sunion = SolidUnion(Breps=offsrf_2)

offsrf_3 = OffsetSurface(Surface=item_10, Distance=expression_11, BothSides=False, CreateSolid=True)
offsrf_4 = OffsetSurface(Surface=join.Breps, Distance=neg_4, BothSides=False, CreateSolid=True)
