# Grasshopper definition der2.gh (Grasshopper 1.0.7)
# plug-ins: Pufferfish

number_slider = Slider(3.33, range=0..10)
# curve
number_slider_2 = Slider(20, range=0..100)
# Revolu
number_slider_3 = Slider(12.5, range=0..100)
expression = Expression(x="5", y=Slider(1.35, range=0..2), Expression="x*y")
Z = UnitZ(Factor=expression)
neg = Negative(Value=Z)
expression_2 = Expression(x=number_slider, y=Slider(1.32, range=0..2), Expression="x/y")
Z_2 = UnitZ(Factor=1)
multiplication = Multiplication(A=expression, B=Slider(0.85, range=0..1))
crv = Curve(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)
neg_2 = Negative(Value=expression)
move = Move(Geometry="0,0,0", Motion=neg)  # -> Geometry, Transform
neg_3 = Negative(Value=Z_2)
neg_4 = Negative(Value=multiplication)
range = Range(Domain=Domain(0, 1), Steps=number_slider_2)
line = LineSDL(Start="0,0,0", Direction=Vector(0, 0, 1), Length=neg_2)
line_2 = LineSDL(Start=move.Geometry, Direction=Vector(0, 0, 1), Length=neg_4)
line_3 = LineSDL(Start="0,0,0", Direction=neg_3, Length=number_slider_3)
number_slider_4 = Slider(1.25, range=0..10)
X = UnitX(Factor=1)

pframes = PerpFrames(Curve=line, Count="20", Align=True)  # -> Frames, Parameters
dom = ConstructDomain(DomainStart="0", DomainEnd="1")
range_2 = Range(Domain=dom, Steps=expr("x-1", "20"))
graph = GraphMapper(
    range_2,
    x0=0,
    x1=1,
    y0=0,
    y1=1,
    container_name="Bezier",
    cpx=[0, 0.4384091496, 0.08715319633, 1],
    cpy=[0, 0, 1, 0.7819713354])
X_2 = UnitX(Factor=1)
multiplication_2 = Multiplication(A="5", B=graph)
amp = Amplitude(Vector=X_2, Amplitude=multiplication_2)

expression_3 = Expression(x="20", Expression="x-1")
item = ListItem(List=multiplication_2, Index=expression_3, Wrap=True)
move_2 = Move(Geometry=pframes.Frames, Motion=amp)  # -> Geometry, Transform
expression_4 = Expression(x=expression_2, Expression="-x")
expression_5 = Expression(x=number_slider, Expression="-x")
expression_6 = Expression(x=expression_2, Expression="x")
expression_7 = Expression(x=number_slider, Expression="x")
neg_5 = Negative(Value=Slider(0.61, range=0..10))
dom_2 = ConstructDomain(DomainStart=expression_6, DomainEnd=expression_4)
dom_3 = ConstructDomain(DomainStart=expression_7, DomainEnd=expression_5)
intcrv = Interpolate(Vertices=move_2.Geometry, Degree=3, Periodic=False, KnotStyle=1)  # -> Curve, Length, Domain
rectangle = Rectangle(Plane=PlaneXY(0, 0, 0), XSize=dom_3, YSize=dom_2, Radius=0)  # -> Rectangle, Length
revsrf = Revolution(Curve=intcrv.Curve, Axis=line, Domain=Domain(0, 6.283185307))
scale = Scale(Geometry=rectangle.Rectangle, Center=Point(0, 0, 0), Factor=0.5)  # -> Geometry, Transform
division = Division(A=number_slider, B=2)
xz = XZPlane(Origin=Point(0, 0, 0))
rotate = Rotate(Geometry=rectangle.Rectangle, Angle=1.570796327, Plane=xz)  # -> Geometry, Transform
fillet = Fillet(Curve=scale.Geometry, Radius=division)
rotate_2 = Rotate(Geometry=fillet, Angle=1.570796327, Plane=xz)  # -> Geometry, Transform
neg_6 = Negative(Value=Slider(4.68, range=0..10))
X_3 = UnitX(Factor=Slider(4.19, range=0..10))
Z_3 = UnitZ(Factor=neg_6)
move_3 = Move(Geometry=rotate_2.Geometry, Motion=Z_3)  # -> Geometry, Transform
move_4 = Move(Geometry=move_3.Geometry, Motion=X_3)  # -> Geometry, Transform
arrpolar = PolarArray(Geometry=move_4.Geometry, Plane=PlaneXY(0, 0, 0), Count="7", Angle=6.283185307)  # -> Geometry, Transform
srfsplit = SurfaceSplit(Surface=revsrf, Curves=arrpolar.Geometry)
item_2 = ListItem(List=srfsplit, Index=0, Wrap=True)

number_slider_5 = Slider(10, range=0..100)
dom_4 = ConstructDomain(DomainStart=expr("x", number_slider_5), DomainEnd=expr("-x", number_slider_5))
rectangle_2 = Rectangle(Plane=PlaneXY(0, 0, 0), XSize=dom_4, YSize=dom_4, Radius=0)  # -> Rectangle, Length
scale_2 = Scale(Geometry=rectangle_2.Rectangle, Center=Point(0, 0, 0), Factor=Slider(0.81, range=0..1))  # -> Geometry, Transform
boundary = BoundarySurfaces(Edges=rectangle_2.Rectangle)
fillet_2 = Fillet(Curve=scale_2.Geometry, Radius=Slider(3.2, range=0..10))

xy = XYPlane(Origin=Point(0, 0, 0))
project = Project(Geometry=crv, Plane=xy)  # -> Geometry, Transform
Z_4 = UnitZ(Factor=1)

reb = RebuildCurve(Curve=project.Geometry, Count=Slider(2, range=0..100), Tangents=False)
eval = EvaluateCurve(Curve=reparameterize(reb), Parameter=range)  # -> Point, Tangent, Angle

line_4 = LineSDL(Start=eval.Point, Direction=Z_4, Length=Slider(6, range=0..10))
ccx = CurveCurve(CurveA=crv, CurveB=line_4)  # -> Points, ParamsA, ParamsB
pdecon = Deconstruct(Point=flatten(ccx.Points))  # -> XComponent, YComponent, ZComponent
bnd = Bounds(Numbers=pdecon.ZComponent)
remap = RemapNumbers(Value=pdecon.ZComponent, Source=bnd, Target=Domain(0, 1))  # -> Mapped, reverse(Clipped)

divide = DivideCurve(Curve=line_3, Count=Slider(20, range=0..100), Kinks=False)  # -> Points, Tangents, Parameters
pl = ConstructPlane(Origin=divide.Points, XAxis=Vector(1, 0, 0), YAxis=divide.Points)
multiplication_3 = Multiplication(A=remap.Clipped, B=Slider(4.6, range=0..20))
amp_2 = Amplitude(Vector=graft(X), Amplitude=multiplication_3)
move_5 = Move(Geometry=divide.Points, Motion=amp_2)  # -> Geometry, Transform
intcrv_2 = Interpolate(Vertices=move_5.Geometry, Degree=3, Periodic=False, KnotStyle=1)  # -> Curve, Length, Domain

revsrf_2 = Revolution(Curve=intcrv_2.Curve, Axis=line_3, Domain=Domain(0, 6.283185307))
srfsplit_2 = SurfaceSplit(Surface=revsrf_2, Curves=arrpolar.Geometry)
item_3 = ListItem(List=srfsplit_2, Index=0, Wrap=True)
srf = Surface(revsrf_2)

curvepoint = PointOnCurve(line_3, parameter=0.516)
curvepoint_2 = PointOnCurve(line_3, parameter=0.982)
pln = Plane(curvepoint)
pln_2 = Plane(curvepoint_2)
sec = BrepPlane(Brep=item_3, Plane=pln)  # -> Curves, Points
sec_2 = BrepPlane(Brep=item_3, Plane=pln_2)  # -> Curves, Points
divide_2 = DivideCurve(Curve=sec.Curves, Count=Slider(7, range=0..10), Kinks=False)  # -> Points, Tangents, Parameters
divide_3 = DivideCurve(Curve=sec_2.Curves, Count=Slider(7, range=0..10), Kinks=False)  # -> Points, Tangents, Parameters
# plane change
shatter = Shatter(Curve=sec.Curves, Parameters=divide_2.Parameters)
shatter_2 = Shatter(Curve=sec_2.Curves, Parameters=divide_3.Parameters)
rotate_3 = Rotate(Geometry=shatter_2, Angle=degrees(Slider(30, range=0..100)), Plane=pln_2)  # -> Geometry, Transform
end = EndPoints(Curve=shatter)  # -> Start, End
end_2 = EndPoints(Curve=rotate_3.Geometry)  # -> Start, End
curvepoint_3 = PointOnCurve(shatter, parameter=0.5)
curvepoint_4 = PointOnCurve(rotate_3.Geometry, parameter=0.5)
ln = Line(StartPoint=end.Start, EndPoint=end_2.Start)
curvepoint_5 = PointOnCurve(ln, parameter=0.5)
ln_2 = Line(StartPoint=end.End, EndPoint=end_2.End)
ln_3 = Line(StartPoint=curvepoint_3, EndPoint=curvepoint_4)
curvepoint_6 = PointOnCurve(ln_3, parameter=0.5)
pull = PullCurve(Curve=shatter, Surface=srf)
crv_2 = Curve(pull)
merge = Merge(Data1=graft(rotate_3.Geometry), Data2=graft(ln_2))
join = JoinCurves(Curves=merge, Preserve=False)

pdecon_2 = Deconstruct(Point=curvepoint_5)  # -> XComponent, YComponent, ZComponent
pt = ConstructPoint(XCoordinate=0, YCoordinate=0, ZCoordinate=pdecon_2.ZComponent)
item_4 = ListItem(List=pt, Index=0, Wrap=True)
pt_2 = Point(flatten(item_4))

join_2 = JoinCurves(Curves=shatter_2, Preserve=False)
join_3 = JoinCurves(Curves=shatter, Preserve=False)

pframes_2 = PerpFrames(Curve=line_2, Count="20", Align=True)  # -> Frames, Parameters
dom_5 = ConstructDomain(DomainStart="0", DomainEnd="1")
range_3 = Range(Domain=dom_5, Steps=expr("x", "20"))
graph_2 = GraphMapper(
    range_3,
    x0=0,
    x1=1,
    y0=0,
    y1=1,
    container_name="Bezier",
    cpx=[0, 0.2601013184, 0.6680238843, 1],
    cpy=[0, 0.2576021552, 0.2239122391, 0])
X_4 = UnitX(Factor=1)
multiplication_4 = Multiplication(A="5", B=graph_2)

addition = Addition(A=item, B=multiplication_4)

amp_3 = Amplitude(Vector=X_4, Amplitude=addition)

move_6 = Move(Geometry=pframes_2.Frames, Motion=amp_3)  # -> Geometry, Transform
intcrv_3 = Interpolate(Vertices=move_6.Geometry, Degree=3, Periodic=False, KnotStyle=1)  # -> Curve, Length, Domain
revsrf_3 = Revolution(Curve=intcrv_3.Curve, Axis=line, Domain=Domain(0, 6.283185307))

ln_4 = Line(StartPoint=pt_2, EndPoint=curvepoint_5)
pl_2 = ConstructPlane(Origin=curvepoint_5, XAxis=ln_4, YAxis=Vector(0, 1, 0))

deplane = DeconstructPlane(Plane=pl_2)  # -> Origin, XAxis, YAxis, ZAxis
neg_7 = Negative(Value=deplane.YAxis)
pl_3 = ConstructPlane(Origin=deplane.Origin, XAxis=neg_7, YAxis=deplane.ZAxis)

project_2 = Project(Curve=graft(ln), Brep=item_3, Direction=graft(pl_3))
curvepoint_7 = PointOnCurve(project_2, parameter=0.5)

# ----
# test
pull_2 = PullPoint(Point=curvepoint_7, Geometry=curvepoint_5, ClosestOnly=True)  # -> ClosestPoint, Distance
smaller = SmallerThan(FirstNumber=pull_2.Distance, SecondNumber=Slider(2, range=0..10))  # -> SmallerThan, OrEqualTo
cull = CullPattern(List=project_2, CullPattern=smaller.SmallerThan)

crv_3 = Curve(flatten(cull))
pull_3 = PullCurve(Curve=crv_3, Surface=srf)
crv_4 = Curve(pull_3)
curvepoint_8 = PointOnCurve(crv_4, parameter=0.5)
merge_2 = Merge(Data1=graft(crv_2), Data2=graft(crv_4))
points = PointList(Points=curvepoint_8, Size=Slider(1, range=0..1))
join_4 = JoinCurves(Curves=merge_2, Preserve=False)
merge_3 = Merge(Data1=graft(join_4), Data2=graft(join))
join_5 = JoinCurves(Curves=merge_3, Preserve=False)
scale_3 = Scale(Geometry=graft(join_5), Center=graft(curvepoint_6), Factor=Slider(0.952, range=0..1))  # -> Geometry, Transform

item_5 = ListItem(List=crv_3, Index=0, Wrap=True)
swp2 = Sweep2(Rail1=join_3, Rail2=join_2, Sections=item_5, SameHeight=False)
divide_4 = DivideDomain²(Domain=swp2, UCount=Slider(7, range=0..100), VCount=Slider(1, range=0..120))
subsrf = Isotrim(Surface=swp2, Domain=divide_4)

map_srf = MapToSurface(Curve=fillet_2, Source=boundary, Target=subsrf)

rotate_4 = Rotate(Geometry=map_srf, Angle=degrees(Slider(141, range=45..360)), Plane=PlaneXY(0, 0, 0))  # -> Geometry, Transform
srfsplit_3 = SurfaceSplit(Surface=item_3, Curves=rotate_4.Geometry)
item_6 = ListItem(List=srfsplit_3, Index=Slider(6, range=0..10), Wrap=True)
offsrf = OffsetSurface(Surface=item_6, Distance=neg_5, BothSides=False, CreateSolid=True)

project_3 = Project(Geometry=graft(scale_3.Geometry), Plane=graft(pl_3))  # -> Geometry, Transform
