# Grasshopper definition der_84_lemon.gh (Grasshopper 1.0.7)

number_slider = Slider(54, range=0..100)
number_slider_2 = Slider(69, range=0..1000)

number_slider_3 = Slider(0.983, range=0..1)
number_slider_4 = Slider(11, range=0..100)
number_slider_5 = Slider(56, range=0..100)

number_slider_6 = Slider(55, range=0..100)  # disabled
number_slider_7 = Slider(69, range=0..1000)  # disabled

number_slider_8 = Slider(0.983, range=0..1)  # disabled
number_slider_9 = Slider(11, range=0..100)  # disabled
number_slider_10 = Slider(56, range=0..100)  # disabled
number_slider_11 = Slider(2.006, range=0..10)  # disabled
number_slider_12 = Slider(1.161, range=0..10)  # disabled
multiplication = Multiplication(A=number_slider_2, B=Slider(1.161, range=0..10))
division = Division(A=number_slider, B=Slider(2.006, range=0..10))
multiplication_2 = Multiplication(A=number_slider_7, B=number_slider_12)  # disabled
division_2 = Division(A=number_slider_6, B=number_slider_11)  # disabled
panel = Panel("-90")  # disabled
ellipse = Ellipse(Plane=PlaneXY(0, 0, 0), Radius1=multiplication, Radius2=division)  # -> Ellipse, Focus1, Focus2
rotate = Rotate(Geometry=ellipse.Ellipse, Angle=degrees("-90"), Plane=PlaneXY(0, 0, 0))  # -> Geometry, Transform

ellipse_2 = Ellipse(Plane=PlaneXY(0, 0, 0), Radius1=number_slider, Radius2=number_slider_2)  # -> Ellipse, Focus1, Focus2
ellipse_3 = Ellipse(Plane=PlaneXY(0, 0, 0), Radius1=division, Radius2=multiplication)  # -> Ellipse, Focus1, Focus2

ellipse_4 = Ellipse(Plane=PlaneXY(0, 0, 0), Radius1=multiplication_2, Radius2=division_2)  # -> Ellipse, Focus1, Focus2; disabled
rotate_2 = Rotate(Geometry=ellipse_4.Ellipse, Angle=degrees(panel), Plane=PlaneXY(0, 0, 0))  # -> Geometry, Transform; disabled

ellipse_5 = Ellipse(Plane=PlaneXY(0, 0, 0), Radius1=number_slider_6, Radius2=number_slider_7)  # -> Ellipse, Focus1, Focus2; disabled
ellipse_6 = Ellipse(Plane=PlaneXY(0, 0, 0), Radius1=division_2, Radius2=multiplication_2)  # -> Ellipse, Focus1, Focus2; disabled

expression = Expression(x=multiplication, Expression="2*x")
dom = ConstructDomain(DomainStart=expr("x", expression), DomainEnd=expr("-x", expression))
rectangle = Rectangle(Plane=PlaneXY(0, 0, 0), XSize=multiplication, YSize=dom, Radius=0)  # -> Rectangle, Length

sunion = SolidUnion(Breps=[ellipse_2.Ellipse, ellipse_3.Ellipse])
edges = BrepEdges(Brep=sunion)  # -> Naked, Interior, NonManifold

expression_2 = Expression(x=multiplication_2, Expression="2*x")  # disabled
dom_2 = ConstructDomain(DomainStart=expr("x", expression_2), DomainEnd=expr("-x", expression_2))  # disabled
rectangle_2 = Rectangle(Plane=PlaneXY(0, 0, 0), XSize=multiplication_2, YSize=dom_2, Radius=0)  # -> Rectangle, Length; disabled

cp = ControlPoints(Curve=rotate.Geometry)  # -> Points, Weights, Knots

sunion_2 = SolidUnion(Breps=[ellipse_5.Ellipse, ellipse_6.Ellipse])  # disabled
edges_2 = BrepEdges(Brep=sunion_2)  # -> Naked, Interior, NonManifold; disabled

cp_2 = ControlPoints(Curve=rotate_2.Geometry)  # -> Points, Weights, Knots; disabled
join = JoinCurves(Curves=flatten(edges.Naked), Preserve=False)
join_2 = JoinCurves(Curves=flatten(edges_2.Naked), Preserve=False)  # disabled
trim = TrimWithRegion(Curve=join, Region=rectangle.Rectangle)  # -> Inside, Outside
mirror = Mirror(Geometry=trim.Inside, Plane=PlaneYZ(0, 0, 0))  # -> Geometry, Transform
trim_2 = TrimWithRegion(Curve=join_2, Region=rectangle_2.Rectangle)  # -> Inside, Outside; disabled
mirror_2 = Mirror(Geometry=trim_2.Inside, Plane=PlaneYZ(0, 0, 0))  # -> Geometry, Transform; disabled
divide = DivideCurve(Curve=trim.Inside, Count=expr("x/2", number_slider_5), Kinks=False)  # -> Points, Tangents, Parameters
divide_2 = DivideCurve(Curve=mirror.Geometry, Count=expr("x/2", number_slider_5), Kinks=False)  # -> Points, Tangents, Parameters
divide_3 = DivideCurve(Curve=trim_2.Inside, Count=expr("x/2", number_slider_10), Kinks=False)  # -> Points, Tangents, Parameters; disabled
divide_4 = DivideCurve(Curve=mirror_2.Geometry, Count=expr("x/2", number_slider_10), Kinks=False)  # -> Points, Tangents, Parameters; disabled
cullpt = CullDuplicates(Points=flatten([divide.Points, divide_2.Points]), Tolerance=0.1, CullMode=3)  # -> Points, Indices, Valence
cullpt_2 = CullDuplicates(Points=flatten([divide_3.Points, divide_4.Points]), Tolerance=0.1, CullMode=3)  # -> Points, Indices, Valence; disabled
panel_2 = Panel("-1")  # disabled
alongcrv = SortAlongCurve(Points=cullpt.Points, Curve=rotate.Geometry)  # -> Points, Indices
alongcrv_2 = SortAlongCurve(Points=cullpt_2.Points, Curve=rotate_2.Geometry)  # -> Points, Indices; disabled
shift = ShiftList(List=alongcrv.Points, Shift="-1", Wrap=True)
number_slider_13 = Slider(5, range=0..10)  # disabled
shift_2 = ShiftList(List=alongcrv_2.Points, Shift=panel_2, Wrap=True)  # disabled
panel_3 = Panel("""0
0.5""")

multiplication_3 = Multiplication(A=division, B=Slider(0.886, range=0..1))
cir = Circle(Plane=PlaneXY(0, 0, 0), Radius=expr("x/2", multiplication_3))
shatter = Shatter(Curve=reparameterize(cir), Parameters=panel_3)
end = EndPoints(Curve=shatter)  # -> Start, End
item = ListItem(List=end.Start, Index=0, Wrap=True)
pt = Point(item)

nurbs = NurbsCurve(Vertices=shift, Degree=3, Periodic=True)  # -> Curve, Length, Domain
panel_4 = Panel("""0
0.5""")  # disabled

number_slider_14 = Slider(0.886, range=0..1)  # disabled
multiplication_4 = Multiplication(A=division_2, B=number_slider_14)  # disabled
cir_2 = Circle(Plane=PlaneXY(0, 0, 0), Radius=expr("x/2", multiplication_4))  # disabled
shatter_2 = Shatter(Curve=reparameterize(cir_2), Parameters=panel_4)  # disabled
end_2 = EndPoints(Curve=shatter_2)  # -> Start, End; disabled
item_2 = ListItem(List=end_2.Start, Index=0, Wrap=True)  # disabled
pt_2 = Point(item_2)  # disabled

nurbs_2 = NurbsCurve(Vertices=shift_2, Degree=3, Periodic=True)  # -> Curve, Length, Domain; disabled
points = PointList(Points=alongcrv.Points, Size=Slider(5, range=0..10))
points_2 = PointList(Points=alongcrv_2.Points, Size=number_slider_13)  # disabled

shatter_3 = Shatter(Curve=reparameterize(nurbs.Curve), Parameters=panel_3)
item_3 = ListItem(List=shatter_3, Index=0, Wrap=True)
end_3 = EndPoints(Curve=item_3)  # -> Start, End
pt_3 = Point(end_3.Start)

shatter_4 = Shatter(Curve=reparameterize(nurbs_2.Curve), Parameters=panel_4)  # disabled
item_4 = ListItem(List=shatter_4, Index=0, Wrap=True)  # disabled
end_4 = EndPoints(Curve=item_4)  # -> Start, End; disabled
pt_4 = Point(end_4.Start)  # disabled

pt_5 = Point(Point(0, 0, 0))
pt_6 = Point(Point(0, 0, 0))  # disabled

ln = Line(StartPoint=pt_3, EndPoint=pt)
flip = FlipCurve(Curve=ln)  # -> Curve, Flag
divide_5 = DivideCurve(Curve=flip.Curve, Count=number_slider_4, Kinks=False)  # -> Points, Tangents, Parameters

ln_2 = Line(StartPoint=pt_4, EndPoint=pt_2)  # disabled
flip_2 = FlipCurve(Curve=ln_2)  # -> Curve, Flag; disabled
divide_6 = DivideCurve(Curve=flip_2.Curve, Count=number_slider_9, Kinks=False)  # -> Points, Tangents, Parameters; disabled

ln_3 = Line(StartPoint=pt_5, EndPoint=pt_3)
ln_4 = Line(StartPoint=pt_6, EndPoint=pt_4)  # disabled
divide_7 = DivideCurve(Curve=ln_3, Count=number_slider_4, Kinks=False)  # -> Points, Tangents, Parameters
divide_8 = DivideCurve(Curve=ln_4, Count=number_slider_9, Kinks=False)  # -> Points, Tangents, Parameters; disabled
Z = UnitZ(Factor=1)
X = UnitX(Factor=1)

dom_3 = ConstructDomain(DomainStart="0", DomainEnd="1")
range = Range(Domain=dom_3, Steps=expr("x-1", number_slider_4))
graph = GraphMapper(
    range,
    x0=0,
    x1=1,
    y0=0,
    y1=1,
    container_name="Bezier",
    cpx=[0, 0.2148601413, 0.5814263821, 1],
    cpy=[0.1250654459, 0.3246698976, 0.3765904307, 0.1016739607])
multiplication_5 = Multiplication(A=graph, B=Slider(40, range=0..100))
amp = Amplitude(Vector=X, Amplitude=multiplication_5)
move = Move(Geometry=divide_5.Points, Motion=amp)  # -> Geometry, Transform

X_2 = UnitX(Factor=1)  # disabled

panel_5 = Panel("0")  # disabled
panel_6 = Panel("1")  # disabled
dom_4 = ConstructDomain(DomainStart=panel_5, DomainEnd=panel_6)  # disabled
number_slider_15 = Slider(39, range=0..100)  # disabled
range_2 = Range(Domain=dom_4, Steps=expr("x-1", number_slider_9))  # disabled
graph_2 = GraphMapper(
    range_2,
    x0=0,
    x1=1,
    y0=0,
    y1=1,
    container_name="Bezier",
    cpx=[0, 0.1363962591, 0.5814263821, 1],
    cpy=[0.05602228642, 0.1605251431, 0.3765904307, 0.1016739607])  # disabled
multiplication_6 = Multiplication(A=graph_2, B=number_slider_15)  # disabled
amp_2 = Amplitude(Vector=X_2, Amplitude=multiplication_6)  # disabled
move_2 = Move(Geometry=divide_6.Points, Motion=amp_2)  # -> Geometry, Transform; disabled

number_slider_16 = Slider(5, range=0..10)
number_slider_17 = Slider(5, range=0..10)  # disabled
crv = Curve(cir)
pt_7 = Point(pt_3)
scale_nu = ScaleNU(Geometry=move.Geometry, Plane=PlaneXY(0, 0, 0), ScaleX=1, ScaleY=number_slider_3, ScaleZ=1)  # -> Geometry, Transform
pt_8 = Point(pt_4)  # disabled
scale_nu_2 = ScaleNU(Geometry=move_2.Geometry, Plane=PlaneXY(0, 0, 0), ScaleX=1, ScaleY=number_slider_8, ScaleZ=1)  # -> Geometry, Transform; disabled
crv_2 = Curve(rotate.Geometry)
pt_9 = Point(flatten([scale_nu.Geometry, pt_7]))
offset = OffsetCurve(Curve=crv, Distance=Slider(3.48, range=0..10), Plane=PlaneXY(0, 0, 0), Corners=1)
crv_3 = Curve(rotate_2.Geometry)  # disabled
pt_10 = Point(flatten([scale_nu_2.Geometry, pt_8]))  # disabled
alongcrv_3 = SortAlongCurve(Points=pt_9, Curve=crv_2)  # -> Points, Indices
alongcrv_4 = SortAlongCurve(Points=pt_10, Curve=crv_3)  # -> Points, Indices; disabled
intcrv = Interpolate(Vertices=alongcrv_3.Points, Degree=3, Periodic=False, KnotStyle=1)  # -> Curve, Length, Domain
crv_4 = Curve(cir_2)  # disabled
xz = XZPlane(Origin=Point(0, 0, 0))
intcrv_2 = Interpolate(Vertices=alongcrv_4.Points, Degree=3, Periodic=False, KnotStyle=1)  # -> Curve, Length, Domain; disabled
xz_2 = XZPlane(Origin=Point(0, 0, 0))  # disabled
mirror_3 = Mirror(Geometry=intcrv.Curve, Plane=PlaneYZ(0, 0, 0))  # -> Geometry, Transform
merge = Merge(Data1=mirror_3.Geometry, Data2=intcrv.Curve)
mirror_4 = Mirror(Geometry=merge, Plane=xz)  # -> Geometry, Transform
mirror_5 = Mirror(Geometry=intcrv_2.Curve, Plane=PlaneYZ(0, 0, 0))  # -> Geometry, Transform; disabled
merge_2 = Merge(Data1=mirror_5.Geometry, Data2=intcrv_2.Curve)  # disabled
mirror_6 = Mirror(Geometry=merge_2, Plane=xz_2)  # -> Geometry, Transform; disabled
offset_2 = OffsetCurve(Curve=crv_4, Distance=1, Plane=PlaneXY(0, 0, 0), Corners=1)  # disabled
join_3 = JoinCurves(Curves=flatten([merge, mirror_4.Geometry]), Preserve=False)
join_4 = JoinCurves(Curves=flatten([merge_2, mirror_6.Geometry]), Preserve=False)  # disabled
divide_9 = DivideCurve(Curve=join_3, Count=expr("x", number_slider_5), Kinks=False)  # -> Points, Tangents, Parameters
alongcrv_5 = SortAlongCurve(Points=divide_9.Points, Curve=crv_2)  # -> Points, Indices
divide_10 = DivideCurve(Curve=join_4, Count=expr("x", number_slider_10), Kinks=False)  # -> Points, Tangents, Parameters; disabled
alongcrv_6 = SortAlongCurve(Points=divide_10.Points, Curve=crv_3)  # -> Points, Indices; disabled
panel_7 = Panel("-1")  # disabled
shift_3 = ShiftList(List=alongcrv_5.Points, Shift="-1", Wrap=True)
nurbs_3 = NurbsCurve(Vertices=shift_3, Degree=3, Periodic=True)  # -> Curve, Length, Domain
shift_4 = ShiftList(List=alongcrv_6.Points, Shift=panel_7, Wrap=True)  # disabled
nurbs_4 = NurbsCurve(Vertices=shift_4, Degree=3, Periodic=True)  # -> Curve, Length, Domain; disabled

shatter_5 = Shatter(Curve=reparameterize(nurbs_3.Curve), Parameters=panel_3)
item_5 = ListItem(List=shatter_5, Index=0, Wrap=True)
end_5 = EndPoints(Curve=item_5)  # -> Start, End
pt_11 = Point(end_5.Start)

shatter_6 = Shatter(Curve=reparameterize(nurbs_4.Curve), Parameters=panel_4)  # disabled
item_6 = ListItem(List=shatter_6, Index=0, Wrap=True)  # disabled
end_6 = EndPoints(Curve=item_6)  # -> Start, End; disabled
pt_12 = Point(end_6.Start)  # disabled

points_3 = PointList(Points=shift_3, Size=number_slider_16)
points_4 = PointList(Points=shift_4, Size=number_slider_17)  # disabled
# NUMBER
# high
number_slider_18 = Slider(13, range=0..100)
number_slider_19 = Slider(20, range=0..100)
# NUMBER
# high
number_slider_20 = Slider(13, range=0..100)  # disabled
number_slider_21 = Slider(2, range=0..10)  # disabled
number_slider_22 = Slider(20, range=0..100)  # disabled
Z_2 = UnitZ(Factor=number_slider_20)  # disabled
crv_5 = Curve(item_3)
crv_6 = Curve(item_6)  # disabled
crv_7 = Curve(item_4)  # disabled
offset_3 = OffsetCurve(Curve=crv_5, Distance=Slider(2, range=0..10), Plane=PlaneXY(0, 0, 0), Corners=1)
mirror_7 = Mirror(Geometry=offset_3, Plane=PlaneYZ(0, 0, 0))  # -> Geometry, Transform
pframes = PerpFrames(Curve=crv_5, Count=number_slider_19, Align=True)  # -> Frames, Parameters
pframes_2 = PerpFrames(Curve=crv_6, Count=number_slider_22, Align=True)  # -> Frames, Parameters; disabled
offset_4 = OffsetCurve(Curve=crv_7, Distance=number_slider_21, Plane=PlaneXY(0, 0, 0), Corners=1)  # disabled
mirror_8 = Mirror(Geometry=offset_4, Plane=PlaneYZ(0, 0, 0))  # -> Geometry, Transform; disabled
pframes_3 = PerpFrames(Curve=crv_7, Count=number_slider_22, Align=True)  # -> Frames, Parameters; disabled
expression_3 = Expression(x=number_slider_19, Expression="x/2")
join_5 = JoinCurves(Curves=flatten([offset_4, mirror_8.Geometry]), Preserve=False)  # disabled
ln_5 = Line(StartPoint=pframes_2.Frames, EndPoint=pframes_3.Frames)  # disabled
Z_3 = UnitZ(Factor=1)
Z_4 = UnitZ(Factor=1)  # disabled
amp_3 = Amplitude(Vector=Z_3, Amplitude=number_slider_18)
amp_4 = Amplitude(Vector=Z_4, Amplitude=number_slider_20)  # disabled
move_3 = Move(Geometry=ln_5, Motion=amp_4)  # -> Geometry, Transform; disabled
end_7 = EndPoints(Curve=ln_5)  # -> Start, End; disabled
crv_8 = Curve(cir)
panel_8 = Panel("""0
1
2""")
end_8 = EndPoints(Curve=move_3.Geometry)  # -> Start, End; disabled
pt_13 = Point(end_7.End)  # disabled
panel_9 = Panel("""0
1
2""")  # disabled
weave = Weave(Pattern=panel_9, Stream0=graft(end_8.Start), Stream1=graft(end_8.End), Stream2=graft(pt_13), NullGaps=False)  # disabled
nurbs_5 = NurbsCurve(Vertices=weave, Degree=3, Periodic=False)  # -> Curve, Length, Domain; disabled

expression_4 = Expression(x=number_slider_22, Expression="x")  # disabled
panel_10 = Panel("0")  # disabled
cull_i = CullIndex(List=flatten(nurbs_5.Curve), Indices=[panel_10, expression_4], Wrap=True)  # disabled

mirror_9 = Mirror(Geometry=cull_i, Plane=PlaneYZ(0, 0, 0))  # -> Geometry, Transform; disabled
merge_3 = Merge(Data1=nurbs_5.Curve, Data2=mirror_9.Geometry)  # disabled

dom_5 = ConstructDomain(DomainStart="0", DomainEnd="1")
range_3 = Range(Domain=dom_5, Steps=expr("x-1", number_slider_4))
graph_3 = GraphMapper(
    range_3,
    x0=0,
    x1=1,
    y0=0,
    y1=1,
    container_name="Bezier",
    cpx=[0, 0.5265420675, 0.6841567159, 1],
    cpy=[0.3605510592, 0.6229159832, 0.4917337298, 0.196573019])
multiplication_7 = Multiplication(A=graph_3, B=Slider(19, range=0..100))

# ----
# z axis
panel_11 = Panel("0")
dom_6 = ConstructDomain(DomainStart=panel_11, DomainEnd="1")
range_4 = Range(Domain=dom_6, Steps=expr("x", number_slider_4))
graph_4 = GraphMapper(
    range_4,
    x0=0,
    x1=1,
    y0=0,
    y1=1,
    container_name="Bezier",
    cpx=[0, 0.4239556491, 0.8639262319, 1],
    cpy=[1, 0.9529126883, 0.9152177572, 0.2086960077])
multiplication_8 = Multiplication(A=graph_4, B=Slider(23, range=0..100))
amp_5 = Amplitude(Vector=Z, Amplitude=multiplication_8)

panel_12 = Panel("0")  # disabled
panel_13 = Panel("1")  # disabled
dom_7 = ConstructDomain(DomainStart=panel_12, DomainEnd=panel_13)  # disabled
number_slider_23 = Slider(19, range=0..100)  # disabled
range_5 = Range(Domain=dom_7, Steps=expr("x-1", number_slider_9))  # disabled
graph_5 = GraphMapper(
    range_5,
    x0=0,
    x1=1,
    y0=0,
    y1=1,
    container_name="Bezier",
    cpx=[0, 0.5265420675, 0.6841567159, 1],
    cpy=[0.3605510592, 0.6229159832, 0.4917337298, 0.196573019])  # disabled
multiplication_9 = Multiplication(A=graph_5, B=number_slider_23)  # disabled

pt_14 = Point(pt_3)
expression_5 = Expression(x=number_slider_4, Expression="x")

item_7 = ListItem(List=multiplication_8, Index=expression_5, Wrap=True)

Z_5 = UnitZ(Factor=item_7)
move_4 = Move(Geometry=pt_14, Motion=Z_5)  # -> Geometry, Transform

X_3 = UnitX(Factor=1)
xz_3 = XZPlane(Origin=Point(0, 0, 0))
expression_6 = Expression(x=number_slider_4, Expression="x")
cull_i_2 = CullIndex(Indices=["0", expression_6], Wrap=True)

amp_6 = Amplitude(Vector=X_3, Amplitude=multiplication_7)
move_5 = Move(Geometry=divide_7.Points, Motion=amp_6)  # -> Geometry, Transform

scale_nu_3 = ScaleNU(Geometry=move_5.Geometry, Plane=PlaneXY(0, 0, 0), ScaleX=1, ScaleY=Slider(0.946, range=0..1), ScaleZ=1)  # -> Geometry, Transform
merge_4 = Merge(Data1=scale_nu_3.Geometry, Data2=pt_11)
mirror_10 = Mirror(Geometry=merge_4, Plane=PlaneYZ(0, 0, 0))  # -> Geometry, Transform
mirror_11 = Mirror(Geometry=[mirror_10.Geometry, merge_4], Plane=xz_3)  # -> Geometry, Transform
pt_15 = Point([merge_4, mirror_10.Geometry])
cullpt_3 = CullDuplicates(Points=flatten([mirror_11.Geometry, pt_15]), Tolerance=0.1, CullMode=3)  # -> Points, Indices, Valence
alongcrv_7 = SortAlongCurve(Points=cullpt_3.Points, Curve=crv_2)  # -> Points, Indices
shift_5 = ShiftList(List=alongcrv_7.Points, Shift=Slider(-2, range=-10..10), Wrap=True)
nurbs_6 = NurbsCurve(Vertices=shift_5, Degree=3, Periodic=True)  # -> Curve, Length, Domain
scale_nu_4 = ScaleNU(Geometry=nurbs_6.Curve, Plane=PlaneXY(0, 0, 0), ScaleX=1, ScaleY=number_slider_3, ScaleZ=1)  # -> Geometry, Transform
rdiff = RegionDifference(CurvesA=scale_nu_4.Geometry, CurvesB=offset)
fillet = Fillet(Curve=rdiff, Radius=Slider(2, range=0..10))

shatter_7 = Shatter(Curve=reparameterize(scale_nu_4.Geometry), Parameters=panel_3)
item_8 = ListItem(List=shatter_7, Index=0, Wrap=True)
end_9 = EndPoints(Curve=item_8)  # -> Start, End
pt_16 = Point(end_9.Start)

X_4 = UnitX(Factor=1)  # disabled
number_slider_24 = Slider(0.946, range=0..1)  # disabled
xz_4 = XZPlane(Origin=Point(0, 0, 0))  # disabled
expression_7 = Expression(x=number_slider_9, Expression="x")  # disabled
panel_14 = Panel("0")  # disabled
cull_i_3 = CullIndex(Indices=[panel_14, expression_7], Wrap=True)  # disabled
number_slider_25 = Slider(-2, range=-10..10)  # disabled
number_slider_26 = Slider(2, range=0..10)  # disabled

amp_7 = Amplitude(Vector=X_4, Amplitude=multiplication_9)  # disabled
move_6 = Move(Geometry=divide_8.Points, Motion=amp_7)  # -> Geometry, Transform; disabled

scale_nu_5 = ScaleNU(Geometry=move_6.Geometry, Plane=PlaneXY(0, 0, 0), ScaleX=1, ScaleY=number_slider_24, ScaleZ=1)  # -> Geometry, Transform; disabled
merge_5 = Merge(Data1=scale_nu_5.Geometry, Data2=pt_12)  # disabled
mirror_12 = Mirror(Geometry=merge_5, Plane=PlaneYZ(0, 0, 0))  # -> Geometry, Transform; disabled
mirror_13 = Mirror(Geometry=[mirror_12.Geometry, merge_5], Plane=xz_4)  # -> Geometry, Transform; disabled
pt_17 = Point([merge_5, mirror_12.Geometry])  # disabled
cullpt_4 = CullDuplicates(Points=flatten([mirror_13.Geometry, pt_17]), Tolerance=0.1, CullMode=3)  # -> Points, Indices, Valence; disabled
alongcrv_8 = SortAlongCurve(Points=cullpt_4.Points, Curve=crv_3)  # -> Points, Indices; disabled
shift_6 = ShiftList(List=alongcrv_8.Points, Shift=number_slider_25, Wrap=True)  # disabled
nurbs_7 = NurbsCurve(Vertices=shift_6, Degree=3, Periodic=True)  # -> Curve, Length, Domain; disabled
scale_nu_6 = ScaleNU(Geometry=nurbs_7.Curve, Plane=PlaneXY(0, 0, 0), ScaleX=1, ScaleY=number_slider_8, ScaleZ=1)  # -> Geometry, Transform; disabled
rdiff_2 = RegionDifference(CurvesA=scale_nu_6.Geometry, CurvesB=offset_2)  # disabled
fillet_2 = Fillet(Curve=rdiff_2, Radius=number_slider_26)  # disabled

shatter_8 = Shatter(Curve=reparameterize(scale_nu_6.Geometry), Parameters=panel_4)  # disabled
item_9 = ListItem(List=shatter_8, Index=0, Wrap=True)  # disabled
end_10 = EndPoints(Curve=item_9)  # -> Start, End; disabled
pt_18 = Point(end_10.Start)  # disabled

crv_9 = Curve([fillet_2, nurbs_4.Curve])  # disabled
boundary = BoundarySurfaces(Edges=crv_9)  # disabled
move_7 = Move(Geometry=boundary, Motion=Z_2)  # -> Geometry, Transform; disabled

scale_nu_7 = ScaleNU(Geometry=move.Geometry, Plane=PlaneXY(0, 0, 0), ScaleX=1, ScaleY=number_slider_3, ScaleZ=1)  # -> Geometry, Transform
crv_10 = Curve(rotate.Geometry)
xz_5 = XZPlane(Origin=Point(0, 0, 0))

move_8 = Move(Geometry=scale_nu_7.Geometry, Motion=amp_5)  # -> Geometry, Transform

pt_19 = Point(flatten([move_4.Geometry, move_8.Geometry]))
alongcrv_9 = SortAlongCurve(Points=pt_19, Curve=crv_10)  # -> Points, Indices
intcrv_3 = Interpolate(Vertices=alongcrv_9.Points, Degree=3, Periodic=False, KnotStyle=1)  # -> Curve, Length, Domain
mirror_14 = Mirror(Geometry=intcrv_3.Curve, Plane=PlaneYZ(0, 0, 0))  # -> Geometry, Transform
merge_6 = Merge(Data1=mirror_14.Geometry, Data2=intcrv_3.Curve)
mirror_15 = Mirror(Geometry=merge_6, Plane=xz_5)  # -> Geometry, Transform
join_6 = JoinCurves(Curves=flatten([merge_6, mirror_15.Geometry]), Preserve=False)
divide_11 = DivideCurve(Curve=join_6, Count=expr("x", number_slider_5), Kinks=False)  # -> Points, Tangents, Parameters
alongcrv_10 = SortAlongCurve(Points=divide_11.Points, Curve=crv_10)  # -> Points, Indices
shift_7 = ShiftList(List=alongcrv_10.Points, Shift="-1", Wrap=True)
nurbs_8 = NurbsCurve(Vertices=shift_7, Degree=3, Periodic=True)  # -> Curve, Length, Domain
points_5 = PointList(Points=shift_7, Size=number_slider_16)

shatter_9 = Shatter(Curve=reparameterize(nurbs_8.Curve), Parameters=panel_3)
item_10 = ListItem(List=shatter_9, Index=0, Wrap=True)
end_11 = EndPoints(Curve=item_10)  # -> Start, End
pt_20 = Point(end_11.Start)

project = Project(Geometry=item_10, Plane=PlaneXY(0, 0, 0))  # -> Geometry, Transform
crv_11 = Curve(project.Geometry)
pframes_4 = PerpFrames(Curve=crv_11, Count=number_slider_19, Align=True)  # -> Frames, Parameters
pframes_5 = PerpFrames(Curve=project.Geometry, Count=number_slider_19, Align=True)  # -> Frames, Parameters
pcx = CurvePlane(Curve=item_10, Plane=pframes_5.Frames)  # -> Points, ParamsC, ParamsP
ln_6 = Line(StartPoint=pframes_4.Frames, EndPoint=pframes.Frames)
move_9 = Move(Geometry=ln_6, Motion=amp_3)  # -> Geometry, Transform
end_12 = EndPoints(Curve=ln_6)  # -> Start, End
pt_21 = Point(end_12.End)
mirror_16 = Mirror(Geometry=item_10, Plane=PlaneYZ(0, 0, 0))  # -> Geometry, Transform
loft = Loft(
    Curves=[mirror_16.Geometry, item_10],
    Options={Adjust=False, Closed=False, LoftEnds=0, LoftSimp=0, LoftType=0, Rebuild=10, Refit=0.01})
project_2 = Project(Curve=fillet, Brep=loft, Direction=Vector(0, 0, 1))
srfsplit = SurfaceSplit(Surface=loft, Curves=flatten(project_2))
item_11 = ListItem(List=srfsplit, Index=0, Wrap=True)

pframes_6 = PerpFrames(Curve=item_10, Count=number_slider_19, Align=True)  # -> Frames, Parameters
pt_22 = Point(flatten(pcx.Points))
Z_6 = UnitZ(Factor=1)

cullpt_5 = CullDuplicates(Points=flatten(pt_22), Tolerance=0.1, CullMode=3)  # -> Points, Indices, Valence
alongcrv_11 = SortAlongCurve(Points=cullpt_5.Points, Curve=crv_2)  # -> Points, Indices

devec = DeconstructVector(Vector=alongcrv_11.Points)  # -> XComponent, YComponent, ZComponent
amp_8 = Amplitude(Vector=Z_6, Amplitude=devec.ZComponent)
move_10 = Move(Geometry=ln_6, Motion=amp_8)  # -> Geometry, Transform

item_12 = ListItem(List=devec.ZComponent, Index=expression_3, Wrap=True)
Z_7 = UnitZ(Factor=item_12)
end_13 = EndPoints(Curve=move_10.Geometry)  # -> Start, End
move_11 = Move(Geometry=crv_8, Motion=Z_7)  # -> Geometry, Transform
weave_2 = Weave(Pattern=panel_8, Stream0=graft(end_13.Start), Stream1=graft(end_13.End), Stream2=graft(pt_21), NullGaps=False)
nurbs_9 = NurbsCurve(Vertices=weave_2, Degree=3, Periodic=False)  # -> Curve, Length, Domain

expression_8 = Expression(x=number_slider_19, Expression="x")
cull_i_4 = CullIndex(List=flatten(nurbs_9.Curve), Indices=["0", expression_8], Wrap=True)

mirror_17 = Mirror(Geometry=cull_i_4, Plane=PlaneYZ(0, 0, 0))  # -> Geometry, Transform
srfsplit_2 = SurfaceSplit(Surface=item_11, Curves=flatten(move_11.Geometry))

merge_7 = Merge(Data1=nurbs_9.Curve, Data2=mirror_17.Geometry)
join_7 = JoinCurves(Curves=flatten([mirror_16.Geometry, item_10]), Preserve=False)
join_8 = JoinCurves(Curves=flatten([offset_3, mirror_7.Geometry]), Preserve=False)

item_13 = ListItem(List=srfsplit_2, Index=0, Wrap=True)
