# Grasshopper definition st.gh (Grasshopper 1.0.7)

# Meissner Tetrahedron 的体积（猜测值）	≈ 0.676	这是 Bonnesen–Fenchel 猜测的最小三维恒宽体体积，尚未严格证明，但数值估计落在此区间
number_slider = Slider(1, range=0..2)
expression = Expression(x=number_slider, Expression="x*2/sqrt(3)")
# 在正四面体里的意义
# 正四面体的高度、外接球半径、内接球半径之间的比例里，都会出现
# 4
# /
# 3
# 。
# 
# 例如：边长为
# 𝑎
#  的正四面体，它的外接球半径
# 𝑅
# =
# 6
# 4
# 𝑎
# ，内接球半径
# 𝑟
# =
# 6
# 12
# 𝑎
# ，这些比例里都会出现类似 1.154 的数。
number_slider_2 = Slider(0.677, range=0..2)
number_slider_3 = Slider(-538, range=-1000..1000)
# 边长
number_slider_4 = Slider(100, range=0..100)
expression_2 = Expression(x=number_slider_4, Expression="x/(2*sqrt(2))/2")
panel = Panel("-1,-1,1")
panel_2 = Panel("1,1,1")
panel_3 = Panel("1,-1,-1")
panel_4 = Panel("-1,1,-1")
pt = ConstructPoint(XCoordinate=expression_2, YCoordinate=expression_2, ZCoordinate=expression_2)
pt_2 = ConstructPoint(XCoordinate=expression_2, YCoordinate=expr("-x", expression_2), ZCoordinate=expr("-x", expression_2))
pt_3 = ConstructPoint(XCoordinate=expr("-x", expression_2), YCoordinate=expression_2, ZCoordinate=expr("-x", expression_2))
pt_4 = ConstructPoint(XCoordinate=expr("-x", expression_2), YCoordinate=expr("-x", expression_2), ZCoordinate=expression_2)
pt_5 = Point(pt)
ln = Line(StartPoint="0,0,0", EndPoint=pt_5)
len = Length(Curve=ln)
panel_5 = Panel(len)
pt_6 = Point(pt_2)
pline = PolyLine(Vertices=[pt_5, pt_6], Closed=True)
pt_7 = Point(pt_4)
merge = Merge(Data1=pt_5, Data2=pt_6, Data3=pt_7)
pt_8 = Point(pt_3)
merge_2 = Merge(Data1=pt_5, Data2=pt_8, Data3=pt_7)
item = ListItem(List=merge_2, Index="0", Wrap=True)
item_2 = ListItem(List=merge_2, Index="2", Wrap=True)
item_3 = ListItem(List=merge_2, Index="1", Wrap=True)
item_4 = ListItem(List=merge, Index="0", Wrap=True)
item_5 = ListItem(List=merge, Index="1", Wrap=True)
item_6 = ListItem(List=merge, Index="2", Wrap=True)
len_2 = Length(Curve=pline)
panel_6 = Panel(len_2)
merge_3 = Merge(Data1=pt_6, Data2=pt_8, Data3=pt_7)
item_7 = ListItem(List=merge_3, Index="0", Wrap=True)
item_8 = ListItem(List=merge_3, Index="1", Wrap=True)
item_9 = ListItem(List=merge_3, Index="2", Wrap=True)
merge_4 = Merge(Data1=pt_5, Data2=pt_6, Data3=pt_8)
item_10 = ListItem(List=merge_4, Index="0", Wrap=True)
item_11 = ListItem(List=merge_4, Index="1", Wrap=True)
item_12 = ListItem(List=merge_4, Index="2", Wrap=True)
pline_2 = PolyLine(Vertices=merge_4, Closed=True)
pline_3 = PolyLine(Vertices=merge, Closed=True)
pline_4 = PolyLine(Vertices=merge_2, Closed=True)
pline_5 = PolyLine(Vertices=merge_3, Closed=True)
number_slider_5 = Slider(-5, range=-10..10)
boundary = BoundarySurfaces(Edges=pline_2)
boundary_2 = BoundarySurfaces(Edges=pline_3)
boundary_3 = BoundarySurfaces(Edges=pline_4)
boundary_4 = BoundarySurfaces(Edges=pline_5)
merge_5 = Merge(Data1=boundary, Data2=boundary_2, Data3=boundary_3, Data4=boundary_4)
yz = YZPlane(Origin=Point(0, 0, 0))
cir = Circle(Plane=yz, Radius=Slider(25, range=0..100))
expression_3 = Expression(x=number_slider_4, Expression="x/4")
box = Box2Pt(PointA="0,0,0", PointB="100,-100,100", Plane=PlaneXY(0, 0, 0))
sph = Sphere(Base=PlaneXY(0, 0, 0), Radius=expression_3)
bbx = BrepBrep(BrepA=box, BrepB=sph)  # -> Curves, Points
srfsplit = SurfaceSplit(Surface=sph, Curves=bbx.Curves)
number_slider_6 = Slider(25, range=0..100)
cyl = Cylinder(Base="0,0,-25", Radius=number_slider_6, Length=Slider(50, range=0..100))
sph_2 = Sphere(Base=PlaneXY(0, 0, 0), Radius=number_slider_6)
xz = XZPlane(Origin=Point(0, 0, 0))
yz_2 = YZPlane(Origin=Point(0, 0, 0))
cap = CapHoles(Brep=cyl)
rotate = Rotate(Geometry=cap, Angle=1.570796327, Plane=yz_2)  # -> Geometry, Transform
rotate_2 = Rotate(Geometry=cap, Angle=1.570796327, Plane=xz)  # -> Geometry, Transform
box_2 = Box2Pt(PointA="0,0,0", PointB="50,-50,50", Plane=PlaneXY(0, 0, 0))
sint = SolidIntersection(BrepsA=rotate.Geometry, BrepsB=rotate_2.Geometry)
box_3 = Box2Pt(PointA="0,0,0", PointB="-50,-50,50", Plane=PlaneXY(0, 0, 0))
sint_2 = SolidIntersection(BrepsA=cyl, BrepsB=sint)
panel_7 = Panel("""0
1
2""")
sint_3 = SolidIntersection(BrepsA=box_3, BrepsB=sint_2)
sint_4 = SolidIntersection(BrepsA=box_2, BrepsB=sph_2)

debrep = DeconstructBrep(Brep=sint_3)  # -> Faces, Edges, Vertices
item_13 = ListItem(List=debrep.Faces, Index=panel_7, Wrap=True)
join = BrepJoin(Breps=flatten(item_13))  # -> Breps, Closed

debrep_2 = DeconstructBrep(Brep=sint_4)  # -> Faces, Edges, Vertices
item_14 = ListItem(List=debrep_2.Faces, Index="0", Wrap=True)

number_slider_7 = Slider(-1, range=-10..10)
scale_nu = ScaleNU(Geometry=join.Breps, Plane=PlaneXY(0, 0, 0), ScaleX=number_slider_7, ScaleY=number_slider_7, ScaleZ=1)  # -> Geometry, Transform
scale_nu_2 = ScaleNU(Geometry=join.Breps, Plane=PlaneXY(0, 0, 0), ScaleX=1, ScaleY=number_slider_7, ScaleZ=number_slider_7)  # -> Geometry, Transform
scale_nu_3 = ScaleNU(Geometry=join.Breps, Plane=PlaneXY(0, 0, 0), ScaleX=number_slider_7, ScaleY=1, ScaleZ=number_slider_7)  # -> Geometry, Transform
scale_nu_4 = ScaleNU(Geometry=item_14, Plane=PlaneXY(0, 0, 0), ScaleX=number_slider_7, ScaleY=number_slider_7, ScaleZ=1)  # -> Geometry, Transform
scale_nu_5 = ScaleNU(Geometry=item_14, Plane=PlaneXY(0, 0, 0), ScaleX=1, ScaleY=number_slider_7, ScaleZ=number_slider_7)  # -> Geometry, Transform
scale_nu_6 = ScaleNU(Geometry=item_14, Plane=PlaneXY(0, 0, 0), ScaleX=number_slider_7, ScaleY=1, ScaleZ=number_slider_7)  # -> Geometry, Transform
merge_6 = Merge(Data1=join.Breps, Data2=scale_nu.Geometry, Data3=scale_nu_2.Geometry, Data4=scale_nu_3.Geometry)
merge_7 = Merge(Data1=item_14, Data2=scale_nu_4.Geometry, Data3=scale_nu_5.Geometry, Data4=scale_nu_6.Geometry)
join_2 = BrepJoin(Breps=flatten([merge_6, merge_7]))  # -> Breps, Closed
preview = CustomPreview(Geometry=join_2.Breps, Material=ColourSwatch(SwatchColor=RGB(184, 184, 184)))

# ----
# 3 Points CENTER
pt_9 = Point(item)
pt_10 = Point(item_3)
pt_11 = Point(item_2)
pl_3pt = Plane3Pt(PointA=pt_9, PointB=pt_10, PointC=pt_11)
pline_6 = PolyLine(Vertices=[pt_9, pt_10], Closed=False)
len_3 = Length(Curve=pline_6)
expression_4 = Expression(x=len_3, Expression="(2/3)*x")

deplane = DeconstructPlane(Plane=pl_3pt)  # -> Origin, XAxis, YAxis, ZAxis
neg = Negative(Value=deplane.YAxis)
pl = ConstructPlane(Origin=pt_10, XAxis=deplane.XAxis, YAxis=deplane.YAxis)

expression_5 = Expression(x=len_3, Expression="(3/4)*x")

pdecon = Deconstruct(Point=pt_9)  # -> XComponent, YComponent, ZComponent
pt_12 = ConstructPoint(XCoordinate=pdecon.XComponent, YCoordinate=pdecon.YComponent, ZCoordinate=pdecon.ZComponent)

cir_2 = Circle(Plane=pl, Radius=expression_5)

pl_2 = ConstructPlane(Origin=pt_11, XAxis=deplane.XAxis, YAxis=deplane.YAxis)
cir_3 = Circle(Plane=pl_2, Radius=expression_4)
cir_4 = Circle(Plane=pl, Radius=expression_4)
cir_5 = Circle(Plane=pl_3pt, Radius=expression_5)
rdiff = RegionDifference(CurvesA=cir_3, CurvesB=cir_4)
rdiff_2 = RegionDifference(CurvesA=cir_5, CurvesB=cir_2)
explode = Explode(Curve=rdiff, Recursive=True)  # -> Segments, Vertices
explode_2 = Explode(Curve=rdiff_2, Recursive=True)  # -> Segments, Vertices
item_15 = ListItem(List=explode.Segments, Index="1", Wrap=True)
item_16 = ListItem(List=explode_2.Segments, Index=0, Wrap=True)
end = EndPoints(Curve=item_15)  # -> Start, End
end_2 = EndPoints(Curve=item_16)  # -> Start, End
pline_7 = PolyLine(Vertices=[end.End, end.Start], Closed=False)
pline_8 = PolyLine(Vertices=[end_2.End, end_2.Start], Closed=False)
llx = LineLine(Line1=pline_8, Line2=pline_7)  # -> ParamA, ParamB, PointA, PointB

pl_3 = ConstructPlane(Origin=llx.PointA, XAxis=deplane.XAxis, YAxis=deplane.YAxis)

expression_6 = Expression(Expression="0")
pdecon_2 = Deconstruct(Point=pl_3)  # -> XComponent, YComponent, ZComponent
addition = Addition(A=Slider(5, range=0..10), B=expression_6)
addition_2 = Addition(A=pdecon_2.ZComponent, B=addition)
pt_13 = ConstructPoint(XCoordinate=pdecon_2.XComponent, YCoordinate=pdecon_2.YComponent, ZCoordinate=pdecon_2.ZComponent)

neg_2 = Negative(Value=addition_2)
Z = UnitZ(Factor=neg_2)
pt_14 = Point(llx.PointA)
move = Move(Geometry=pl_3, Motion=Z)  # -> Geometry, Transform
merge_8 = Merge(Data1=pt_14, Data2=pt_9)
pline_9 = PolyLine(Vertices=flatten(merge_8), Closed=False)
len_4 = Length(Curve=pline_9)
cir_6 = Circle(Plane=pl_3, Radius=len_4)

pt_15 = Point(item_12)
pt_16 = Point(item_11)
# 3 Points CENTER
pt_17 = Point(item_10)
pl_3pt_2 = Plane3Pt(PointA=pt_17, PointB=pt_16, PointC=pt_15)
pline_10 = PolyLine(Vertices=[pt_17, pt_16], Closed=False)
len_5 = Length(Curve=pline_10)
expression_7 = Expression(x=len_5, Expression="(2/3)*x")
cir_7 = Circle(Plane=pl_3pt_2, Radius=expression_7)

deplane_2 = DeconstructPlane(Plane=pl_3pt_2)  # -> Origin, XAxis, YAxis, ZAxis
neg_3 = Negative(Value=deplane_2.YAxis)
pl_4 = ConstructPlane(Origin=pt_16, XAxis=deplane_2.XAxis, YAxis=deplane_2.YAxis)

pl_5 = ConstructPlane(Origin=pt_15, XAxis=deplane_2.XAxis, YAxis=deplane_2.YAxis)
cir_8 = Circle(Plane=pl_4, Radius=expression_7)
cir_9 = Circle(Plane=pl_5, Radius=expression_7)
rdiff_3 = RegionDifference(CurvesA=cir_7, CurvesB=cir_8)
rdiff_4 = RegionDifference(CurvesA=cir_9, CurvesB=cir_8)
explode_3 = Explode(Curve=rdiff_3, Recursive=True)  # -> Segments, Vertices
explode_4 = Explode(Curve=rdiff_4, Recursive=True)  # -> Segments, Vertices
item_17 = ListItem(List=explode_3.Segments, Index=0, Wrap=True)
item_18 = ListItem(List=explode_4.Segments, Index="1", Wrap=True)
end_3 = EndPoints(Curve=item_17)  # -> Start, End
end_4 = EndPoints(Curve=item_18)  # -> Start, End
pline_11 = PolyLine(Vertices=[end_3.End, end_3.Start], Closed=False)
pline_12 = PolyLine(Vertices=[end_4.End, end_4.Start], Closed=False)
llx_2 = LineLine(Line1=pline_11, Line2=pline_12)  # -> ParamA, ParamB, PointA, PointB

pdecon_3 = Deconstruct(Point=pt_17)  # -> XComponent, YComponent, ZComponent
pt_18 = ConstructPoint(XCoordinate=pdecon_3.XComponent, YCoordinate=pdecon_3.YComponent, ZCoordinate=pdecon_3.ZComponent)

pl_6 = ConstructPlane(Origin=llx_2.PointA, XAxis=deplane_2.XAxis, YAxis=deplane_2.YAxis)

expression_8 = Expression(Expression="0")
pdecon_4 = Deconstruct(Point=pl_6)  # -> XComponent, YComponent, ZComponent
addition_3 = Addition(A=Slider(5, range=0..10), B=expression_8)
addition_4 = Addition(A=pdecon_4.ZComponent, B=addition_3)
pt_19 = ConstructPoint(XCoordinate=pdecon_4.XComponent, YCoordinate=pdecon_4.YComponent, ZCoordinate=pdecon_4.ZComponent)

neg_4 = Negative(Value=addition_4)
Z_2 = UnitZ(Factor=neg_4)
move_2 = Move(Geometry=pl_6, Motion=Z_2)  # -> Geometry, Transform

pt_20 = Point(item_4)
pt_21 = Point(item_6)
pt_22 = Point(item_5)
pl_3pt_3 = Plane3Pt(PointA=pt_20, PointB=pt_21, PointC=pt_22)
pline_13 = PolyLine(Vertices=[pt_20, pt_21], Closed=False)
len_6 = Length(Curve=pline_13)
expression_9 = Expression(x=len_6, Expression="(2/3)*x")
cir_10 = Circle(Plane=pl_3pt_3, Radius=expression_9)

deplane_3 = DeconstructPlane(Plane=pl_3pt_3)  # -> Origin, XAxis, YAxis, ZAxis
pl_7 = ConstructPlane(Origin=pt_21, XAxis=deplane_3.XAxis, YAxis=deplane_3.YAxis)
neg_5 = Negative(Value=deplane_3.XAxis)

pl_8 = ConstructPlane(Origin=pt_22, XAxis=deplane_3.XAxis, YAxis=deplane_3.YAxis)
cir_11 = Circle(Plane=pl_8, Radius=expression_9)
cir_12 = Circle(Plane=pl_7, Radius=expression_9)
rdiff_5 = RegionDifference(CurvesA=cir_10, CurvesB=cir_12)
rdiff_6 = RegionDifference(CurvesA=cir_11, CurvesB=cir_12)
explode_5 = Explode(Curve=rdiff_5, Recursive=True)  # -> Segments, Vertices
explode_6 = Explode(Curve=rdiff_6, Recursive=True)  # -> Segments, Vertices
item_19 = ListItem(List=explode_5.Segments, Index=0, Wrap=True)
item_20 = ListItem(List=explode_6.Segments, Index="1", Wrap=True)
end_5 = EndPoints(Curve=item_19)  # -> Start, End
end_6 = EndPoints(Curve=item_20)  # -> Start, End
pline_14 = PolyLine(Vertices=[end_5.End, end_5.Start], Closed=False)
pline_15 = PolyLine(Vertices=[end_6.End, end_6.Start], Closed=False)
llx_3 = LineLine(Line1=pline_14, Line2=pline_15)  # -> ParamA, ParamB, PointA, PointB

pdecon_5 = Deconstruct(Point=pt_20)  # -> XComponent, YComponent, ZComponent
pt_23 = ConstructPoint(XCoordinate=pdecon_5.XComponent, YCoordinate=pdecon_5.YComponent, ZCoordinate=pdecon_5.ZComponent)

pl_9 = ConstructPlane(Origin=llx_3.PointA, XAxis=deplane_3.XAxis, YAxis=deplane_3.YAxis)

expression_10 = Expression(Expression="0")
pdecon_6 = Deconstruct(Point=pl_9)  # -> XComponent, YComponent, ZComponent
addition_5 = Addition(A=Slider(5, range=0..10), B=expression_10)
addition_6 = Addition(A=pdecon_6.ZComponent, B=addition_5)
pt_24 = ConstructPoint(XCoordinate=pdecon_6.XComponent, YCoordinate=pdecon_6.YComponent, ZCoordinate=pdecon_6.ZComponent)

neg_6 = Negative(Value=addition_6)
Z_3 = UnitZ(Factor=neg_6)
move_3 = Move(Geometry=pl_9, Motion=Z_3)  # -> Geometry, Transform

pt_25 = Point(item_7)
pt_26 = Point(item_9)
pt_27 = Point(item_8)
pline_16 = PolyLine(Vertices=[pt_25, pt_27], Closed=False)
pl_3pt_4 = Plane3Pt(PointA=pt_25, PointB=pt_27, PointC=pt_26)
len_7 = Length(Curve=pline_16)
expression_11 = Expression(x=len_7, Expression="(2/3)*x")
cir_13 = Circle(Plane=pl_3pt_4, Radius=expression_11)

deplane_4 = DeconstructPlane(Plane=pl_3pt_4)  # -> Origin, XAxis, YAxis, ZAxis
neg_7 = Negative(Value=deplane_4.YAxis)
pl_10 = ConstructPlane(Origin=pt_27, XAxis=deplane_4.XAxis, YAxis=deplane_4.YAxis)

pl_11 = ConstructPlane(Origin=pt_26, XAxis=deplane_4.XAxis, YAxis=deplane_4.YAxis)
cir_14 = Circle(Plane=pl_10, Radius=expression_11)
cir_15 = Circle(Plane=pl_11, Radius=expression_11)
rdiff_7 = RegionDifference(CurvesA=cir_13, CurvesB=cir_14)
rdiff_8 = RegionDifference(CurvesA=cir_15, CurvesB=cir_14)
explode_7 = Explode(Curve=rdiff_7, Recursive=True)  # -> Segments, Vertices
explode_8 = Explode(Curve=rdiff_8, Recursive=True)  # -> Segments, Vertices
item_21 = ListItem(List=explode_7.Segments, Index=0, Wrap=True)
item_22 = ListItem(List=explode_8.Segments, Index="1", Wrap=True)
end_7 = EndPoints(Curve=item_21)  # -> Start, End
end_8 = EndPoints(Curve=item_22)  # -> Start, End
pline_17 = PolyLine(Vertices=[end_7.End, end_7.Start], Closed=False)
pline_18 = PolyLine(Vertices=[end_8.End, end_8.Start], Closed=False)
llx_4 = LineLine(Line1=pline_17, Line2=pline_18)  # -> ParamA, ParamB, PointA, PointB

pdecon_7 = Deconstruct(Point=pt_25)  # -> XComponent, YComponent, ZComponent
pt_28 = ConstructPoint(XCoordinate=pdecon_7.XComponent, YCoordinate=pdecon_7.YComponent, ZCoordinate=pdecon_7.ZComponent)

pl_12 = ConstructPlane(Origin=llx_4.PointA, XAxis=deplane_4.XAxis, YAxis=deplane_4.YAxis)
pt_29 = Point(pl_12)
ln_2 = Line(StartPoint=pt_29, EndPoint=pt_5)
len_8 = Length(Curve=ln_2)
ln_3 = Line(StartPoint=pt_29, EndPoint=pt_5)
len_9 = Length(Curve=ln_3)
panel_8 = Panel(len_9)
subtraction = Subtraction(A=panel_8, B=panel_5)
panel_9 = Panel(subtraction)
multiplication = Multiplication(A=panel_8, B=Slider(0.5, range=0..2))
subtraction_2 = Subtraction(A=number_slider_6, B=subtraction)
neg_8 = Negative(Value=multiplication)
panel_10 = Panel(multiplication)
panel_11 = Panel(subtraction_2)
neg_9 = Negative(Value=neg_8)

expression_12 = Expression(Expression="0")
pdecon_8 = Deconstruct(Point=pl_12)  # -> XComponent, YComponent, ZComponent
addition_7 = Addition(A=Slider(5, range=0..10), B=expression_12)
addition_8 = Addition(A=pdecon_8.ZComponent, B=addition_7)
pt_30 = ConstructPoint(XCoordinate=pdecon_8.XComponent, YCoordinate=pdecon_8.YComponent, ZCoordinate=pdecon_8.ZComponent)

neg_10 = Negative(Value=pt_30)
Z_4 = UnitZ(Factor=neg_10)
move_4 = Move(Geometry=pl_12, Motion=Z_4)  # -> Geometry, Transform
line = LineSDL(Start=pl_3, Direction=pl_3, Length=neg_8)
line_2 = LineSDL(Start=pl_6, Direction=pl_6, Length=neg_8)
line_3 = LineSDL(Start=pl_12, Direction=pl_12, Length=neg_9)
line_4 = LineSDL(Start=pl_9, Direction=pl_9, Length=neg_8)
end_9 = EndPoints(Curve=flatten(line))  # -> Start, End
end_10 = EndPoints(Curve=flatten(line_2))  # -> Start, End
end_11 = EndPoints(Curve=flatten(line_4))  # -> Start, End
end_12 = EndPoints(Curve=flatten(line_3))  # -> Start, End
pline_19 = PolyLine(Vertices=[pt_9, end_9.End], Closed=False)
pline_20 = PolyLine(Vertices=[pt_11, end_9.End], Closed=False)
pline_21 = PolyLine(Vertices=[pt_10, end_9.End], Closed=False)
len_10 = Length(Curve=line_3)
pline_22 = PolyLine(Vertices=[pt_16, end_10.End], Closed=False)
pline_23 = PolyLine(Vertices=[pt_17, end_10.End], Closed=False)
pline_24 = PolyLine(Vertices=[pt_15, end_10.End], Closed=False)
pline_25 = PolyLine(Vertices=[pt_20, end_11.End], Closed=False)
pline_26 = PolyLine(Vertices=[pt_27, end_12.End], Closed=False)
pline_27 = PolyLine(Vertices=[end_12.End, pt_25], Closed=False)
pline_28 = PolyLine(Vertices=[pt_21, end_11.End], Closed=False)
pline_29 = PolyLine(Vertices=[pt_22, end_11.End], Closed=False)
pline_30 = PolyLine(Vertices=[pt_26, end_12.End], Closed=False)
len_11 = Length(Curve=pline_19)
len_12 = Length(Curve=pline_20)
len_13 = Length(Curve=pline_21)
panel_12 = Panel(len_13)
len_14 = Length(Curve=pline_22)
len_15 = Length(Curve=pline_23)
len_16 = Length(Curve=pline_22)
len_17 = Length(Curve=pline_25)
len_18 = Length(Curve=pline_26)
len_19 = Length(Curve=pline_30)
len_20 = Length(Curve=pline_27)
len_21 = Length(Curve=pline_28)
len_22 = Length(Curve=pline_29)
panel_13 = Panel(len_11)
panel_14 = Panel(len_12)
panel_15 = Panel(len_18)
panel_16 = Panel(len_20)
panel_17 = Panel(len_19)
panel_18 = Panel(len_17)
panel_19 = Panel(len_21)
panel_20 = Panel(len_22)
panel_21 = Panel(len_15)
panel_22 = Panel(len_16)
panel_23 = Panel(len_14)
sph_3 = Sphere(Base=end_12.End, Radius=len_19)
sph_4 = Sphere(Base=end_11.End, Radius=len_21)
sph_5 = Sphere(Base=end_10.End, Radius=len_16)
sph_6 = Sphere(Base=end_9.End, Radius=len_12)
merge_9 = Merge(Data1=sph_5, Data2=sph_6)
merge_10 = Merge(Data1=sph_4, Data2=sph_3)
sint_5 = SolidIntersection(BrepsA=flatten(merge_9), BrepsB=flatten(merge_10))
item_23 = ListItem(List=sint_5, Index="0", Wrap=True)
item_24 = ListItem(List=sint_5, Index="1", Wrap=True)
sint_6 = SolidIntersection(BrepsA=flatten(item_23), BrepsB=flatten(item_24))

panel_24 = Panel("""0
0.25
0.5
0.75""")
debrep_3 = DeconstructBrep(Brep=sint_6)  # -> Faces, Edges, Vertices
shatter = Shatter(Curve=reparameterize(cir), Parameters=panel_24)
edges = BrepEdges(Brep=debrep_3.Faces)  # -> Naked, Interior, NonManifold
panel_25 = Panel("""0
0.5""")
item_25 = ListItem(List=shatter, Index="1", Wrap=False)
panel_26 = Panel("""0
0.5""")
crv = Curve(flatten(edges.Naked))
item_26 = ListItem(List=crv, Index=Slider(1, range=0..10), Wrap=False)
shatter_2 = Shatter(Curve=reparameterize(item_26), Parameters=panel_25)
shatter_3 = Shatter(Curve=reparameterize(item_25), Parameters=panel_26)
explode_9 = Explode(Curve=flatten(item_26), Recursive=True)  # -> Segments, Vertices
item_27 = ListItem(List=shatter_3, Index="0", Wrap=False)
item_28 = ListItem(List=shatter_2, Index="1", Wrap=False)
loft = Loft(
    Curves=flatten([item_27, item_28]),
    Options={Adjust=False, Closed=False, LoftEnds=0, LoftSimp=0, LoftType=0, Rebuild=10, Refit=0.01})
pl_3pt_5 = Plane3Pt(PointA=pt_4, PointB=pt_3, PointC=pl_9)
pl_3pt_6 = Plane3Pt(PointA=pt, PointB=pt_4, PointC="0,0,0")
mirror = Mirror(Geometry=loft, Plane=pl_3pt_5)  # -> Geometry, Transform
number_slider_8 = Slider(3, range=0..10)
merge_11 = Merge(Data1=loft, Data2=mirror.Geometry)
arrpolar = PolarArray(Geometry=merge_11, Plane=pl_9, Count=number_slider_8, Angle=6.283185307)  # -> Geometry, Transform
item_29 = ListItem(List=srfsplit, Index=0, Wrap=True)
join_3 = BrepJoin(Breps=flatten([arrpolar.Geometry, item_29]))  # -> Breps, Closed
arrpolar_2 = PolarArray(Geometry=flatten(join_3.Breps), Plane=pl_3, Count=number_slider_8, Angle=6.283185307)  # -> Geometry, Transform
mirror_2 = Mirror(Geometry=join_3.Breps, Plane=pl_3pt_6)  # -> Geometry, Transform
join_4 = BrepJoin(Breps=flatten([arrpolar_2.Geometry, mirror_2.Geometry]))  # -> Breps, Closed
