# Grasshopper definition st2.gh (Grasshopper 1.0.7)

expression = Expression(x=Slider(1, range=0..2), Expression="x*2/sqrt(3)")
# 在正四面体里的意义
# 正四面体的高度、外接球半径、内接球半径之间的比例里，都会出现
# 4
# /
# 3
# 。
# 
# 例如：边长为
# 𝑎
#  的正四面体，它的外接球半径
# 𝑅
# =
# 6
# 4
# 𝑎
# ，内接球半径
# 𝑟
# =
# 6
# 12
# 𝑎
# ，这些比例里都会出现类似 1.154 的数。
number_slider = Slider(0.677, range=0..2)
number_slider_2 = Slider(-538, range=-1000..1000)
# 边长
number_slider_3 = Slider(100, range=0..100)
expression_2 = Expression(x=number_slider_3, Expression="x/(2*sqrt(2))/2")
panel = Panel("-1,-1,1")
panel_2 = Panel("1,1,1")
panel_3 = Panel("1,-1,-1")
panel_4 = Panel("-1,1,-1")
pt = ConstructPoint(XCoordinate=expression_2, YCoordinate=expression_2, ZCoordinate=expression_2)
pt_2 = ConstructPoint(XCoordinate=expression_2, YCoordinate=expr("-x", expression_2), ZCoordinate=expr("-x", expression_2))
pt_3 = ConstructPoint(XCoordinate=expr("-x", expression_2), YCoordinate=expression_2, ZCoordinate=expr("-x", expression_2))
pt_4 = ConstructPoint(XCoordinate=expr("-x", expression_2), YCoordinate=expr("-x", expression_2), ZCoordinate=expression_2)
pt_5 = Point(pt)
ln = Line(StartPoint="0,0,0", EndPoint=pt_5)
len = Length(Curve=ln)
# 中点到端点
# Meissner Tetrahedron 的体积（猜测值）	≈ 0.676	这是 Bonnesen–Fenchel 猜测的最小三维恒宽体体积，尚未严格证明，但数值估计落在此区间
panel_5 = Panel(len)
pt_6 = Point(pt_2)
pline = PolyLine(Vertices=[pt_5, pt_6], Closed=True)
pt_7 = Point(pt_4)
merge = Merge(Data1=pt_5, Data2=pt_6, Data3=pt_7)
pt_8 = Point(pt_3)
merge_2 = Merge(Data1=pt_5, Data2=pt_8, Data3=pt_7)
item = ListItem(List=merge_2, Index="0", Wrap=True)
item_2 = ListItem(List=merge_2, Index="2", Wrap=True)
item_3 = ListItem(List=merge_2, Index="1", Wrap=True)
item_4 = ListItem(List=merge, Index="0", Wrap=True)
item_5 = ListItem(List=merge, Index="1", Wrap=True)
item_6 = ListItem(List=merge, Index="2", Wrap=True)
len_2 = Length(Curve=pline)
panel_6 = Panel(len_2)
merge_3 = Merge(Data1=pt_6, Data2=pt_8, Data3=pt_7)
item_7 = ListItem(List=merge_3, Index="0", Wrap=True)
item_8 = ListItem(List=merge_3, Index="1", Wrap=True)
item_9 = ListItem(List=merge_3, Index="2", Wrap=True)
merge_4 = Merge(Data1=pt_5, Data2=pt_6, Data3=pt_8)
item_10 = ListItem(List=merge_4, Index="0", Wrap=True)
item_11 = ListItem(List=merge_4, Index="1", Wrap=True)
item_12 = ListItem(List=merge_4, Index="2", Wrap=True)
pline_2 = PolyLine(Vertices=merge_4, Closed=True)
pline_3 = PolyLine(Vertices=merge, Closed=True)
pline_4 = PolyLine(Vertices=merge_2, Closed=True)
pline_5 = PolyLine(Vertices=merge_3, Closed=True)
number_slider_4 = Slider(-5, range=-10..10)
boundary = BoundarySurfaces(Edges=pline_2)
boundary_2 = BoundarySurfaces(Edges=pline_3)
boundary_3 = BoundarySurfaces(Edges=pline_4)
boundary_4 = BoundarySurfaces(Edges=pline_5)
merge_5 = Merge(Data1=boundary, Data2=boundary_2, Data3=boundary_3, Data4=boundary_4)
# 2xlengh
number_slider_5 = Slider(2, range=0..3)
yz = YZPlane(Origin=Point(0, 0, 0))
expression_3 = Expression(x=Slider(1, range=0..2), Expression="x*2/sqrt(3)")
cir = Circle(Plane=yz, Radius=Slider(25, range=0..100))
number_slider_6 = Slider(1, range=0..1)
panel_7 = Panel("-25,25,-25")
panel_8 = Panel("25,-25,25")
pt_9 = ConstructPoint(XCoordinate=expr("-x", expression_2), YCoordinate=expression_2, ZCoordinate=expr("-x", expression_2))
pt_10 = ConstructPoint(XCoordinate=expression_2, YCoordinate=expr("-x", expression_2), ZCoordinate=expression_2)
box = Box2Pt(PointA=pt_9, PointB=pt_10, Plane=PlaneXY(0, 0, 0))
neg = Negative(Value="81.54461")
number_slider_7 = Slider(25, range=0..100)
cyl = Cylinder(Base="0,0,-25", Radius=number_slider_7, Length=Slider(50, range=0..100))
sph = Sphere(Base=PlaneXY(0, 0, 0), Radius=number_slider_7)
xz = XZPlane(Origin=Point(0, 0, 0))
yz_2 = YZPlane(Origin=Point(0, 0, 0))
cap = CapHoles(Brep=cyl)
number_slider_8 = Slider(-5, range=-10..10)
rotate = Rotate(Geometry=cap, Angle=1.570796327, Plane=yz_2)  # -> Geometry, Transform
rotate_2 = Rotate(Geometry=cap, Angle=1.570796327, Plane=xz)  # -> Geometry, Transform
box_2 = Box2Pt(PointA="0,0,0", PointB="50,-50,50", Plane=PlaneXY(0, 0, 0))
sint = SolidIntersection(BrepsA=rotate.Geometry, BrepsB=rotate_2.Geometry)
box_3 = Box2Pt(PointA="0,0,0", PointB="-50,-50,50", Plane=PlaneXY(0, 0, 0))
sint_2 = SolidIntersection(BrepsA=cyl, BrepsB=sint)
panel_9 = Panel("""0
1
2""")
sint_3 = SolidIntersection(BrepsA=box_3, BrepsB=sint_2)
sint_4 = SolidIntersection(BrepsA=box_2, BrepsB=sph)

debrep = DeconstructBrep(Brep=sint_3)  # -> Faces, Edges, Vertices
item_13 = ListItem(List=debrep.Faces, Index=panel_9, Wrap=True)
join = BrepJoin(Breps=flatten(item_13))  # -> Breps, Closed

debrep_2 = DeconstructBrep(Brep=sint_4)  # -> Faces, Edges, Vertices
item_14 = ListItem(List=debrep_2.Faces, Index="0", Wrap=True)

number_slider_9 = Slider(-1, range=-10..10)
scale_nu = ScaleNU(Geometry=join.Breps, Plane=PlaneXY(0, 0, 0), ScaleX=number_slider_9, ScaleY=number_slider_9, ScaleZ=1)  # -> Geometry, Transform
scale_nu_2 = ScaleNU(Geometry=join.Breps, Plane=PlaneXY(0, 0, 0), ScaleX=1, ScaleY=number_slider_9, ScaleZ=number_slider_9)  # -> Geometry, Transform
scale_nu_3 = ScaleNU(Geometry=join.Breps, Plane=PlaneXY(0, 0, 0), ScaleX=number_slider_9, ScaleY=1, ScaleZ=number_slider_9)  # -> Geometry, Transform
scale_nu_4 = ScaleNU(Geometry=item_14, Plane=PlaneXY(0, 0, 0), ScaleX=number_slider_9, ScaleY=number_slider_9, ScaleZ=1)  # -> Geometry, Transform
scale_nu_5 = ScaleNU(Geometry=item_14, Plane=PlaneXY(0, 0, 0), ScaleX=1, ScaleY=number_slider_9, ScaleZ=number_slider_9)  # -> Geometry, Transform
scale_nu_6 = ScaleNU(Geometry=item_14, Plane=PlaneXY(0, 0, 0), ScaleX=number_slider_9, ScaleY=1, ScaleZ=number_slider_9)  # -> Geometry, Transform
merge_6 = Merge(Data1=join.Breps, Data2=scale_nu.Geometry, Data3=scale_nu_2.Geometry, Data4=scale_nu_3.Geometry)
panel_10 = Panel("1")
merge_7 = Merge(Data1=item_14, Data2=scale_nu_4.Geometry, Data3=scale_nu_5.Geometry, Data4=scale_nu_6.Geometry)
item_15 = ListItem(Index="1", Wrap=True)
join_2 = BrepJoin(Breps=flatten([merge_6, merge_7]))  # -> Breps, Closed
preview = CustomPreview(Material=ColourSwatch(SwatchColor=RGB(184, 184, 184)))

# ----
# 圆切中点确定长度
pt_11 = Point(item_7)
pt_12 = Point(item_8)
pt_13 = Point(item_9)
pline_6 = PolyLine(Vertices=[pt_11, pt_12], Closed=False)
pl_3pt = Plane3Pt(PointA=pt_11, PointB=pt_12, PointC=pt_13)
len_3 = Length(Curve=pline_6)
expression_4 = Expression(x=len_3, Expression="(2/3)*x")
cir_2 = Circle(Plane=pl_3pt, Radius=expression_4)

deplane = DeconstructPlane(Plane=pl_3pt)  # -> Origin, XAxis, YAxis, ZAxis
neg_2 = Negative(Value=deplane.YAxis)
pl = ConstructPlane(Origin=pt_12, XAxis=deplane.XAxis, YAxis=deplane.YAxis)

pl_2 = ConstructPlane(Origin=pt_13, XAxis=deplane.XAxis, YAxis=deplane.YAxis)
cir_3 = Circle(Plane=pl, Radius=expression_4)
cir_4 = Circle(Plane=pl_2, Radius=expression_4)
rdiff = RegionDifference(CurvesA=cir_2, CurvesB=cir_3)
rdiff_2 = RegionDifference(CurvesA=cir_4, CurvesB=cir_3)
explode = Explode(Curve=rdiff, Recursive=True)  # -> Segments, Vertices
explode_2 = Explode(Curve=rdiff_2, Recursive=True)  # -> Segments, Vertices
item_16 = ListItem(List=explode.Segments, Index=0, Wrap=True)
item_17 = ListItem(List=explode_2.Segments, Index="1", Wrap=True)
end = EndPoints(Curve=item_16)  # -> Start, End
end_2 = EndPoints(Curve=item_17)  # -> Start, End
pline_7 = PolyLine(Vertices=[end.End, end.Start], Closed=False)
pline_8 = PolyLine(Vertices=[end_2.End, end_2.Start], Closed=False)
llx = LineLine(Line1=pline_7, Line2=pline_8)  # -> ParamA, ParamB, PointA, PointB

pdecon = Deconstruct(Point=pt_11)  # -> XComponent, YComponent, ZComponent
pt_14 = ConstructPoint(XCoordinate=pdecon.XComponent, YCoordinate=pdecon.YComponent, ZCoordinate=pdecon.ZComponent)

pl_3 = ConstructPlane(Origin=llx.PointA, XAxis=deplane.XAxis, YAxis=deplane.YAxis)

pt_15 = Point(item_2)
# 3 Points CENTER
pt_16 = Point(item)
pt_17 = Point(item_3)
pl_3pt_2 = Plane3Pt(PointA=pt_16, PointB=pt_17, PointC=pt_15)
pline_9 = PolyLine(Vertices=[pt_16, pt_17], Closed=False)
len_4 = Length(Curve=pline_9)
expression_5 = Expression(x=len_4, Expression="(2/3)*x")

deplane_2 = DeconstructPlane(Plane=pl_3pt_2)  # -> Origin, XAxis, YAxis, ZAxis
neg_3 = Negative(Value=deplane_2.YAxis)
pl_4 = ConstructPlane(Origin=pt_17, XAxis=deplane_2.XAxis, YAxis=deplane_2.YAxis)

expression_6 = Expression(x=len_4, Expression="(3/4)*x")

pdecon_2 = Deconstruct(Point=pt_16)  # -> XComponent, YComponent, ZComponent
pt_18 = ConstructPoint(XCoordinate=pdecon_2.XComponent, YCoordinate=pdecon_2.YComponent, ZCoordinate=pdecon_2.ZComponent)

cir_5 = Circle(Plane=pl_4, Radius=expression_6)

pl_5 = ConstructPlane(Origin=pt_15, XAxis=deplane_2.XAxis, YAxis=deplane_2.YAxis)
cir_6 = Circle(Plane=pl_5, Radius=expression_5)
cir_7 = Circle(Plane=pl_4, Radius=expression_5)
cir_8 = Circle(Plane=pl_3pt_2, Radius=expression_6)
rdiff_3 = RegionDifference(CurvesA=cir_6, CurvesB=cir_7)
rdiff_4 = RegionDifference(CurvesA=cir_8, CurvesB=cir_5)
explode_3 = Explode(Curve=rdiff_3, Recursive=True)  # -> Segments, Vertices
explode_4 = Explode(Curve=rdiff_4, Recursive=True)  # -> Segments, Vertices
item_18 = ListItem(List=explode_3.Segments, Index="1", Wrap=True)
item_19 = ListItem(List=explode_4.Segments, Index=0, Wrap=True)
end_3 = EndPoints(Curve=item_18)  # -> Start, End
end_4 = EndPoints(Curve=item_19)  # -> Start, End
pline_10 = PolyLine(Vertices=[end_3.End, end_3.Start], Closed=False)
pline_11 = PolyLine(Vertices=[end_4.End, end_4.Start], Closed=False)
llx_2 = LineLine(Line1=pline_11, Line2=pline_10)  # -> ParamA, ParamB, PointA, PointB

pl_6 = ConstructPlane(Origin=llx_2.PointA, XAxis=deplane_2.XAxis, YAxis=deplane_2.YAxis)

expression_7 = Expression(Expression="0")
pdecon_3 = Deconstruct(Point=pl_6)  # -> XComponent, YComponent, ZComponent
addition = Addition(A=Slider(5, range=0..10), B=expression_7)
addition_2 = Addition(A=pdecon_3.ZComponent, B=addition)
pt_19 = ConstructPoint(XCoordinate=pdecon_3.XComponent, YCoordinate=pdecon_3.YComponent, ZCoordinate=pdecon_3.ZComponent)

neg_4 = Negative(Value=addition_2)
Z = UnitZ(Factor=neg_4)
pt_20 = Point(llx_2.PointA)
move = Move(Geometry=pl_6, Motion=Z)  # -> Geometry, Transform
merge_8 = Merge(Data1=pt_20, Data2=pt_16)
pline_12 = PolyLine(Vertices=flatten(merge_8), Closed=False)
len_5 = Length(Curve=pline_12)
cir_9 = Circle(Plane=pl_6, Radius=len_5)

pt_21 = Point(item_12)
pt_22 = Point(item_11)
# 3 Points CENTER
pt_23 = Point(item_10)
pl_3pt_3 = Plane3Pt(PointA=pt_23, PointB=pt_22, PointC=pt_21)
pline_13 = PolyLine(Vertices=[pt_23, pt_22], Closed=False)
len_6 = Length(Curve=pline_13)
expression_8 = Expression(x=len_6, Expression="(2/3)*x")
cir_10 = Circle(Plane=pl_3pt_3, Radius=expression_8)

deplane_3 = DeconstructPlane(Plane=pl_3pt_3)  # -> Origin, XAxis, YAxis, ZAxis
neg_5 = Negative(Value=deplane_3.YAxis)
pl_7 = ConstructPlane(Origin=pt_22, XAxis=deplane_3.XAxis, YAxis=deplane_3.YAxis)

pl_8 = ConstructPlane(Origin=pt_21, XAxis=deplane_3.XAxis, YAxis=deplane_3.YAxis)
cir_11 = Circle(Plane=pl_7, Radius=expression_8)
cir_12 = Circle(Plane=pl_8, Radius=expression_8)
rdiff_5 = RegionDifference(CurvesA=cir_10, CurvesB=cir_11)
rdiff_6 = RegionDifference(CurvesA=cir_12, CurvesB=cir_11)
explode_5 = Explode(Curve=rdiff_5, Recursive=True)  # -> Segments, Vertices
explode_6 = Explode(Curve=rdiff_6, Recursive=True)  # -> Segments, Vertices
item_20 = ListItem(List=explode_5.Segments, Index=0, Wrap=True)
item_21 = ListItem(List=explode_6.Segments, Index="1", Wrap=True)
end_5 = EndPoints(Curve=item_20)  # -> Start, End
end_6 = EndPoints(Curve=item_21)  # -> Start, End
pline_14 = PolyLine(Vertices=[end_5.End, end_5.Start], Closed=False)
pline_15 = PolyLine(Vertices=[end_6.End, end_6.Start], Closed=False)
llx_3 = LineLine(Line1=pline_14, Line2=pline_15)  # -> ParamA, ParamB, PointA, PointB

pdecon_4 = Deconstruct(Point=pt_23)  # -> XComponent, YComponent, ZComponent
pt_24 = ConstructPoint(XCoordinate=pdecon_4.XComponent, YCoordinate=pdecon_4.YComponent, ZCoordinate=pdecon_4.ZComponent)

pl_9 = ConstructPlane(Origin=llx_3.PointA, XAxis=deplane_3.XAxis, YAxis=deplane_3.YAxis)

expression_9 = Expression(Expression="0")
pdecon_5 = Deconstruct(Point=pl_9)  # -> XComponent, YComponent, ZComponent
addition_3 = Addition(A=Slider(5, range=0..10), B=expression_9)
addition_4 = Addition(A=pdecon_5.ZComponent, B=addition_3)
pt_25 = ConstructPoint(XCoordinate=pdecon_5.XComponent, YCoordinate=pdecon_5.YComponent, ZCoordinate=pdecon_5.ZComponent)

neg_6 = Negative(Value=addition_4)
Z_2 = UnitZ(Factor=neg_6)
move_2 = Move(Geometry=pl_9, Motion=Z_2)  # -> Geometry, Transform

pt_26 = Point(item_4)
pt_27 = Point(item_6)
pt_28 = Point(item_5)
pl_3pt_4 = Plane3Pt(PointA=pt_26, PointB=pt_27, PointC=pt_28)
pline_16 = PolyLine(Vertices=[pt_26, pt_27], Closed=False)
len_7 = Length(Curve=pline_16)
expression_10 = Expression(x=len_7, Expression="(2/3)*x")
cir_13 = Circle(Plane=pl_3pt_4, Radius=expression_10)

deplane_4 = DeconstructPlane(Plane=pl_3pt_4)  # -> Origin, XAxis, YAxis, ZAxis
neg_7 = Negative(Value=deplane_4.YAxis)
pl_10 = ConstructPlane(Origin=pt_27, XAxis=deplane_4.XAxis, YAxis=deplane_4.YAxis)

pl_11 = ConstructPlane(Origin=pt_28, XAxis=deplane_4.XAxis, YAxis=deplane_4.YAxis)
cir_14 = Circle(Plane=pl_11, Radius=expression_10)
cir_15 = Circle(Plane=pl_10, Radius=expression_10)
rdiff_7 = RegionDifference(CurvesA=cir_13, CurvesB=cir_15)
rdiff_8 = RegionDifference(CurvesA=cir_14, CurvesB=cir_15)
explode_7 = Explode(Curve=rdiff_7, Recursive=True)  # -> Segments, Vertices
explode_8 = Explode(Curve=rdiff_8, Recursive=True)  # -> Segments, Vertices
item_22 = ListItem(List=explode_7.Segments, Index=0, Wrap=True)
item_23 = ListItem(List=explode_8.Segments, Index="1", Wrap=True)
end_7 = EndPoints(Curve=item_22)  # -> Start, End
end_8 = EndPoints(Curve=item_23)  # -> Start, End
pline_17 = PolyLine(Vertices=[end_7.End, end_7.Start], Closed=False)
pline_18 = PolyLine(Vertices=[end_8.End, end_8.Start], Closed=False)
llx_4 = LineLine(Line1=pline_17, Line2=pline_18)  # -> ParamA, ParamB, PointA, PointB

pdecon_6 = Deconstruct(Point=pt_26)  # -> XComponent, YComponent, ZComponent
pt_29 = ConstructPoint(XCoordinate=pdecon_6.XComponent, YCoordinate=pdecon_6.YComponent, ZCoordinate=pdecon_6.ZComponent)

pl_12 = ConstructPlane(Origin=llx_4.PointA, XAxis=deplane_4.XAxis, YAxis=deplane_4.YAxis)

expression_11 = Expression(Expression="0")
pdecon_7 = Deconstruct(Point=pl_12)  # -> XComponent, YComponent, ZComponent
addition_5 = Addition(A=Slider(5, range=0..10), B=expression_11)
addition_6 = Addition(A=pdecon_7.ZComponent, B=addition_5)
pt_30 = ConstructPoint(XCoordinate=pdecon_7.XComponent, YCoordinate=pdecon_7.YComponent, ZCoordinate=pdecon_7.ZComponent)

neg_8 = Negative(Value=addition_6)
Z_3 = UnitZ(Factor=neg_8)
move_3 = Move(Geometry=pl_12, Motion=Z_3)  # -> Geometry, Transform

pt_31 = Point(item_7)
pt_32 = Point(item_9)
pt_33 = Point(item_8)
pline_19 = PolyLine(Vertices=[pt_31, pt_33], Closed=False)
pl_3pt_5 = Plane3Pt(PointA=pt_31, PointB=pt_33, PointC=pt_32)
len_8 = Length(Curve=pline_19)
expression_12 = Expression(x=len_8, Expression="(2/3)*x")
cir_16 = Circle(Plane=pl_3pt_5, Radius=expression_12)

deplane_5 = DeconstructPlane(Plane=pl_3pt_5)  # -> Origin, XAxis, YAxis, ZAxis
neg_9 = Negative(Value=deplane_5.YAxis)
pl_13 = ConstructPlane(Origin=pt_33, XAxis=deplane_5.XAxis, YAxis=deplane_5.YAxis)

pl_14 = ConstructPlane(Origin=pt_32, XAxis=deplane_5.XAxis, YAxis=deplane_5.YAxis)
cir_17 = Circle(Plane=pl_13, Radius=expression_12)
cir_18 = Circle(Plane=pl_14, Radius=expression_12)
rdiff_9 = RegionDifference(CurvesA=cir_16, CurvesB=cir_17)
rdiff_10 = RegionDifference(CurvesA=cir_18, CurvesB=cir_17)
explode_9 = Explode(Curve=rdiff_9, Recursive=True)  # -> Segments, Vertices
explode_10 = Explode(Curve=rdiff_10, Recursive=True)  # -> Segments, Vertices
item_24 = ListItem(List=explode_9.Segments, Index=0, Wrap=True)
item_25 = ListItem(List=explode_10.Segments, Index="1", Wrap=True)
end_9 = EndPoints(Curve=item_24)  # -> Start, End
end_10 = EndPoints(Curve=item_25)  # -> Start, End
pline_20 = PolyLine(Vertices=[end_9.End, end_9.Start], Closed=False)
pline_21 = PolyLine(Vertices=[end_10.End, end_10.Start], Closed=False)
llx_5 = LineLine(Line1=pline_20, Line2=pline_21)  # -> ParamA, ParamB, PointA, PointB

pdecon_8 = Deconstruct(Point=pt_31)  # -> XComponent, YComponent, ZComponent
pt_34 = ConstructPoint(XCoordinate=pdecon_8.XComponent, YCoordinate=pdecon_8.YComponent, ZCoordinate=pdecon_8.ZComponent)

pl_15 = ConstructPlane(Origin=llx_5.PointA, XAxis=deplane_5.XAxis, YAxis=deplane_5.YAxis)
ln_2 = Line(StartPoint=pt_31, EndPoint=pl_15)
len_9 = Length(Curve=ln_2)
panel_11 = Panel(len_9)
pt_35 = Point(pl_15)
ln_3 = Line(StartPoint=pt_35, EndPoint=pt_5)
len_10 = Length(Curve=ln_3)
ln_4 = Line(StartPoint=pt_35, EndPoint=pt_5)
len_11 = Length(Curve=ln_4)
panel_12 = Panel(len_11)
subtraction = Subtraction(A=panel_12, B=panel_5)
subtraction_2 = Subtraction(A=number_slider_7, B=subtraction)
# 弧高
panel_13 = Panel(subtraction_2)
panel_14 = Panel(subtraction)
multiplication = Multiplication(A=panel_12, B=Slider(0.5, range=0..25))
panel_15 = Panel(multiplication)
panel_16 = Panel(len_11)

expression_13 = Expression(Expression="0")
pdecon_9 = Deconstruct(Point=pl_15)  # -> XComponent, YComponent, ZComponent
addition_7 = Addition(A=Slider(5, range=0..10), B=expression_13)
addition_8 = Addition(A=pdecon_9.ZComponent, B=addition_7)
pt_36 = ConstructPoint(XCoordinate=pdecon_9.XComponent, YCoordinate=pdecon_9.YComponent, ZCoordinate=pdecon_9.ZComponent)

multiplication_2 = Multiplication(A=panel_12, B=Slider(2, range=0..3))
neg_10 = Negative(Value=pt_36)
neg_11 = Negative(Value=multiplication_2)
Z_4 = UnitZ(Factor=neg_10)
move_4 = Move(Geometry=pl_15, Motion=Z_4)  # -> Geometry, Transform
line = LineSDL(Start=pl_3, Direction=pl_3, Length=neg_11)
ln_5 = Line(StartPoint=pt_33, EndPoint=pl_15)
ln_6 = Line(StartPoint="0,0,0", EndPoint=pl_15)
len_12 = Length(Curve=ln_5)
len_13 = Length(Curve=ln_6)
panel_17 = Panel(len_12)
panel_18 = Panel(len_13)
panel_19 = Panel(panel_18)
subtraction_3 = Subtraction(A=number_slider_7, B=panel_19)
panel_20 = Panel(subtraction_3)
neg_12 = Negative(Value=panel_20)
line_2 = LineSDL(Start=pl_3, Direction=pl_3, Length=neg_12)
end_11 = EndPoints(Curve=line_2)  # -> Start, End
ln_7 = Line(StartPoint=end_11.End, EndPoint=pt_33)
pl_3pt_6 = Plane3Pt(PointA=end_11.End, PointB=pt_33, PointC="0,0,0")
pframes = PerpFrames(Curve=ln_7, Count=Slider(2, range=0..10), Align=True)  # -> Frames, Parameters
deplane_6 = DeconstructPlane(Plane=pl_3pt_6)  # -> Origin, XAxis, YAxis, ZAxis
len_14 = Length(Curve=ln_7)
item_26 = ListItem(List=pframes.Frames, Index="1", Wrap=True)
panel_21 = Panel(len_14)
deplane_7 = DeconstructPlane(Plane=item_26)  # -> Origin, XAxis, YAxis, ZAxis
pl_16 = ConstructPlane(Origin=item_26, XAxis=deplane_6.YAxis, YAxis=deplane_7.ZAxis)
deplane_8 = DeconstructPlane(Plane=pl_16)  # -> Origin, XAxis, YAxis, ZAxis
pl_17 = ConstructPlane(Origin=item_26, XAxis=deplane_8.ZAxis, YAxis=deplane_8.YAxis)
multiplication_3 = Multiplication(A=panel_12, B=expression_3)
multiplication_4 = Multiplication(A=panel_12, B=number_slider_5)
neg_13 = Negative(Value=multiplication_4)
line_3 = LineSDL(Start=pl_16, Direction=pl_17, Length=neg_13)
ccx = CurveCurve(CurveA=line_3, CurveB=ln_4)  # -> Points, ParamsA, ParamsB
ln_8 = Line(StartPoint=ccx.Points, EndPoint=pt_33)
len_15 = Length(Curve=ln_8)
panel_23 = Panel(len_15)
subtraction_4 = Subtraction(A=panel_23, B=panel_20)
panel_24 = Panel(subtraction_4)
neg_14 = Negative(Value=panel_24)
neg_15 = Negative(Value=neg_14)
line_4 = LineSDL(Start=pl_6, Direction=pl_6, Length=neg_14)
line_5 = LineSDL(Start=pl_15, Direction=pl_15, Length=neg_15)
line_6 = LineSDL(Start=pl_9, Direction=pl_9, Length=neg_14)
line_7 = LineSDL(Start=pl_12, Direction=pl_12, Length=neg_14)
end_12 = EndPoints(Curve=flatten(line_4))  # -> Start, End
line_8 = LineSDL(Start=pl_12, Direction=Vector(0, 0, 1), Length=neg_14)
end_13 = EndPoints(Curve=flatten(line_6))  # -> Start, End
end_14 = EndPoints(Curve=flatten(line_5))  # -> Start, End
pline_22 = PolyLine(Vertices=[pt_16, end_12.End], Closed=False)
pline_23 = PolyLine(Vertices=[pt_15, end_12.End], Closed=False)
end_15 = EndPoints(Curve=flatten(line_7))  # -> Start, End
pline_24 = PolyLine(Vertices=[pt_17, end_12.End], Closed=False)
pline_25 = PolyLine(Vertices=[pt_22, end_13.End], Closed=False)
pline_26 = PolyLine(Vertices=[pt_23, end_13.End], Closed=False)
pline_27 = PolyLine(Vertices=[pt_21, end_13.End], Closed=False)
end_16 = EndPoints(Curve=flatten(line_8))  # -> Start, End
pline_28 = PolyLine(Vertices=[pt_26, end_15.End], Closed=False)
pline_29 = PolyLine(Vertices=[pt_27, end_15.End], Closed=False)
pline_30 = PolyLine(Vertices=[pt_28, end_15.End], Closed=False)
pline_31 = PolyLine(Vertices=[pt_32, end_14.End], Closed=False)
pline_32 = PolyLine(Vertices=[pt_33, end_14.End], Closed=False)
pline_33 = PolyLine(Vertices=[pt_31, end_14.End], Closed=False)
len_16 = Length(Curve=pline_22)
len_17 = Length(Curve=pline_23)
len_18 = Length(Curve=pline_24)
len_19 = Length(Curve=pline_25)
len_20 = Length(Curve=pline_26)
len_21 = Length(Curve=pline_25)
len_22 = Length(Curve=pline_28)
len_23 = Length(Curve=pline_31)
len_24 = Length(Curve=pline_29)
len_25 = Length(Curve=pline_30)
len_26 = Length(Curve=pline_32)
len_27 = Length(Curve=pline_33)
panel_25 = Panel(len_18)
panel_26 = Panel(len_16)
panel_27 = Panel(len_17)
panel_28 = Panel(len_23)
panel_29 = Panel(len_22)
panel_30 = Panel(len_26)
panel_31 = Panel(len_24)
panel_32 = Panel(len_25)
panel_33 = Panel(len_27)
panel_34 = Panel(len_20)
panel_35 = Panel(len_21)
panel_36 = Panel(len_19)
sph_2 = Sphere(Base=end_14.End, Radius=len_23)
bcx = BrepCurve(Brep=sph_2, Curve=line)  # -> Curves, Points
ln_9 = Line(StartPoint="0,0,0", EndPoint=bcx.Points)
ln_10 = Line(StartPoint=pl_15, EndPoint=bcx.Points)
len_28 = Length(Curve=ln_9)
len_29 = Length(Curve=ln_10)
sph_3 = Sphere(Base=end_15.End, Radius=len_24)
sph_4 = Sphere(Base=end_16.End, Radius=len_24)
sph_5 = Sphere(Base=end_13.End, Radius=len_21)
sph_6 = Sphere(Base=end_12.End, Radius=len_17)
panel_37 = Panel(len_28)
panel_38 = Panel(len_29)
merge_9 = Merge(Data1=sph_5, Data2=sph_6)
merge_10 = Merge(Data1=sph_3, Data2=sph_2)
sint_5 = SolidIntersection(BrepsA=flatten(merge_9), BrepsB=flatten(merge_10))
item_27 = ListItem(List=sint_5, Index="0", Wrap=True)
item_28 = ListItem(List=sint_5, Index="1", Wrap=True)
sint_6 = SolidIntersection(BrepsA=flatten(item_27), BrepsB=flatten(item_28))
edges = BrepEdges(Brep=sint_6)  # -> Naked, Interior, NonManifold
debrep_3 = DeconstructBrep(Brep=sint_6)  # -> Faces, Edges, Vertices
multiplication_5 = Multiplication(A=neg_14, B=Slider(-4, range=-10..10))
multiplication_6 = Multiplication(A=multiplication_5, B=Slider(1, range=-2..2))
crv = Curve(edges.Interior)
item_29 = ListItem(List=debrep_3.Faces, Index=number_slider_6, Wrap=True)
scale_nu_7 = ScaleNU(
    Geometry=item_29,
    Plane=PlaneXY(0, 0, 0),
    ScaleX=expr("-x", number_slider_6),
    ScaleY=expr("-x", number_slider_6),
    ScaleZ=number_slider_6)  # -> Geometry, Transform
panel_39 = Panel(multiplication_4)
panel_40 = Panel(multiplication_5)
join_3 = BrepJoin(Breps=[scale_nu_7.Geometry, item_29])  # -> Breps, Closed
scale_nu_8 = ScaleNU(
    Geometry=join_3.Breps,
    Plane=PlaneXY(0, 0, 0),
    ScaleX=number_slider_6,
    ScaleY=expr("-x", number_slider_6),
    ScaleZ=expr("-x", 1))  # -> Geometry, Transform
join_4 = BrepJoin(Breps=[scale_nu_8.Geometry, join_3.Breps])  # -> Breps, Closed

# ----
# 3 Points CENTER
pt_37 = Point(item)
pt_38 = Point(item_3)
pt_39 = Point(item_2)
pl_3pt_7 = Plane3Pt(PointA=pt_37, PointB=pt_38, PointC=pt_39)
pline_34 = PolyLine(Vertices=[pt_37, pt_38], Closed=False)
len_30 = Length(Curve=pline_34)
expression_14 = Expression(x=len_30, Expression="(2/3)*x")

deplane_9 = DeconstructPlane(Plane=pl_3pt_7)  # -> Origin, XAxis, YAxis, ZAxis
neg_16 = Negative(Value=deplane_9.YAxis)
pl_18 = ConstructPlane(Origin=pt_38, XAxis=deplane_9.XAxis, YAxis=deplane_9.YAxis)

expression_15 = Expression(x=len_30, Expression="(3/4)*x")

pdecon_10 = Deconstruct(Point=pt_37)  # -> XComponent, YComponent, ZComponent
pt_40 = ConstructPoint(XCoordinate=pdecon_10.XComponent, YCoordinate=pdecon_10.YComponent, ZCoordinate=pdecon_10.ZComponent)

cir_19 = Circle(Plane=pl_18, Radius=expression_15)

pl_19 = ConstructPlane(Origin=pt_39, XAxis=deplane_9.XAxis, YAxis=deplane_9.YAxis)
cir_20 = Circle(Plane=pl_19, Radius=expression_14)
cir_21 = Circle(Plane=pl_18, Radius=expression_14)
cir_22 = Circle(Plane=pl_3pt_7, Radius=expression_15)
rdiff_11 = RegionDifference(CurvesA=cir_20, CurvesB=cir_21)
rdiff_12 = RegionDifference(CurvesA=cir_22, CurvesB=cir_19)
explode_11 = Explode(Curve=rdiff_11, Recursive=True)  # -> Segments, Vertices
explode_12 = Explode(Curve=rdiff_12, Recursive=True)  # -> Segments, Vertices
item_30 = ListItem(List=explode_11.Segments, Index="1", Wrap=True)
item_31 = ListItem(List=explode_12.Segments, Index=0, Wrap=True)
end_17 = EndPoints(Curve=item_30)  # -> Start, End
end_18 = EndPoints(Curve=item_31)  # -> Start, End
pline_35 = PolyLine(Vertices=[end_17.End, end_17.Start], Closed=False)
pline_36 = PolyLine(Vertices=[end_18.End, end_18.Start], Closed=False)
llx_6 = LineLine(Line1=pline_36, Line2=pline_35)  # -> ParamA, ParamB, PointA, PointB

pl_20 = ConstructPlane(Origin=llx_6.PointA, XAxis=deplane_9.YAxis, YAxis=deplane_9.XAxis)

expression_16 = Expression(Expression="0")
pdecon_11 = Deconstruct(Point=pl_20)  # -> XComponent, YComponent, ZComponent
addition_9 = Addition(A=Slider(5, range=0..10), B=expression_16)
addition_10 = Addition(A=pdecon_11.ZComponent, B=addition_9)
pt_41 = ConstructPoint(XCoordinate=pdecon_11.XComponent, YCoordinate=pdecon_11.YComponent, ZCoordinate=pdecon_11.ZComponent)

neg_17 = Negative(Value=addition_10)
Z_5 = UnitZ(Factor=neg_17)
move_5 = Move(Geometry=pl_20, Motion=Z_5)  # -> Geometry, Transform
line_9 = LineSDL(Start=pl_20, Direction=pl_20, Length=neg)
end_19 = EndPoints(Curve=flatten(line_9))  # -> Start, End
pline_37 = PolyLine(Vertices=[pt_37, end_19.End], Closed=False)
pline_38 = PolyLine(Vertices=[pt_39, end_19.End], Closed=False)
pline_39 = PolyLine(Vertices=[pt_38, end_19.End], Closed=False)
len_31 = Length(Curve=pline_37)
len_32 = Length(Curve=pline_38)
len_33 = Length(Curve=pline_39)
panel_41 = Panel(len_31)
panel_42 = Panel(len_32)
sph_7 = Sphere(Base=end_19.End, Radius=len_32)

pt_42 = Point(item_11)
pt_43 = Point(item_12)
# 3 Points CENTER
pt_44 = Point(item_10)
pl_3pt_8 = Plane3Pt(PointA=pt_44, PointB=pt_42, PointC=pt_43)
pline_40 = PolyLine(Vertices=[pt_44, pt_42], Closed=False)
len_34 = Length(Curve=pline_40)
expression_17 = Expression(x=len_34, Expression="(2/3)*x")
cir_23 = Circle(Plane=pl_3pt_8, Radius=expression_17)

deplane_10 = DeconstructPlane(Plane=pl_3pt_8)  # -> Origin, XAxis, YAxis, ZAxis
neg_18 = Negative(Value=deplane_10.YAxis)
pl_21 = ConstructPlane(Origin=pt_42, XAxis=deplane_10.XAxis, YAxis=deplane_10.YAxis)

pl_22 = ConstructPlane(Origin=pt_43, XAxis=deplane_10.XAxis, YAxis=deplane_10.YAxis)
cir_24 = Circle(Plane=pl_21, Radius=expression_17)
cir_25 = Circle(Plane=pl_22, Radius=expression_17)
rdiff_13 = RegionDifference(CurvesA=cir_23, CurvesB=cir_24)
rdiff_14 = RegionDifference(CurvesA=cir_25, CurvesB=cir_24)
explode_13 = Explode(Curve=rdiff_13, Recursive=True)  # -> Segments, Vertices
explode_14 = Explode(Curve=rdiff_14, Recursive=True)  # -> Segments, Vertices
item_32 = ListItem(List=explode_13.Segments, Index=0, Wrap=True)
item_33 = ListItem(List=explode_14.Segments, Index="1", Wrap=True)
end_20 = EndPoints(Curve=item_32)  # -> Start, End
end_21 = EndPoints(Curve=item_33)  # -> Start, End
pline_41 = PolyLine(Vertices=[end_20.End, end_20.Start], Closed=False)
pline_42 = PolyLine(Vertices=[end_21.End, end_21.Start], Closed=False)
llx_7 = LineLine(Line1=pline_41, Line2=pline_42)  # -> ParamA, ParamB, PointA, PointB

pdecon_12 = Deconstruct(Point=pt_44)  # -> XComponent, YComponent, ZComponent
pt_45 = ConstructPoint(XCoordinate=pdecon_12.XComponent, YCoordinate=pdecon_12.YComponent, ZCoordinate=pdecon_12.ZComponent)

pl_23 = ConstructPlane(Origin=llx_7.PointA, XAxis=deplane_10.YAxis, YAxis=deplane_10.XAxis)

expression_18 = Expression(Expression="0")
pdecon_13 = Deconstruct(Point=pl_23)  # -> XComponent, YComponent, ZComponent
addition_11 = Addition(A=Slider(5, range=0..10), B=expression_18)
addition_12 = Addition(A=pdecon_13.ZComponent, B=addition_11)
pt_46 = ConstructPoint(XCoordinate=pdecon_13.XComponent, YCoordinate=pdecon_13.YComponent, ZCoordinate=pdecon_13.ZComponent)

neg_19 = Negative(Value=addition_12)
Z_6 = UnitZ(Factor=neg_19)
move_6 = Move(Geometry=pl_23, Motion=Z_6)  # -> Geometry, Transform
line_10 = LineSDL(Start=pl_23, Direction=pl_23, Length=neg)
end_22 = EndPoints(Curve=flatten(line_10))  # -> Start, End
pline_43 = PolyLine(Vertices=[pt_42, end_22.End], Closed=False)
pline_44 = PolyLine(Vertices=[pt_44, end_22.End], Closed=False)
pline_45 = PolyLine(Vertices=[pt_43, end_22.End], Closed=False)
len_35 = Length(Curve=pline_43)
len_36 = Length(Curve=pline_44)
len_37 = Length(Curve=pline_43)
panel_43 = Panel(len_36)
panel_44 = Panel(len_37)
panel_45 = Panel(len_35)
sph_8 = Sphere(Base=end_22.End, Radius=len_37)
merge_11 = Merge(Data1=sph_8, Data2=sph_7)  # -> flatten(Result)
sdiff = SolidDifference(BrepsA=box, BrepsB=sph_8)
sdiff_2 = SolidDifference(BrepsA=sdiff, BrepsB=sph_7)
pt_47 = Point(pt_44)

pt_48 = Point(item_7)
pt_49 = Point(item_8)
pt_50 = Point(item_9)
pline_46 = PolyLine(Vertices=[pt_48, pt_49], Closed=False)
pl_3pt_9 = Plane3Pt(PointA=pt_48, PointB=pt_49, PointC=pt_50)
len_38 = Length(Curve=pline_46)
expression_19 = Expression(x=len_38, Expression="(2/3)*x")
cir_26 = Circle(Plane=pl_3pt_9, Radius=expression_19)

deplane_11 = DeconstructPlane(Plane=pl_3pt_9)  # -> Origin, XAxis, YAxis, ZAxis
neg_20 = Negative(Value=deplane_11.YAxis)
pl_24 = ConstructPlane(Origin=pt_49, XAxis=deplane_11.XAxis, YAxis=deplane_11.YAxis)

pl_25 = ConstructPlane(Origin=pt_50, XAxis=deplane_11.XAxis, YAxis=deplane_11.YAxis)
cir_27 = Circle(Plane=pl_24, Radius=expression_19)
cir_28 = Circle(Plane=pl_25, Radius=expression_19)
rdiff_15 = RegionDifference(CurvesA=cir_26, CurvesB=cir_27)
rdiff_16 = RegionDifference(CurvesA=cir_28, CurvesB=cir_27)
explode_15 = Explode(Curve=rdiff_15, Recursive=True)  # -> Segments, Vertices
explode_16 = Explode(Curve=rdiff_16, Recursive=True)  # -> Segments, Vertices
item_34 = ListItem(List=explode_15.Segments, Index=0, Wrap=True)
item_35 = ListItem(List=explode_16.Segments, Index="1", Wrap=True)
end_23 = EndPoints(Curve=item_34)  # -> Start, End
end_24 = EndPoints(Curve=item_35)  # -> Start, End
pline_47 = PolyLine(Vertices=[end_23.End, end_23.Start], Closed=False)
pline_48 = PolyLine(Vertices=[end_24.End, end_24.Start], Closed=False)
llx_8 = LineLine(Line1=pline_47, Line2=pline_48)  # -> ParamA, ParamB, PointA, PointB

pdecon_14 = Deconstruct(Point=pt_48)  # -> XComponent, YComponent, ZComponent
pt_51 = ConstructPoint(XCoordinate=pdecon_14.XComponent, YCoordinate=pdecon_14.YComponent, ZCoordinate=pdecon_14.ZComponent)

pl_26 = ConstructPlane(Origin=llx_8.PointA, XAxis=deplane_11.XAxis, YAxis=deplane_11.YAxis)

expression_20 = Expression(Expression="0")
pdecon_15 = Deconstruct(Point=pl_26)  # -> XComponent, YComponent, ZComponent
addition_13 = Addition(A=Slider(5, range=0..10), B=expression_20)
addition_14 = Addition(A=pdecon_15.ZComponent, B=addition_13)
pt_52 = ConstructPoint(XCoordinate=pdecon_15.XComponent, YCoordinate=pdecon_15.YComponent, ZCoordinate=pdecon_15.ZComponent)

neg_21 = Negative(Value=pt_52)
Z_7 = UnitZ(Factor=neg_21)
move_7 = Move(Geometry=pl_26, Motion=Z_7)  # -> Geometry, Transform
line_11 = LineSDL(Start=pl_26, Direction=pl_26, Length=neg)
end_25 = EndPoints(Curve=flatten(line_11))  # -> Start, End
len_39 = Length(Curve=line_11)
pline_49 = PolyLine(Vertices=[pt_49, end_25.End], Closed=False)
pline_50 = PolyLine(Vertices=[end_25.End, pt_48], Closed=False)
pline_51 = PolyLine(Vertices=[pt_50, end_25.End], Closed=False)
len_40 = Length(Curve=pline_49)
len_41 = Length(Curve=pline_51)
len_42 = Length(Curve=pline_50)
panel_46 = Panel(len_40)
panel_47 = Panel(len_42)
panel_48 = Panel(len_41)
sph_9 = Sphere(Base=end_25.End, Radius=len_41)

pt_53 = Point(item_4)
pt_54 = Point(item_6)
pt_55 = Point(item_5)
pl_3pt_10 = Plane3Pt(PointA=pt_53, PointB=pt_54, PointC=pt_55)
pline_52 = PolyLine(Vertices=[pt_53, pt_54], Closed=False)
len_43 = Length(Curve=pline_52)
expression_21 = Expression(x=len_43, Expression="(2/3)*x")
cir_29 = Circle(Plane=pl_3pt_10, Radius=expression_21)

deplane_12 = DeconstructPlane(Plane=pl_3pt_10)  # -> Origin, XAxis, YAxis, ZAxis
neg_22 = Negative(Value=deplane_12.YAxis)
pl_27 = ConstructPlane(Origin=pt_54, XAxis=deplane_12.XAxis, YAxis=deplane_12.YAxis)

pl_28 = ConstructPlane(Origin=pt_55, XAxis=deplane_12.XAxis, YAxis=deplane_12.YAxis)
cir_30 = Circle(Plane=pl_28, Radius=expression_21)
cir_31 = Circle(Plane=pl_27, Radius=expression_21)
rdiff_17 = RegionDifference(CurvesA=cir_29, CurvesB=cir_31)
rdiff_18 = RegionDifference(CurvesA=cir_30, CurvesB=cir_31)
explode_17 = Explode(Curve=rdiff_17, Recursive=True)  # -> Segments, Vertices
explode_18 = Explode(Curve=rdiff_18, Recursive=True)  # -> Segments, Vertices
item_36 = ListItem(List=explode_17.Segments, Index=0, Wrap=True)
item_37 = ListItem(List=explode_18.Segments, Index="1", Wrap=True)
end_26 = EndPoints(Curve=item_36)  # -> Start, End
end_27 = EndPoints(Curve=item_37)  # -> Start, End
pline_53 = PolyLine(Vertices=[end_26.End, end_26.Start], Closed=False)
pline_54 = PolyLine(Vertices=[end_27.End, end_27.Start], Closed=False)
llx_9 = LineLine(Line1=pline_53, Line2=pline_54)  # -> ParamA, ParamB, PointA, PointB

pdecon_16 = Deconstruct(Point=pt_53)  # -> XComponent, YComponent, ZComponent
pt_56 = ConstructPoint(XCoordinate=pdecon_16.XComponent, YCoordinate=pdecon_16.YComponent, ZCoordinate=pdecon_16.ZComponent)

pl_29 = ConstructPlane(Origin=llx_9.PointA, XAxis=deplane_12.YAxis, YAxis=deplane_12.XAxis)

expression_22 = Expression(Expression="0")
pdecon_17 = Deconstruct(Point=pl_29)  # -> XComponent, YComponent, ZComponent
addition_15 = Addition(A=Slider(5, range=0..10), B=expression_22)
addition_16 = Addition(A=pdecon_17.ZComponent, B=addition_15)
pt_57 = ConstructPoint(XCoordinate=pdecon_17.XComponent, YCoordinate=pdecon_17.YComponent, ZCoordinate=pdecon_17.ZComponent)

neg_23 = Negative(Value=addition_16)
Z_8 = UnitZ(Factor=neg_23)
move_8 = Move(Geometry=pl_29, Motion=Z_8)  # -> Geometry, Transform
line_12 = LineSDL(Start=pl_29, Direction=pl_29, Length=neg)
end_28 = EndPoints(Curve=flatten(line_12))  # -> Start, End
pline_55 = PolyLine(Vertices=[pt_53, end_28.End], Closed=False)
pline_56 = PolyLine(Vertices=[pt_54, end_28.End], Closed=False)
pline_57 = PolyLine(Vertices=[pt_55, end_28.End], Closed=False)
len_44 = Length(Curve=pline_55)
len_45 = Length(Curve=pline_56)
len_46 = Length(Curve=pline_57)
panel_49 = Panel(len_44)
panel_50 = Panel(len_45)
panel_51 = Panel(len_46)
sph_10 = Sphere(Base=end_28.End, Radius=len_45)
merge_12 = Merge(Data1=sph_10, Data2=sph_9)  # -> flatten(Result)
sdiff_3 = SolidDifference(BrepsA=sdiff_2, BrepsB=sph_10)
sdiff_4 = SolidDifference(BrepsA=sdiff_3, BrepsB=sph_9)
edges_2 = BrepEdges(Brep=sdiff_4)  # -> Naked, Interior, NonManifold
item_38 = ListItem(List=edges_2.Interior, Index=0, Wrap=True)
end_29 = EndPoints(Curve=item_38)  # -> Start, End
ln_11 = Line(StartPoint=pt_47, EndPoint=end_29.Start)
len_47 = Length(Curve=ln_11)
panel_52 = Panel(len_47)
