# Grasshopper definition light_covid19.gh (Grasshopper 1.0.7)
# plug-ins: Pufferfish, Bifocals, Weaverbird, Noise 4D

R = Slider(100, range=0..200)
construct_point = ConstructPoint(XCoordinate="0", YCoordinate="0", ZCoordinate="0")
radius = Slider(1, range=0..1)
count = Slider(100, range=0..100)
s = Slider(18, range=0..100)
u = Slider(500, range=0..600)
v = Slider(300, range=0..600)
s_2 = Slider(20, range=0..100)
count_2 = Slider(50, range=0..100)
sphere = Sphere(Base=construct_point, Radius=R)
mesh_surface = MeshSurface(Surface=sphere, UCount=u, VCount=v, Overhang=True, Equalize=False)
wbicosahedron = WeaverbirdsMeshMeshIcosahedron(Plane=PlaneXY(0, 0, 0), Radius=R)
mesh_sphere_ex = MeshSphereEx(Base=PlaneXY(0, 0, 0), Radius=radius, Count=5)
populate_geometry = PopulateGeometry(Geometry=sphere, Count=count, Seed=s)
wbtriangles = WeaverbirdsSplitTrianglesSubdivision(MeshCurves=wbicosahedron, Level="2")
area = Area(Geometry=mesh_sphere_ex)  # -> Area, Centroid
T = Slider(2.82, range=0..33)
scale = Slider(2.1, range=0..21)
area_2 = Area(Geometry=sphere)  # -> Area, Centroid
populate_geometry_2 = PopulateGeometry(Count=count_2, Seed=s_2)
demesh = DeconstructMesh(Mesh=wbtriangles)  # -> Vertices, Faces, Colours, Normals
deconstruct_mesh = DeconstructMesh(Mesh=mesh_surface)  # -> Vertices, Faces, Colours, Normals
pull = PullPoint(Point=demesh.Vertices, Geometry=sphere, ClosestOnly=True)  # -> ClosestPoint, Distance
simplexnoise = SimplexNoise(Values=deconstruct_mesh.Vertices, Time=T, Scale=scale)
cullpt = CullDuplicates(Points=pull.ClosestPoint, Tolerance=0.1, CullMode=3)  # -> Points, Indices, Valence
orient = Orient(Geometry=mesh_sphere_ex, Source=area.Centroid, Target=populate_geometry)  # -> Geometry, Transform
pt = Point(cullpt.Points)
line = Line(StartPoint=pt, EndPoint=area_2.Centroid)
multiplication = Multiplication(A=deconstruct_mesh.Normals, B=simplexnoise)
construct_domain = ConstructDomain(DomainStart=Slider(2.08, range=0..100), DomainEnd=Slider(0.42, range=0..100))
move = Move(Geometry=deconstruct_mesh.Vertices, Motion=multiplication)  # -> Geometry, Transform
surface_curve = SurfaceCurve(Surface=sphere, Curve=line)  # -> Curves, Points, UVPoints, Normals, Parameters, Tangents
range = Range(Domain=construct_domain, Steps=expr("x-1", count))
construct_mesh = ConstructMesh(Vertices=move.Geometry, Faces=deconstruct_mesh.Faces)
param_viewer = ParamViewer(range)
mesh = Mesh(construct_mesh)
colour_swatch = ColourSwatch(SwatchColor=RGB(227, 227, 227))
jitter = Jitter(List=range, Jitter=1, Seed=2)  # -> Values, Indices
evaluate_surface = EvaluateSurface(Surface=sphere, Point=surface_curve.UVPoints)  # -> Point, Normal, UDirection, VDirection, Frame
triangulate = Triangulate(Mesh=mesh)  # -> Mesh, Count
create_material = CreateMaterial(
    Diffuse=colour_swatch,
    Specular=RGB(255, 255, 255),
    Emission=ColourSwatch(SwatchColor=RGB(0, 0, 0)),
    Transparency=0,
    Shine=colour_swatch)
scale_2 = Scale(Geometry=orient.Geometry, Center=populate_geometry, Factor=jitter.Values)  # -> Geometry, Transform
panel = Panel(evaluate_surface.Point)
line_sdl = LineSDL(Start=evaluate_surface.Frame, Direction=evaluate_surface.Normal, Length=Slider(24, range=0..100))
custom_preview = CustomPreview(Geometry=triangulate.Mesh, Material=create_material)
perp_frames = PerpFrames(Curve=line_sdl, Count=Slider(3, range=0..10), Align=True)  # -> Frames, Parameters
r = Slider(12, range=0..100)
item = Slider(0, range=0..4)
item_2 = Slider(1, range=0..4)
item_3 = Slider(2, range=0..4)
item_4 = Slider(3, range=0..4)
create_material_2 = CreateMaterial(
    Diffuse=ColourSwatch(SwatchColor=RGB(255, 166, 0)),
    Specular=RGB(255, 255, 255),
    Emission=ColourSwatch(SwatchColor=RGB(0, 0, 0)),
    Transparency=0,
    Shine=0)
circle = Circle(Plane=perp_frames.Frames, Radius=r)
srf = Surface(sphere)
pt_2 = Point(pt)
list_item = ListItem(List=circle, Index=item, Wrap=True)
list_item_2 = ListItem(List=circle, Index=item, Wrap=True)
custom_preview_2 = CustomPreview(Geometry=scale_2.Geometry, Material=create_material_2)
list_item_3 = ListItem(List=circle, Index=item_3, Wrap=True)
list_item_4 = ListItem(List=circle, Index=item_4, Wrap=True)
list_item_5 = ListItem(List=circle, Index=item_2, Wrap=True)
area_3 = Area(Geometry=list_item_5)  # -> Area, Centroid
area_4 = Area(Geometry=list_item_3)  # -> Area, Centroid
geo = Geometry(sphere)
scale_3 = Scale(Geometry=list_item_3, Center=area_4.Centroid, Factor=0.5)  # -> Geometry, Transform
scale_4 = Scale(Geometry=list_item_5, Center=area_3.Centroid, Factor=0.5)  # -> Geometry, Transform
panel_2 = Panel("""0
1""")
offsrf = OffsetSurface(Surface=geo, Distance=Slider(1.2, range=0..10), BothSides=False, CreateSolid=True)
panel_3 = Panel("""0
1""")
panel_4 = Panel("""0
1
2
3
4""")
geo_2 = Geometry(<brep referenced from the Rhino model>)
count_3 = Slider(173, range=0..200)
r_2 = Slider(1, range=0..1)
create_material_3 = CreateMaterial(
    Diffuse=ColourSwatch(SwatchColor=RGB(138, 124, 124)),
    Specular=RGB(255, 255, 255),
    Emission=ColourSwatch(SwatchColor=RGB(0, 0, 0)),
    Transparency=0,
    Shine=0)
create_material_4 = CreateMaterial(
    Diffuse=ColourSwatch(SwatchColor=RGB(255, 0, 0)),
    Specular=RGB(255, 255, 255),
    Emission=ColourSwatch(SwatchColor=RGB(0, 0, 0)),
    Transparency=0,
    Shine=0)

srf_cp = SurfaceClosestPoint(Point=pt_2, Surface=srf)  # -> Point, UVPoint, Distance
evalsrf = EvaluateSurface(Surface=srf, Point=srf_cp.UVPoint)  # -> Point, Normal, UDirection, VDirection, Frame

deplane = DeconstructPlane(Plane=evalsrf.Frame)  # -> Origin, XAxis, YAxis, ZAxis
amp = Amplitude(Vector=deplane.ZAxis, Amplitude=Slider(-5, range=-15..15))

move_2 = Move(Geometry=graft(list_item_2), Motion=graft(amp))  # -> Geometry, Transform

weave = Weave(Pattern=panel_3, Stream0=graft(move_2.Geometry), Stream1=graft(list_item), NullGaps=False)
loft = Loft(Curves=weave, Options={Adjust=False, Closed=False, LoftEnds=0, LoftSimp=0, LoftType=0, Rebuild=10, Refit=0.01})
weave_2 = Weave(Pattern=panel_3, Stream0=graft(move_2.Geometry), Stream1=graft(list_item_4), NullGaps=False)
loft_2 = Loft(Curves=weave_2, Options={Adjust=False, Closed=False, LoftEnds=0, LoftSimp=0, LoftType=0, Rebuild=10, Refit=0.01})
offset = OffsetSurface(Surface=loft_2, Distance=Slider(0.15, range=0..1), Retrim=True)
cap_holes = CapHoles(Brep=flatten(offset))
sdiff = SolidDifference(BrepsA=offsrf, BrepsB=cap_holes)
sdiff_2 = SolidDifference(BrepsA=sdiff, BrepsB=geo_2)

srf_cp_2 = SurfaceClosestPoint(Point=pt_2, Surface=srf)  # -> Point, UVPoint, Distance
evalsrf_2 = EvaluateSurface(Surface=srf, Point=srf_cp_2.UVPoint)  # -> Point, Normal, UDirection, VDirection, Frame

deplane_2 = DeconstructPlane(Plane=evalsrf_2.Frame)  # -> Origin, XAxis, YAxis, ZAxis
amp_2 = Amplitude(Vector=deplane_2.ZAxis, Amplitude=Slider(1.5, range=-15..15))

move_3 = Move(Geometry=graft(list_item_4), Motion=graft(amp_2))  # -> Geometry, Transform

area_5 = Area(Geometry=move_3.Geometry)  # -> Area, Centroid
scale_5 = Scale(Geometry=move_3.Geometry, Center=area_5.Centroid, Factor=Slider(0.398, range=0..1))  # -> Geometry, Transform
weave_3 = Weave(
    Pattern=panel_4,
    Stream0=graft(list_item_2),
    Stream1=graft(scale_4.Geometry),
    Stream2=graft(scale_3.Geometry),
    Stream3=graft(list_item_4),
    Stream4=graft(move_3.Geometry),
    NullGaps=False)
weave_4 = Weave(Pattern=panel_2, Stream0=graft(move_3.Geometry), Stream1=graft(scale_5.Geometry), NullGaps=False)
loft_3 = Loft(Curves=weave_3, Options={Adjust=False, Closed=False, LoftEnds=0, LoftSimp=0, LoftType=0, Rebuild=10, Refit=0.01})
loft_4 = Loft(Curves=weave_4, Options={Adjust=False, Closed=False, LoftEnds=0, LoftSimp=0, LoftType=0, Rebuild=10, Refit=0.01})
deplane_3 = DeconstructPlane(Plane=evalsrf_2.Frame)  # -> Origin, XAxis, YAxis, ZAxis
flip = Flip(Surface=loft_4)  # -> Surface, Result
amp_3 = Amplitude(Vector=deplane_3.ZAxis, Amplitude=Slider(3, range=-15..15))
merge = Merge(Data1=loft, Data2=loft_3, Data3=flip.Surface)
join = BrepJoin(Breps=flatten(merge))  # -> Breps, Closed
move_4 = Move(Geometry=graft(join.Breps), Motion=graft(amp_3))  # -> Geometry, Transform
cap_holes_2 = CapHoles(Brep=join.Breps)  # -> graft(Brep)
brep = Brep(cap_holes_2)
offsrf_2 = OffsetSurface(Surface=join.Breps, Distance=Slider(-0.8, range=-10..10), BothSides=False, CreateSolid=True)
populate_geometry_3 = PopulateGeometry(Geometry=brep, Count=count_3, Seed=1)
mesh_sphere_ex_2 = MeshSphereEx(Base=populate_geometry_3, Radius=r_2, Count=5)
merge_2 = Merge(Data1=mesh_sphere_ex_2, Data2=cap_holes_2, Data3=scale_2.Geometry, Data4=triangulate.Mesh)
custom_preview_3 = CustomPreview(Geometry=loft_3, Material=create_material_3)
custom_preview_4 = CustomPreview(Geometry=mesh_sphere_ex_2, Material=create_material_4)
