# Grasshopper definition mask_Eskier.gh (Grasshopper 1.0.7)
# plug-ins: Pufferfish, NGon 2

brep = Brep([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])
brep_2 = Brep()
brep_3 = Brep([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])
brep_4 = Brep([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])
brep_5 = Brep([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])
brep_6 = Brep([<brep referenced from the Rhino model> x6])
brep_7 = Brep(<brep referenced from the Rhino model>)
crv = Curve(<curve referenced from the Rhino model>)
number_slider = Slider(50, range=0..100)
brep_8 = Brep([<brep referenced from the Rhino model> x4])
# 旋转角度
number_slider_2 = Slider(19.76, range=-180..180)
edges = BrepEdges(Brep=brep_6)  # -> Naked, Interior, NonManifold
divlength = DivideLength(Curve=crv, Length=Slider(8, range=0..10))  # -> Points, Tangents, Parameters
# eyes
panel = Panel("0,0,0")
merge = Merge(Data1=brep_5, Data2=brep_2, Data3=brep)
# 线宽
expression = Expression(x=number_slider, y=Slider(0.05, range=0..10), Expression="x*y")
expression_2 = Expression(x="5", y=Slider(1, range=0..1), Expression="x*y")
edges_2 = BrepEdges(Brep=brep_8)  # -> Naked, Interior, NonManifold
expression_3 = Expression(x=expression_2, Expression="x/2")
expression_4 = Expression(x=expression_2, Expression="-x*2")
# samll edge
panel_2 = Panel("0.5")
panel_3 = Panel("""0.5
1""")
number_slider_3 = Slider(0.99, range=0..1)
pline = PolyLine(Vertices=divlength.Points, Closed=False)
area = Area(Geometry=brep_4)  # -> Area, Centroid
project = Project(Curve=edges.Naked, Brep=brep_7, Direction=Vector(0, 0, 1))
crv_2 = Curve(<curve referenced from the Rhino model>)
text = Text(
    Location="0,0,0",
    Text=Slider(1, range=0..10),
    Size=number_slider,
    Bold=False,
    HorizontalAlignment=0,
    VerticalAlignment=0)
join = JoinCurves(Curves=flatten(edges_2.Naked), Preserve=False)
neg = Negative(Value=expression_2)
line = LineSDL(Start=panel, Direction="0,-1,0", Length=expression_4)
# 中线
Z = UnitZ(Factor=expression_4)
edges_3 = BrepEdges(Brep=graft(brep_4))  # -> Naked, Interior, NonManifold
pt = Point(area.Centroid)
# 眉毛
panel_4 = Panel("1")
line_2 = LineSDL(Start="0,0,0", Direction=Vector(0, 0, 1), Length=neg)
runion = RegionUnion(Curves=join)
crv_3 = Curve(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)

explode = Explode(Curve=text, Recursive=True)  # -> Segments, Vertices
item = ListItem(List=explode.Segments, Index="1", Wrap=True)
offcrv = OffsetCurve(Curve=item, Plane=PlaneXY(0, 0, 0), Distance=expression, BothSides=True, Kinks=0, CapType=1)
expression_5 = Expression(x="5", y=Slider(1.039, range=0..10), Expression="x*y")
X = UnitX(Factor=expression_5)
move = Move(Geometry=item, Motion=X)  # -> Geometry, Transform
expression_6 = Expression(x=expression, y=Slider(0.413, range=0..10), Expression="x*y")
offcrv_2 = OffsetCurve(Curve=move.Geometry, Plane=PlaneXY(0, 0, 0), Distance=expression_6, BothSides=True, Kinks=0, CapType=1)

# ----
# 正方形坐标
panel_5 = Panel("0")
cp = ControlPoints(Curve=offcrv)  # -> Points, Weights, Knots
neg_2 = Negative(Value=Z)
join_2 = JoinCurves(Curves=edges_3.Naked, Preserve=False)

pframes = PerpFrames(Curve=line_2, Count="20", Align=True)  # -> Frames, Parameters
dom = ConstructDomain(DomainStart="0", DomainEnd="1")
range = Range(Domain=dom, Steps=expr("x-1", "20"))
graph = GraphMapper(range, x0=0, x1=1, y0=0, y1=1, container_name="Bezier", cpx=[0, 0.1173696965, 0, 1], cpy=[0, 0, 0.9989924431, 1])
X_2 = UnitX(Factor=1)
multiplication = Multiplication(A="5", B=graph)
amp = Amplitude(Vector=X_2, Amplitude=multiplication)

item_2 = ListItem(List=explode.Segments, Index=panel_5, Wrap=True)
crv_4 = Curve(<curve referenced from the Rhino model>)
item_3 = ListItem(List=cp.Points, Index=Slider(3, range=0..10), Wrap=True)
alongcrv = SortAlongCurve(Points=pt, Curve=crv_2)  # -> Points, Indices
midpt = CurveMiddle(Curve=line)
rotate = Rotate(Geometry=line, Angle=1.570796327, Plane=midpt)  # -> Geometry, Transform
crv_5 = Curve(rotate.Geometry)
midpt_2 = CurveMiddle(Curve=item_2)
extr = Extrude(Base=line, Direction=neg_2)
item_4 = ListItem(List=runion, Index=Slider(6, range=0..10), Wrap=True)

pframes_2 = PerpFrames(Curve=item_2, Count=Slider(1, range=0..10), Align=True)  # -> Frames, Parameters
pframes_3 = PerpFrames(Curve=item_2, Count=Slider(1, range=0..10), Align=True)  # -> Frames, Parameters
item_5 = ListItem(List=pframes_3.Frames, Index="2", Wrap=True)
item_6 = ListItem(List=pframes_2.Frames, Index="1", Wrap=True)

item_7 = ListItem(List=flatten(join_2), Index=alongcrv.Indices, Wrap=True)
cp_2 = ControlPoints(Curve=crv_4)  # -> Points, Weights, Knots
lng = ListLength(List=cp_2.Points)
area_2 = Area(Geometry=item_7)  # -> Area, Centroid

# ----
# 坐标转换
deplane = DeconstructPlane(Plane=item_6)  # -> Origin, XAxis, YAxis, ZAxis
pl = ConstructPlane(Origin=midpt_2, XAxis=deplane.YAxis, YAxis=deplane.ZAxis)

series = Series(Start=0, Step=1, Count=lng)
pt_2 = Point([Point(237.1526993, 470.8044876, 0), Point(144.4739175, 514.4948669, 0), Point(65.07471117, 346.0682744, 0), Point(149.8776993, 306.0906803, 0), Point(149.8776993, 31.12948759, 0), Point(106.775939, 31.12948759, 0), Point(106.775939, 10.47948759, 0), Point(292.9794595, 10.47948759, 0), Point(292.9794595, 31.12948759, 0), Point(237.1526993, 31.12948759, 0), Point(237.1526993, 470.8044876, 0)])
number_slider_4 = Slider(1, range=0..1)
txt = Text(cp_2.Points)
cp_3 = ControlPoints(Curve=item_7)  # -> Points, Weights, Knots
points = PointList(Points=area_2.Centroid, Size=Slider(10, range=0..10))
expression_7 = Expression(x=expression_6, y=Slider(1, range=0..10), Expression="x/y")
# 眼睛曲线
number_slider_5 = Slider(2.2, range=0..10)
txt_2 = Text(cp_3.Points)
points_2 = PointList(Size=Slider(4, range=0..10))
panel_6 = Panel(pt_2)
join_3 = TextJoin(Text=txt)
move_2 = Move(Geometry=pframes.Frames, Motion=amp)  # -> Geometry, Transform
join_4 = TextJoin(Text=txt_2)
rotate_2 = Rotate(Geometry=pl, Angle=degrees(number_slider_2), Plane=midpt_2)  # -> Geometry, Transform
# 底部方形
dom_2 = ConstructDomain(DomainStart=expr("-x", expression_7), DomainEnd=expr("x", expression_7))
intcrv = Interpolate(Vertices=move_2.Geometry, Degree=3, Periodic=False, KnotStyle=1)  # -> Curve, Length, Domain
deplane_2 = DeconstructPlane(Plane=rotate_2.Geometry)  # -> Origin, XAxis, YAxis, ZAxis
panel_7 = Panel(join_4)
panel_8 = Panel(join_3)
yz = YZPlane(Origin=Point(0, 0, 0))
neg_3 = Negative(Value=deplane_2.XAxis)

cp_4 = ControlPoints(Curve=offcrv_2)  # -> Points, Weights, Knots
item_8 = ListItem(List=cp_4.Points, Index=Slider(2, range=0..10), Wrap=True)
# 交点
len = Length(Curve=item)
line_3 = LineSDL(Start=midpt_2, Direction=deplane_2.YAxis, Length=len)
line_4 = LineSDL(Start=item_8, Direction=neg_3, Length=len)

# ----
# 下眉毛
panel_9 = Panel("0")
rotate_3 = Rotate(Geometry=intcrv.Curve, Angle=1.570796327, Plane=yz)  # -> Geometry, Transform
expression_8 = Expression(x=expression_2, Expression="x*2")
ccx = CurveCurve(CurveA=line_3, CurveB=line_4)  # -> Points, ParamsA, ParamsB
ln = Line(StartPoint=item_8, EndPoint=ccx.Points)
ln_2 = Line(StartPoint=midpt_2, EndPoint=ccx.Points)
len_2 = Length(Curve=ln_2)
len_3 = Length(Curve=ln)
expression_9 = Expression(x=len_3, y=Slider(0.277, range=0..10), Expression="x*y")
dom_3 = ConstructDomain(DomainStart=expr("-x", len_2), DomainEnd=expr("x", len_2))
dom_4 = ConstructDomain(DomainStart=expr("-x", expression_9), DomainEnd=expr("x", len_3))
dom_5 = ConstructDomain(DomainStart=expr("-x", len_2), DomainEnd=expr("x", len_2))
# 顶部方形
rectangle = Rectangle(Plane=rotate_2.Geometry, XSize=dom_4, YSize=dom_3, Radius=0)  # -> Rectangle, Length

# ----
# 中部三角
expression_10 = Expression(x=expression_6, y=Slider(3, range=0..10), Expression="x*y")
explode_2 = Explode(Curve=rectangle.Rectangle, Recursive=True)  # -> Segments, Vertices
explode_3 = Explode(Curve=offcrv, Recursive=True)  # -> Segments, Vertices
neg_4 = Negative(Value=expression_10)
item_9 = ListItem(List=flatten(explode_2.Segments), Index=Slider(3, range=0..10), Wrap=True)
item_10 = ListItem(List=flatten(explode_2.Segments), Index=Slider(0, range=0..10), Wrap=True)
item_11 = ListItem(List=flatten(explode_3.Segments), Index=Slider(0, range=0..10), Wrap=True)
len_4 = Length(Curve=item_11)
expression_11 = Expression(x=len_4, y=Slider(2.5, range=0..10), Expression="x*y")
join_5 = JoinCurves(Curves=[item_9, item_10], Preserve=False)
end = EndPoints(Curve=item_11)  # -> Start, End
line_5 = LineSDL(Start=end.Start, Direction="0,1,0", Length=expression_11)
offset = OffsetCurve(Curve=join_5, Distance=neg_4, Plane=PlaneXY(0, 0, 0), Corners=1)
clscrv = CloseCurve(Curve=offset, CloseType=0, Bulge=0.5, Tolerance=0)  # -> Closed, R
rectangle_2 = Rectangle(Plane=end.Start, XSize=expression_11, YSize=expression_11, Radius=0)  # -> Rectangle, Length

item_12 = ListItem(List=flatten(explode_2.Segments), Index=Slider(2, range=0..10), Wrap=True)
join_6 = JoinCurves(Curves=[item_9, item_10, item_12], Preserve=False)
rectangle_3 = Rectangle(Plane=item_3, XSize=dom_5, YSize=dom_2, Radius=0)  # -> Rectangle, Length
offcrv_3 = OffsetCurve(Curve=join_6, Plane=PlaneXY(0, 0, 0), Distance=neg_4, BothSides=False, Kinks=0, CapType=1)
merge_2 = Merge(Data1=offcrv, Data2=offcrv_2, Data3=offcrv_3, Data4=rectangle_3.Rectangle)
end_2 = EndPoints(Curve=rotate_3.Geometry)  # -> Start, End
Z_2 = UnitZ(Factor=1)
Y = UnitY(Factor=expression_8)
expression_12 = Expression(x=expression_8, Expression="x/2")
# 下
panel_10 = Panel("1,0,0")
line_6 = LineSDL(Start=end_2.End, Direction="1,0,0", Length=neg)
midpt_3 = CurveMiddle(Curve=line_6)
cir = Circle(Plane=midpt_3, Radius=expression_3)
end_3 = EndPoints(Curve=line_6)  # -> Start, End
scale = Scale(Geometry=cir, Center=end_3.End, Factor=number_slider_3)  # -> Geometry, Transform
# 半圆
flip = FlipCurve(Curve=rotate_3.Geometry)  # -> Curve, Flag
expression_13 = Expression(x=expression_2, Expression="x/3")

# ----
# 上部位置
# 细条大小
# 粗细大小
runion_2 = RegionUnion(Curves=flatten(merge_2))
rdiff = RegionDifference(CurvesA=clscrv.Closed, CurvesB=rectangle_2.Rectangle)

Y_2 = UnitY(Factor=expression_12)
revsrf = Revolution(Curve=flip.Curve, Axis=line_6, Domain=Domain(0, 3.141592654))
project_2 = Project(Curve=scale.Geometry, Brep=revsrf, Direction=Vector(0, 0, 1))
project_3 = Project(Curve=project_2, Brep=extr, Direction="1,0,0")

panel_11 = Panel("""0.25
0.75""")
# 线段
shatter = Shatter(Curve=reparameterize(project_2), Parameters=panel_11)
item_13 = ListItem(List=shatter, Index="0", Wrap=True)
item_14 = ListItem(List=shatter, Index="1", Wrap=True)
# 上
crv_6 = Curve(item_13)
crv_7 = Curve(item_14)

shatter_2 = Shatter(Curve=reparameterize(project_3), Parameters=panel_11)
item_15 = ListItem(List=shatter_2, Index="0", Wrap=True)
item_16 = ListItem(List=shatter_2, Index="1", Wrap=True)
crv_8 = Curve(item_16)
crv_9 = Curve(item_15)

end_4 = EndPoints(Curve=crv_8)  # -> Start, End
# 裁切形状
midpt_4 = CurveMiddle(Curve=crv_6)

# ----
# 编辑下半圆
shatter_3 = Shatter(Curve=reparameterize(crv_8), Parameters="0.5")
item_17 = ListItem(List=shatter_3, Index="0", Wrap=True)
crv_10 = Curve(item_17)

ln_3 = Line(StartPoint=end_4.Start, EndPoint=end_4.End)
len_5 = Length(Curve=ln_3)
expression_14 = Expression(x=len_5, Expression="x/2")
midpt_5 = CurveMiddle(Curve=ln_3)
xz = XZPlane(Origin=midpt_5)
deplane_3 = DeconstructPlane(Plane=midpt_4)  # -> Origin, XAxis, YAxis, ZAxis
end_5 = EndPoints(Curve=crv_10)  # -> Start, End
number_slider_6 = Slider(50, range=0..100)
neg_5 = Negative(Value=Y_2)
# 调节旋转线
number_slider_7 = Slider(-45, range=-180..180)
pl_2 = ConstructPlane(Origin=midpt_4, XAxis=deplane_3.YAxis, YAxis=deplane_3.ZAxis)
ln_4 = Line(StartPoint=midpt_5, EndPoint=end_5.End)
expression_15 = Expression(x=expression_13, y=Slider(1, range=0..1.5), Expression="x*y")
# 地面
expression_16 = Expression(x=expression_2, Expression="x")
len_6 = Length(Curve=ln_4)
expression_17 = Expression(x=number_slider_3, y=len_6, Expression="0.9*x*y")
ellipse = Ellipse(Plane=midpt_5, Radius1=expression_17, Radius2=expression_14)  # -> Ellipse, Focus1, Focus2
rotate_4 = Rotate(Geometry=ellipse.Ellipse, Angle=1.570796327, Plane=xz)  # -> Geometry, Transform

# ----
# 编辑后
shatter_4 = Shatter(Curve=reparameterize(rotate_4.Geometry), Parameters=panel_11)
item_18 = ListItem(List=shatter_4, Index="0", Wrap=True)
crv_11 = Curve(item_18)

project_4 = Project(Curve=crv_11, Brep=revsrf, Direction=panel_10)

yz_2 = YZPlane(Origin=Point(0, 0, 0))
# 裁切修补
midpt_6 = CurveMiddle(Curve=project_4)
mirror = Mirror(Geometry=midpt_6, Plane=yz_2)  # -> Geometry, Transform
ln_5 = Line(StartPoint=midpt_6, EndPoint=mirror.Geometry)
midpt_7 = CurveMiddle(Curve=ln_5)
len_7 = Length(Curve=ln_5)
expression_18 = Expression(x=len_7, Expression="x/2")
# 内椭圆
expression_19 = Expression(x=expression_18, y=Slider(0.58, range=0..1.5), Expression="x*y")
ellipse_2 = Ellipse(Plane=midpt_7, Radius1=expression_18, Radius2=expression_19)  # -> Ellipse, Focus1, Focus2
yz_3 = YZPlane(Origin=midpt_7)
rotate_5 = Rotate(Geometry=ellipse_2.Ellipse, Angle=1.570796327, Plane=yz_3)  # -> Geometry, Transform

shatter_5 = Shatter(Curve=reparameterize(rotate_5.Geometry), Parameters=panel_3)
item_19 = ListItem(List=shatter_5, Index="0", Wrap=True)
crv_12 = Curve(item_19)

midpt_8 = CurveMiddle(Curve=crv_12)
pt_3 = Point(midpt_8)
pt_4 = Point(midpt_6)
ln_6 = Line(StartPoint=pt_4, EndPoint=pt_3)

pframes_4 = PerpFrames(Curve=ln_6, Count=Slider(1, range=0..10), Align=True)  # -> Frames, Parameters
pframes_5 = PerpFrames(Curve=ln_6, Count=Slider(1, range=0..10), Align=True)  # -> Frames, Parameters
item_20 = ListItem(List=pframes_5.Frames, Index="2", Wrap=True)
item_21 = ListItem(List=pframes_4.Frames, Index="1", Wrap=True)

rdiff_2 = RegionDifference(CurvesA=runion_2, CurvesB=rdiff)
line_7 = LineSDL(Start=midpt_4, Direction=Vector(0, 0, 1), Length=neg)
dom_6 = ConstructDomain(DomainStart=expr("-x", expression_15), DomainEnd=expr("x", expression_15))

# ----
# 合并圆
merge_3 = Merge(Data1=crv_6, Data2=project_4)
join_7 = JoinCurves(Curves=flatten(merge_3), Preserve=False)

text_2 = Text(
    Location="0,0,0",
    Text=Slider(2, range=0..10),
    Size=number_slider_6,
    Bold=False,
    HorizontalAlignment=0,
    VerticalAlignment=0)
# 线宽
panel_12 = Panel(expression_6)
item_22 = ListItem(List=rdiff_2, Index="1", Wrap=True)
dom_7 = ConstructDomain(DomainStart=expr("-x", expression_16), DomainEnd=expr("x", expression_16))
item_23 = ListItem(List=rdiff_2, Index="0", Wrap=True)
item_24 = ListItem(List=rdiff_2, Index="3", Wrap=True)
rotate_6 = Rotate(Geometry=line_7, Angle=degrees(number_slider_7), Plane=pl_2)  # -> Geometry, Transform
crv_13 = Curve(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)
rectangle_4 = Rectangle(Plane=midpt, XSize=dom_6, YSize=dom_6, Radius=0)  # -> Rectangle, Length
explode_4 = Explode(Curve=text_2, Recursive=True)  # -> Segments, Vertices
pt_5 = Point(midpt)
crv_14 = Curve(flatten([item_23, item_22, item_24]))
boundary = BoundarySurfaces(Edges=crv_14)
expression_20 = Expression(x=number_slider, y=Slider(0.275, range=0..10), Expression="x*y")
rectangle_5 = Rectangle(Plane=midpt, XSize=dom_7, YSize=dom_7, Radius=0)  # -> Rectangle, Length
# 嘴巴
number_slider_8 = Slider(2, range=0..12)
rotate_7 = Rotate(Geometry=rectangle_4.Rectangle, Angle=0.7853981634, Plane=pt_5)  # -> Geometry, Transform

# ----
# 三角形
shatter_6 = Shatter(Curve=reparameterize(rotate_7.Geometry), Parameters=panel_11)
item_25 = ListItem(List=shatter_6, Index="1", Wrap=True)
crv_15 = Curve(item_25)

item_26 = ListItem(List=explode_4.Segments, Index=Slider(3, range=0..10), Wrap=True)

# ----
# 裁切线
project_5 = Project(Curve=join_7, Brep=extr, Direction="1,0,0")
project_6 = Project(Curve=project_5, Brep=revsrf, Direction="1,0,0")

dom_8 = ConstructDomain(DomainStart=expr("-x", expression_20), DomainEnd=expr("x", expression_20))
boundary_2 = BoundarySurfaces(Edges=rectangle_5.Rectangle)
midpt_9 = CurveMiddle(Curve=item_26)
cp_5 = ControlPoints(Curve=crv_15)  # -> Points, Weights, Knots
# 数字2
line_8 = LineSDL(Start=midpt_9, Direction="0,1,0", Length=number_slider)

# ----
# 大小移动
number_slider_9 = Slider(-5.214, range=-10..10)
curvepoint = PointOnCurve(line_8, parameter=0.566)

neg_6 = Negative(Value=expression)
rectangle_6 = Rectangle(Plane=curvepoint, XSize=dom_8, YSize=dom_8, Radius=0)  # -> Rectangle, Length
# 上部
rotate_8 = Rotate(Geometry=rectangle_6.Rectangle, Angle=degrees(Slider(45, range=-180..180)), Plane=curvepoint)  # -> Geometry, Transform
panel_13 = Panel("""0
1
2""")
explode_5 = Explode(Curve=rotate_8.Geometry, Recursive=True)  # -> Segments, Vertices
item_27 = ListItem(List=flatten(explode_5.Segments), Index=panel_13, Wrap=True)
join_8 = JoinCurves(Curves=item_27, Preserve=False)
offcrv_4 = OffsetCurve(Curve=join_8, Plane=PlaneXY(0, 0, 0), Distance=neg_6, BothSides=False, Kinks=0, CapType=1)

expression_21 = Expression(x=panel_12, y=Slider(3.209, range=0..10), Expression="x*y")
xz_2 = XZPlane(Origin=Point(0, 0, 0))
pline_2 = PolyLine(Vertices=cp_5.Points, Closed=True)
expression_22 = Expression(x=expression_2, Expression="x")
rotate_9 = Rotate(Geometry=pline_2, Angle=1.570796327, Plane=xz_2)  # -> Geometry, Transform
Z_3 = UnitZ(Factor=expression_22)
Z_4 = UnitZ(Factor=expression_22)

number_slider_10 = Slider(2, range=0..10)
cp_6 = ControlPoints(Curve=rotate_8.Geometry)  # -> Points, Weights, Knots
item_28 = ListItem(List=cp_6.Points, Index=number_slider_10, Wrap=True)
item_29 = ListItem(List=cp_6.Points, Index=Slider(0, range=0..10), Wrap=True)
ln_7 = Line(StartPoint=item_29, EndPoint=item_28)
offcrv_5 = OffsetCurve(Curve=ln_7, Plane=PlaneXY(0, 0, 0), Distance=panel_12, BothSides=False, Kinks=0, CapType=1)

dom_9 = ConstructDomain(DomainStart=expr("-x", expression_15), DomainEnd=expr("x", expression_15))
move_3 = Move(Geometry=rotate_9.Geometry, Motion=Z_3)  # -> Geometry, Transform
# 变形
move_4 = Move(Geometry=midpt, Motion=Z_4)  # -> Geometry, Transform
X_3 = UnitX(Factor=expression_21)
# 交点
expression_23 = Expression(x=expression_2, y=Slider(16, range=0..50), Expression="x/y")
# 方形点
item_30 = ListItem(List=flatten(explode_5.Segments), Index="1", Wrap=True)

pframes_6 = PerpFrames(Curve=item_30, Count=Slider(1, range=0..10), Align=True)  # -> Frames, Parameters
item_31 = ListItem(List=pframes_6.Frames, Index="1", Wrap=True)

deplane_4 = DeconstructPlane(Plane=item_31)  # -> Origin, XAxis, YAxis, ZAxis
pl_3 = ConstructPlane(Origin=midpt_2, XAxis=deplane_4.YAxis, YAxis=deplane_4.ZAxis)

deplane_5 = DeconstructPlane(Plane=pl_3)  # -> Origin, XAxis, YAxis, ZAxis
scale_nu = ScaleNU(
    Geometry=move_3.Geometry,
    Plane=move_4.Geometry,
    ScaleX=1,
    ScaleY=Slider(0.773, range=0..1.5),
    ScaleZ=Slider(1.441, range=0..2))  # -> Geometry, Transform
crv_16 = Curve(scale_nu.Geometry)

# ----
# 三角加圆
project_7 = Project(Curve=join_7, Brep=extr, Direction="1,0,0")
runion_3 = RegionUnion(Curves=flatten([scale_nu.Geometry, project_7]))
project_8 = Project(Curve=runion_3, Brep=revsrf, Direction="1,0,0")

crv_17 = Curve(runion_3)
dom_10 = ConstructDomain(DomainStart=expr("-x", expression_23), DomainEnd=expr("x", expression_23))
multiplication_2 = Multiplication(A=deplane_5.XAxis, B=number_slider_9)
move_5 = Move(Geometry=item_30, Motion=multiplication_2)  # -> Geometry, Transform
move_6 = Move(Geometry=ln_7, Motion=X_3)  # -> Geometry, Transform
ccx_2 = CurveCurve(CurveA=offcrv_4, CurveB=move_5.Geometry)  # -> Points, ParamsA, ParamsB
ccx_3 = CurveCurve(CurveA=ln_7, CurveB=move_5.Geometry)  # -> Points, ParamsA, ParamsB
ccx_4 = CurveCurve(CurveA=offcrv_4, CurveB=ln_7)  # -> Points, ParamsA, ParamsB
points_3 = PointList(Points=ccx_4.Points, Size=number_slider_10)
ccx_5 = CurveCurve(CurveA=move_5.Geometry, CurveB=ln_7)  # -> Points, ParamsA, ParamsB
ccx_6 = CurveCurve(CurveA=offcrv_4, CurveB=move_6.Geometry)  # -> Points, ParamsA, ParamsB
panel_14 = Panel("""0
1""")
# 上部细线
item_32 = ListItem(List=flatten(ccx_2.Points), Index=panel_14, Wrap=True)
neg_7 = Negative(Value=panel_12)
item_33 = ListItem(List=flatten(ccx_4.Points), Index="1", Wrap=True)
item_34 = ListItem(List=flatten(ccx_6.Points), Index="1", Wrap=True)
panel_15 = Panel("""1
2""")
item_35 = ListItem(List=flatten(ccx_4.Points), Index=panel_15, Wrap=True)
expression_24 = Expression(x=panel_12, y=Slider(3.209, range=0..10), Expression="x*y")
pline_3 = PolyLine(Vertices=item_35, Closed=False)
deplane_6 = DeconstructPlane(Plane=item_20)  # -> Origin, XAxis, YAxis, ZAxis
pl_4 = ConstructPlane(Origin=item_20, XAxis=deplane_6.YAxis, YAxis=deplane_6.ZAxis)
end_6 = EndPoints(Curve=join_8)  # -> Start, End
expression_25 = Expression(x=expression_24, Expression="5*x")
# 移动一个字符
panel_16 = Panel(neg_6)
panel_17 = Panel(expression_7)
rectangle_7 = Rectangle(Plane=end_6.Start, XSize=expression_25, YSize=expression_25, Radius=0)  # -> Rectangle, Length
expression_26 = Expression(x=panel_17, y=panel_16, Expression="-y-x")
number_slider_11 = Slider(0, range=0..5)
Y_3 = UnitY(Factor=expression_26)
panel_18 = Panel(panel_12)
expression_27 = Expression(x=panel_18, Expression="(x)*4")
# 数字3
crv_18 = Curve(join_8)
neg_8 = Negative(Value=expression_27)
# 调整大小
number_slider_12 = Slider(0.85, range=0..10)
crv_19 = Curve(rotate_3.Geometry)
panel_19 = Panel("""1
2
3
4""")
panel_20 = Panel("0,0,1")
end_7 = EndPoints(Curve=crv_19)  # -> Start, End
pdecon = Deconstruct(Point=end_7.End)  # -> XComponent, YComponent, ZComponent
# 放射线
panel_21 = Panel(pdecon.XComponent)
edges_4 = BrepEdges(Brep=revsrf)  # -> Naked, Interior, NonManifold
clscrv_2 = CloseCurve(Curve=crv_18, CloseType=0, Bulge=0.5, Tolerance=0)  # -> Closed, R
item_36 = ListItem(List=edges_4.Naked, Index=Slider(0, range=0..10), Wrap=True)
item_37 = ListItem(List=edges_4.Naked, Index=Slider(2, range=0..10), Wrap=True)
pt_6 = ConstructPoint(XCoordinate=0, YCoordinate=pdecon.YComponent, ZCoordinate=0)
join_9 = JoinCurves(Curves=flatten([item_36, item_37]), Preserve=False)
mirror_2 = Mirror(Geometry=join_9, Plane=PlaneYZ(0, 0, 0))  # -> Geometry, Transform
join_10 = JoinCurves(Curves=flatten([join_9, mirror_2.Geometry]), Preserve=False)
number_slider_13 = Slider(16, range=0..100)
offcrv_6 = OffsetCurve(Curve=join_10, Plane=PlaneXY(0, 0, 0), Distance=Slider(0.37, range=0..3), BothSides=False, Kinks=0, CapType=1)
cir_2 = Circle(Plane=pt_6, Radius=Slider(4.676, range=0..10))
boundary_3 = BoundarySurfaces(Edges=flatten([offcrv_6, join_10]))
xz_3 = XZPlane(Origin=pt_6)
xz_4 = XZPlane(Origin=pt_6)
panel_22 = Panel(number_slider)
Z_5 = UnitZ(Factor=Slider(0.25, range=0..3))
# 正方形坐标
number_slider_14 = Slider(8, range=0..10)
text_3 = Text(
    Location="0,0,0",
    Text=Slider(4, range=0..10),
    Size=Slider(50, range=0..100),
    Bold=False,
    HorizontalAlignment=0,
    VerticalAlignment=0)
# 数字4
crv_20 = Curve([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])
explode_6 = Explode(Curve=text_3, Recursive=True)  # -> Segments, Vertices

# ----
# 空隙
panel_23 = Panel(number_slider_9)
expression_28 = Expression(x=panel_23, y=neg_6, z=panel_12, Expression="-((y-x)-z)")
expression_29 = Expression(x=panel_23, y=panel_12, Expression="(y+x)")

item_38 = ListItem(List=flatten(explode_6.Segments), Index=number_slider_14, Wrap=True)
# 小方形
number_slider_15 = Slider(2, range=0..10)
end_8 = EndPoints(Curve=item_38)  # -> Start, End
Y_4 = UnitY(Factor=expression_29)
neg_9 = Negative(Value=Y_4)
X_4 = UnitX(Factor=expression_28)
neg_10 = Negative(Value=neg_6)
panel_24 = Panel(neg_10)
# 数值
panel_25 = Panel(number_slider_9)
Y_5 = UnitY(Factor=expression_26)
item_39 = ListItem(List=flatten(explode_5.Segments), Index="3", Wrap=True)
pt_7 = Point(curvepoint)

deplane_7 = DeconstructPlane(Plane=pt_7)  # -> Origin, XAxis, YAxis, ZAxis
pl_5 = ConstructPlane(Origin=pt_7, XAxis=deplane_7.ZAxis, YAxis=deplane_7.XAxis)

# ----
# 数字5
panel_26 = Panel(neg_10)
panel_27 = Panel(panel_12)
expression_30 = Expression(x=panel_25, y=panel_27, Expression="(-x)-y")
X_5 = UnitX(Factor=expression_30)
Y_6 = UnitY(Factor=expression_30)
neg_11 = Negative(Value=Y_6)
expression_31 = Expression(x=panel_26, y=panel_27, Expression="-(x-y)")
crv_21 = Curve(<curve referenced from the Rhino model>)
len_8 = Length(Curve=crv_21)
panel_28 = Panel(len_8)
expression_32 = Expression(x=panel_26, y=Slider(4, range=0..10), Expression="-x*y")
neg_12 = Negative(Value=panel_12)
expression_33 = Expression(x=panel_26, Expression="x/20")
expression_34 = Expression(x=panel_26, Expression="x*3")
item_40 = ListItem(List=flatten(explode_5.Segments), Index="3", Wrap=True)
panel_29 = Panel("""1
3""")
item_41 = ListItem(List=flatten(explode_5.Segments), Index=Slider(6, range=0..10), Wrap=True)

# ----
# 坐标
pframes_7 = PerpFrames(Curve=item_41, Count=Slider(1, range=0..10), Align=True)  # -> Frames, Parameters
item_42 = ListItem(List=pframes_7.Frames, Index="1", Wrap=True)

deplane_8 = DeconstructPlane(Plane=item_42)  # -> Origin, XAxis, YAxis, ZAxis
pl_6 = ConstructPlane(Origin=item_42, XAxis=deplane_8.YAxis, YAxis=deplane_8.ZAxis)

deplane_9 = DeconstructPlane(Plane=item_42)  # -> Origin, XAxis, YAxis, ZAxis
neg_13 = Negative(Value=expression_33)
neg_14 = Negative(Value=expression_34)
# 移动
dom_11 = ConstructDomain(DomainStart=expr("-x", expression_33), DomainEnd=expr("x", expression_7))
deplane_10 = DeconstructPlane(Plane=pl_6)  # -> Origin, XAxis, YAxis, ZAxis
multiplication_3 = Multiplication(A=panel_25, B=deplane_10.YAxis)
neg_15 = Negative(Value=multiplication_3)
multiplication_4 = Multiplication(A=panel_25, B=deplane_10.XAxis)
multiplication_5 = Multiplication(A=panel_25, B=deplane_10.YAxis)
neg_16 = Negative(Value=neg_10)
neg_17 = Negative(Value=panel_12)
move_7 = Move(Geometry=item_41, Motion=multiplication_4)  # -> Geometry, Transform
# 下
neg_18 = Negative(Value=multiplication_5)
panel_30 = Panel(neg_10)
expression_35 = Expression(x=panel_26, y=Slider(35.79, range=0..100), Expression="-x*y")
neg_19 = Negative(Value=neg_12)
neg_20 = Negative(Value=neg_19)
neg_21 = Negative(Value=panel_12)
# 小方形
expression_36 = Expression(x=panel_12, Expression="x")
panel_31 = Panel(expression_36)
neg_22 = Negative(Value=panel_31)
number_slider_16 = Slider(0.93, range=0..1)
panel_32 = Panel("""0
1
2
3""")
explode_7 = Explode(Curve=rotate_8.Geometry, Recursive=True)  # -> Segments, Vertices
panel_33 = Panel("""0
1
2
3""")
# 数字8
# 上
item_43 = ListItem(List=flatten(explode_7.Segments), Index=panel_32, Wrap=True)
neg_23 = Negative(Value=neg_16)
join_11 = JoinCurves(Curves=item_43, Preserve=False)
area_3 = Area(Geometry=join_11)  # -> Area, Centroid
scale_2 = Scale(Geometry=join_11, Center=area_3.Centroid, Factor=Slider(0.56, range=0..1))  # -> Geometry, Transform
item_44 = ListItem(List=flatten(explode_7.Segments), Index=Slider(4, range=0..10), Wrap=True)

# ----
# 正方形坐标
number_slider_17 = Slider(1, range=0..10)
pframes_8 = PerpFrames(Curve=item_44, Count=number_slider_17, Align=True)  # -> Frames, Parameters
item_45 = ListItem(List=pframes_8.Frames, Index="1", Wrap=True)

# ----
# 坐标转换
deplane_11 = DeconstructPlane(Plane=item_45)  # -> Origin, XAxis, YAxis, ZAxis
pl_7 = ConstructPlane(Origin=item_45, XAxis=deplane_11.YAxis, YAxis=deplane_11.ZAxis)

deplane_12 = DeconstructPlane(Plane=pl_7)  # -> Origin, XAxis, YAxis, ZAxis
multiplication_6 = Multiplication(A=deplane_12.YAxis, B=panel_25)
multiplication_7 = Multiplication(A=deplane_12.XAxis, B=panel_25)
neg_24 = Negative(Value=multiplication_6)
explode_8 = Explode(Curve=scale_2.Geometry, Recursive=True)  # -> Segments, Vertices
move_8 = Move(Geometry=item_44, Motion=multiplication_7)  # -> Geometry, Transform
expression_37 = Expression(x=neg_20, Expression="x/2")
neg_25 = Negative(Value=neg_20)
neg_26 = Negative(Value=neg_20)
offcrv_7 = OffsetCurve(Curve=explode_8.Segments, Plane=PlaneXY(0, 0, 0), Distance=neg_20, BothSides=False, Kinks=0, CapType=1)
runion_4 = RegionUnion(Curves=flatten(offcrv_7))
cp_7 = ControlPoints(Curve=crv_18)  # -> Points, Weights, Knots
# 数字9
item_46 = ListItem(List=flatten(cp_7.Points), Index=Slider(2, range=0..10), Wrap=True)
expression_38 = Expression(x=neg_26, Expression="x/2")

# ----
# 坐标系
number_slider_18 = Slider(-70.39, range=-180..180)

deplane_13 = DeconstructPlane(Plane=pt_3)  # -> Origin, XAxis, YAxis, ZAxis
deplane_14 = DeconstructPlane(Plane=item_20)  # -> Origin, XAxis, YAxis, ZAxis
multiplication_8 = Multiplication(A=Slider(1, range=0..10), B=deplane_13.XAxis)

pl_8 = ConstructPlane(Origin=item_20, XAxis=deplane_14.YAxis, YAxis=deplane_14.ZAxis)
rotate_10 = Rotate(Geometry=pl_8, Angle=degrees(number_slider_18), Plane=pl_8)  # -> Geometry, Transform

neg_27 = Negative(Value=deplane_13.XAxis)
deplane_15 = DeconstructPlane(Plane=rotate_10.Geometry)  # -> Origin, XAxis, YAxis, ZAxis
neg_28 = Negative(Value=deplane_15.XAxis)

multiplication_9 = Multiplication(A=number_slider_5, B=neg_28)
bzspan = BezierSpan(StartPoint=deplane_13.Origin, StartTangent=multiplication_8, EndPoint=deplane_15.Origin, EndTangent=multiplication_9)  # -> Curve, Length, Domain

# ----
# 中间面
extr_2 = Extrude(Base=bzspan.Curve, Direction=Y)
move_9 = Move(Geometry=extr_2, Motion=neg_5)  # -> Geometry, Transform
srf = Surface(move_9.Geometry)
# 圆圈
project_9 = Project(Curve=join_7, Brep=srf, Direction="0,0,1")
srfsplit = SurfaceSplit(Surface=move_9.Geometry, Curves=project_9)
item_47 = ListItem(List=srfsplit, Index="0", Wrap=True)
edges_5 = BrepEdges(Brep=item_47)  # -> Naked, Interior, NonManifold
project_10 = Project(Curve=edges_5.Naked, Brep=extr, Direction="1,0,0")
ccx_7 = CurveCurve(CurveA=scale_nu.Geometry, CurveB=project_10)  # -> Points, ParamsA, ParamsB
ccx_8 = CurveCurve(CurveA=rotate_6.Geometry, CurveB=project_10)  # -> Points, ParamsA, ParamsB
item_48 = ListItem(List=flatten(ccx_8.Points), Index="0", Wrap=True)

# ----
# 上线段长度
pdecon_2 = Deconstruct(Point=item_48)  # -> XComponent, YComponent, ZComponent
pt_8 = ConstructPoint(XCoordinate=0, YCoordinate=pdecon_2.YComponent, ZCoordinate=0)
ln_8 = Line(StartPoint=pt_8, EndPoint=midpt)

item_49 = ListItem(List=flatten(ccx_7.Points), Index="0", Wrap=True)

# ----
# 下线段长度
pdecon_3 = Deconstruct(Point=item_49)  # -> XComponent, YComponent, ZComponent
pt_9 = ConstructPoint(XCoordinate=0, YCoordinate=pdecon_3.YComponent, ZCoordinate=0)
ln_9 = Line(StartPoint=pt_9, EndPoint=midpt)

len_9 = Length(Curve=ln_8)
rectangle_8 = Rectangle(Plane=item_48, XSize=dom_10, YSize=len_9, Radius=0)  # -> Rectangle, Length
cp_8 = ControlPoints(Curve=rectangle_8.Rectangle)  # -> Points, Weights, Knots
item_50 = ListItem(List=flatten(cp_8.Points), Index="1", Wrap=True)
item_51 = ListItem(List=flatten(cp_8.Points), Index="0", Wrap=True)
len_10 = Length(Curve=ln_9)
rectangle_9 = Rectangle(Plane=item_49, XSize=dom_9, YSize=len_10, Radius=0)  # -> Rectangle, Length

# ----
# 中部线段
project_11 = Project(Curve=rectangle_9.Rectangle, Brep=boundary_2, Direction="0,0,1")
project_12 = Project(Curve=project_9, Brep=boundary_2, Direction="0,0,1")
runion_5 = RegionUnion(Curves=flatten([project_12, project_11]))

project_13 = Project(Curve=runion_5, Brep=move_9.Geometry, Direction="0,0,1")

srfsplit_2 = SurfaceSplit(Surface=move_9.Geometry, Curves=project_13)
item_52 = ListItem(List=srfsplit_2, Index=Slider(3, range=0..5), Wrap=True)
srf_2 = Surface(item_52)
# 眼睛
mirror_3 = Mirror(Geometry=srf_2, Plane=PlaneYZ(0, 0, 0))  # -> Geometry, Transform
sunion = SolidUnion(Breps=[srf_2, mirror_3.Geometry])

ln_10 = Line(StartPoint=item_50, EndPoint=item_51)

expression_39 = Expression(x=expression_2, y=Slider(35, range=0..100), Expression="x/y")
expression_40 = Expression(x=expression_2, y=Slider(4.5, range=0..50), Expression="x/y")
expression_41 = Expression(x=expression_40, y=Slider(1.03, range=0..10), Expression="x*y")
expression_42 = Expression(x=expression_39, y=Slider(2.152, range=0..10), Expression="x*y")
midpt_10 = CurveMiddle(Curve=bzspan.Curve)
dom_12 = ConstructDomain(DomainStart=expr("-x", expression_39), DomainEnd=expr("x", expression_39))
dom_13 = ConstructDomain(DomainStart=expr("-x", expression_40), DomainEnd=expr("x", expression_40))
dom_14 = ConstructDomain(DomainStart=expr("-x", expression_41), DomainEnd=expr("x", expression_41))
dom_15 = ConstructDomain(DomainStart=expr("-x", expression_42), DomainEnd=expr("x", expression_42))
rectangle_10 = Rectangle(Plane=midpt_10, XSize=dom_13, YSize=dom_12, Radius=0)  # -> Rectangle, Length
rectangle_11 = Rectangle(Plane=midpt_10, XSize=dom_14, YSize=dom_15, Radius=0)  # -> Rectangle, Length

# ----
# 坐标转换
deplane_16 = DeconstructPlane(Plane=item_50)  # -> Origin, XAxis, YAxis, ZAxis
pl_9 = ConstructPlane(Origin=item_50, XAxis=deplane_16.XAxis, YAxis=deplane_16.YAxis)

rotate_11 = Rotate(Geometry=pl_9, Angle=degrees(Slider(24.03, range=-180..180)), Plane=item_50)  # -> Geometry, Transform

deplane_17 = DeconstructPlane(Plane=rotate_11.Geometry)  # -> Origin, XAxis, YAxis, ZAxis
deplane_18 = DeconstructPlane(Plane=pl_4)  # -> Origin, XAxis, YAxis, ZAxis
multiplication_10 = Multiplication(A=Slider(2.8, range=0..10), B=deplane_17.YAxis)
multiplication_11 = Multiplication(A=Slider(3.3, range=0..10), B=deplane_18.ZAxis)
bzspan_2 = BezierSpan(StartPoint=deplane_17.Origin, StartTangent=multiplication_10, EndPoint=deplane_15.Origin, EndTangent=multiplication_11)  # -> Curve, Length, Domain

# ----
# 眉毛曲线
neg_29 = Negative(Value=deplane_18.YAxis)
merge_4 = Merge(Data1=bzspan_2.Curve, Data2=ln_10)
join_12 = JoinCurves(Curves=flatten(merge_4), Preserve=False)
project_14 = Project(Curve=join_12, Brep=move_9.Geometry, Direction="0,0,1")

srfsplit_3 = SurfaceSplit(Surface=revsrf, Curves=project_8)
# 剪切
item_53 = ListItem(List=srfsplit_3, Index="1", Wrap=True)

# ----
# 直线
neg_30 = Negative(Value=number_slider_6)
neg_31 = Negative(Value=deplane_5.XAxis)
line_9 = LineSDL(Start=midpt_9, Direction="1,0,0", Length=neg_30)
multiplication_12 = Multiplication(A=deplane_5.YAxis, B=number_slider_9)
crv_22 = Curve(line_8)
neg_32 = Negative(Value=panel_12)

line_10 = LineSDL(Start=midpt_4, Direction=Vector(0, 0, 1), Length=neg)
panel_34 = Panel("""0.875
1""")
expression_43 = Expression(x=expression_2, y=Slider(14, range=0..100), Expression="x/y")
expression_44 = Expression(x=expression_2, y=Slider(15, range=0..100), Expression="x/y")
Z_6 = UnitZ(Factor=expression_44)
neg_33 = Negative(Value=Z_6)

shatter_7 = Shatter(Curve=reparameterize(line_10), Parameters=panel_34)
item_54 = ListItem(List=shatter_7, Index="1", Wrap=True)
# 耳朵曲线
crv_23 = Curve(item_54)

deplane_19 = DeconstructPlane(Plane=crv_23)  # -> Origin, XAxis, YAxis, ZAxis

pline_4 = PolyLine(Vertices=item_32, Closed=False)
ln_11 = Line(StartPoint=item_33, EndPoint=ccx_3.Points)

# ----
# 底部三角
curvepoint_2 = PointOnCurve(ln_11, parameter=0.262)
# 左交点
line_11 = LineSDL(Start=curvepoint_2, Direction=neg_31, Length=number_slider_6)
ccx_9 = CurveCurve(CurveA=line_11, CurveB=line_9)  # -> Points, ParamsA, ParamsB
ln_12 = Line(StartPoint=curvepoint_2, EndPoint=ccx_9.Points)
move_10 = Move(Geometry=ln_12, Motion=multiplication_12)  # -> Geometry, Transform
# 右交点
ccx_10 = CurveCurve(CurveA=move_10.Geometry, CurveB=line_9)  # -> Points, ParamsA, ParamsB
ccx_11 = CurveCurve(CurveA=crv_22, CurveB=move_10.Geometry)  # -> Points, ParamsA, ParamsB
ln_13 = Line(StartPoint=ccx_10.Points, EndPoint=ccx_11.Points)
ext = ExtendCurve(Curve=ln_13, Type=0, Start=panel_12, End=panel_12)

ln_14 = Line(StartPoint=ccx_9.Points, EndPoint=midpt_9)
len_11 = Length(Curve=ln_14)
dom_16 = ConstructDomain(DomainStart=expr("x", len_11), DomainEnd=expr("-x", len_11))
ccx_12 = CurveCurve(CurveA=pline_4, CurveB=move_6.Geometry)  # -> Points, ParamsA, ParamsB

ln_15 = Line(StartPoint=item_34, EndPoint=ccx_12.Points)

offcrv_8 = OffsetCurve(Curve=ln_11, Plane=PlaneXY(0, 0, 0), Distance=panel_12, BothSides=False, Kinks=0, CapType=1)
offcrv_9 = OffsetCurve(Curve=pline_4, Plane=PlaneXY(0, 0, 0), Distance=neg_7, BothSides=False, Kinks=0, CapType=1)
offcrv_10 = OffsetCurve(Curve=ln_15, Plane=PlaneXY(0, 0, 0), Distance=panel_12, BothSides=False, Kinks=0, CapType=1)
offcrv_11 = OffsetCurve(Curve=pline_3, Plane=PlaneXY(0, 0, 0), Distance=expression_24, BothSides=False, Kinks=0, CapType=1)
offcrv_12 = OffsetCurve(Curve=ln_12, Plane=PlaneXY(0, 0, 0), Distance=neg_6, BothSides=False, Kinks=0, CapType=1)
offcrv_13 = OffsetCurve(Curve=ext, Plane=PlaneXY(0, 0, 0), Distance=neg_32, BothSides=False, Kinks=0, CapType=1)
rectangle_12 = Rectangle(Plane=midpt_9, XSize=dom_16, YSize=neg_6, Radius=0)  # -> Rectangle, Length

merge_5 = Merge(Data1=offcrv_4, Data2=offcrv_9, Data3=offcrv_8, Data4=offcrv_10)
runion_6 = RegionUnion(Curves=flatten(merge_5))
runion_7 = RegionUnion(Curves=flatten([offcrv_12, offcrv_13, rectangle_12.Rectangle]))
rdiff_3 = RegionDifference(CurvesA=runion_6, CurvesB=offcrv_11)
rdiff_4 = RegionDifference(CurvesA=runion_7, CurvesB=rectangle_7.Rectangle)
expression_45 = Expression(x=len_11, Expression="2*x")
boundary_4 = BoundarySurfaces(Edges=rdiff_3)
boundary_5 = BoundarySurfaces(Edges=rdiff_4)
merge_6 = Merge(Data1=boundary_4, Data2=boundary_5)
move_11 = Move(Geometry=merge_6, Motion=Y_3)  # -> Geometry, Transform
X_6 = UnitX(Factor=expression_45)
move_12 = Move(Geometry=move_11.Geometry, Motion=X_6)  # -> Geometry, Transform
neg_34 = Negative(Value=X_6)

X_7 = UnitX(Factor=1)
multiplication_13 = Multiplication(A=X_7, B=number_slider_9)
multiplication_14 = Multiplication(A=deplane_5.YAxis, B=number_slider_9)
neg_35 = Negative(Value=Slider(1.427, range=0..10))
item_55 = ListItem(List=flatten(explode_5.Segments), Index="0", Wrap=True)
crv_24 = Curve(offcrv_4)
neg_36 = Negative(Value=multiplication_14)
multiplication_15 = Multiplication(A=multiplication_13, B=neg_35)
# 上部
move_13 = Move(Geometry=item_55, Motion=neg_36)  # -> Geometry, Transform
move_14 = Move(Geometry=ln_11, Motion=multiplication_15)  # -> Geometry, Transform
ccx_13 = CurveCurve(CurveA=move_13.Geometry, CurveB=move_14.Geometry)  # -> Points, ParamsA, ParamsB
ccx_14 = CurveCurve(CurveA=crv_24, CurveB=move_14.Geometry)  # -> Points, ParamsA, ParamsB
item_56 = ListItem(List=ccx_14.Points, Index="0", Wrap=True)
ln_16 = Line(StartPoint=item_56, EndPoint=ccx_13.Points)
neg_37 = Negative(Value=panel_12)
offcrv_14 = OffsetCurve(Curve=ln_16, Plane=PlaneXY(0, 0, 0), Distance=neg_37, BothSides=False, Kinks=0, CapType=1)
offcrv_15 = OffsetCurve(Curve=move_13.Geometry, Plane=PlaneXY(0, 0, 0), Distance=panel_12, BothSides=False, Kinks=0, CapType=1)
merge_7 = Merge(Data1=crv_24, Data2=offcrv_15, Data3=offcrv_14)
runion_8 = RegionUnion(Curves=flatten(merge_7))
mirror_4 = Mirror(Geometry=rectangle_7.Rectangle, Plane=PlaneYZ(0, 0, 0))  # -> Geometry, Transform

expression_46 = Expression(x=len_11, Expression="(x)*4")
X_8 = UnitX(Factor=expression_46)
end_9 = EndPoints(Curve=ln_14)  # -> Start, End
offcrv_16 = OffsetCurve(Curve=ln_15, Plane=PlaneXY(0, 0, 0), Distance=panel_26, BothSides=False, Kinks=0, CapType=1)

# ----
# 上部三角
crv_25 = Curve(offcrv_9)
crv_26 = Curve(offcrv_4)
ccx_15 = CurveCurve(CurveA=offcrv_16, CurveB=crv_25)  # -> Points, ParamsA, ParamsB
ccx_16 = CurveCurve(CurveA=offcrv_16, CurveB=crv_26)  # -> Points, ParamsA, ParamsB
item_57 = ListItem(List=ccx_15.Points, Index=Slider(3, range=0..10), Wrap=True)
# 修改数字2
item_58 = ListItem(List=ccx_16.Points, Index=Slider(0, range=0..10), Wrap=True)
ln_17 = Line(StartPoint=item_58, EndPoint=item_57)
end_10 = EndPoints(Curve=ln_17)  # -> Start, End
end_11 = EndPoints(Curve=ln_15)  # -> Start, End
ln_18 = Line(StartPoint=end_11.Start, EndPoint=end_10.Start)
ln_19 = Line(StartPoint=end_11.End, EndPoint=end_10.End)
merge_8 = Merge(Data1=ln_15, Data2=ln_18, Data3=ln_19, Data4=ln_17)
join_13 = JoinCurves(Curves=flatten(merge_8), Preserve=False)

merge_9 = Merge(Data1=offcrv_4, Data2=offcrv_9, Data3=offcrv_8, Data4=join_13)
runion_9 = RegionUnion(Curves=flatten(merge_9))
rdiff_5 = RegionDifference(CurvesA=runion_9, CurvesB=offcrv_11)

# ----
# 移动
expression_47 = Expression(x=len_11, Expression="(x)*8")
X_9 = UnitX(Factor=expression_47)

mirror_5 = Mirror(Geometry=rdiff_5, Plane=pl_5)  # -> Geometry, Transform

cpoly = ControlPolygon(Curve=mirror_5.Geometry)  # -> Polygon, Points
pt_10 = Point(midpt_9)
item_59 = ListItem(List=flatten(cpoly.Points), Index=Slider(5, range=0..10), Wrap=True)
# 移动
devec = DeconstructVector(Vector=pt_10)  # -> XComponent, YComponent, ZComponent
devec_2 = DeconstructVector(Vector=item_59)  # -> XComponent, YComponent, ZComponent
panel_35 = Panel(devec.YComponent)
panel_36 = Panel(devec_2.YComponent)
expression_48 = Expression(x=panel_35, y=panel_36, Expression="(-x)-(-y)")

expression_49 = Expression(x=len_11, Expression="(x)*10")
X_10 = UnitX(Factor=expression_49)

# ----
# 移动
expression_50 = Expression(x=len_11, Expression="(x)*12")
X_11 = UnitX(Factor=expression_50)

# ----
# 移动
expression_51 = Expression(x=len_11, Expression="(x)*14")
X_12 = UnitX(Factor=expression_51)

# ----
# 移动
expression_52 = Expression(x=len_11, Expression="(x)*16")
X_13 = UnitX(Factor=expression_52)

# ----
# 移动
expression_53 = Expression(x=len_11, Expression="(x)*18")
X_14 = UnitX(Factor=expression_53)

end_12 = EndPoints(Curve=crv_23)  # -> Start, End

pl_10 = ConstructPlane(Origin=end_12.Start, XAxis=deplane_19.YAxis, YAxis=deplane_19.ZAxis)

cir_3 = Circle(Plane=pl_10, Radius=expression_43)

project_15 = Project(Curve=cir_3, Brep=item_53, Direction="1,0,0")
srfsplit_4 = SurfaceSplit(Surface=item_53, Curves=project_15)
item_60 = ListItem(List=srfsplit_4, Index="0", Wrap=True)

srf_3 = Surface(item_60)
mirror_6 = Mirror(Geometry=srf_3, Plane=PlaneYZ(0, 0, 0))  # -> Geometry, Transform

edges_6 = BrepEdges(Brep=srf_3)  # -> Naked, Interior, NonManifold
join_14 = JoinCurves(Curves=edges_6.Naked, Preserve=False)
project_16 = Project(Curve=join_14, Brep=move_9.Geometry, Direction="0,0,1")

srfsplit_5 = SurfaceSplit(Surface=move_9.Geometry, Curves=project_16)
item_61 = ListItem(List=srfsplit_5, Index=Slider(4, range=0..5), Wrap=True)
srf_4 = Surface(item_61)
mirror_7 = Mirror(Geometry=srf_4, Plane=PlaneYZ(0, 0, 0))  # -> Geometry, Transform
sunion_2 = SolidUnion(Breps=[srf_4, mirror_7.Geometry])

# ----
# big edge
srf_5 = Surface(srf_3)
edges_7 = BrepEdges(Brep=srf_5)  # -> Naked, Interior, NonManifold
item_62 = ListItem(List=flatten(edges_7.Naked), Index=Slider(6, range=0..12), Wrap=True)

item_63 = ListItem(List=flatten(edges_7.Naked), Index=Slider(5, range=0..12), Wrap=True)
shatter_8 = Shatter(Curve=reparameterize(item_63), Parameters="0.5")
item_64 = ListItem(List=shatter_8, Index=panel_4, Wrap=True)

crv_27 = Curve(item_62)
crv_28 = Curve(item_62)
shatter_9 = Shatter(Curve=reparameterize(crv_28), Parameters=panel_2)
shatter_10 = Shatter(Curve=reparameterize(crv_27), Parameters="0.5")
item_65 = ListItem(List=shatter_10, Index=panel_4, Wrap=True)
item_66 = ListItem(List=shatter_9, Index="0", Wrap=True)

flip_2 = FlipCurve(Curve=item_65)  # -> Curve, Flag
flip_3 = FlipCurve(Curve=item_66)  # -> Curve, Flag

edges_8 = BrepEdges(Brep=srf_5)  # -> Naked, Interior, NonManifold
item_67 = ListItem(List=edges_8.Naked, Index=Slider(3, range=0..12), Wrap=True)

flip_4 = FlipCurve(Curve=item_67)  # -> Curve, Flag

srfsplit_6 = SurfaceSplit(Surface=srf_2, Curves=project_14)
item_68 = ListItem(List=srfsplit_6, Index=Slider(2, range=0..5), Wrap=True)
# 眼睛
srf_6 = Surface(item_68)

edges_9 = BrepEdges(Brep=srf_6)  # -> Naked, Interior, NonManifold
item_69 = ListItem(List=edges_9.Naked, Index=Slider(6, range=0..12), Wrap=True)

item_70 = ListItem(List=edges_9.Naked, Index=Slider(7, range=0..12), Wrap=True)
extr_3 = Extrude(Base=item_70, Direction=Z_2)
extr_4 = Extrude(Base=item_69, Direction=Z_2)
srfsplit_7 = SurfaceSplit(Surface=extr_4, Curves=project_6)
srfsplit_8 = SurfaceSplit(Surface=extr_3, Curves=project_6)
item_71 = ListItem(List=srfsplit_7, Index="1", Wrap=True)
item_72 = ListItem(List=srfsplit_8, Index="1", Wrap=True)
srf_7 = Surface(item_72)
srf_8 = Surface(item_71)
project_17 = Project(Curve=crv_16, Brep=srf_7, Direction="1,0,0")

edges_10 = BrepEdges(Brep=srf_6)  # -> Naked, Interior, NonManifold
item_73 = ListItem(List=edges_10.Naked, Index=Slider(8, range=0..12), Wrap=True)

srfsplit_9 = SurfaceSplit(Surface=srf_7, Curves=project_17)
item_74 = ListItem(List=srfsplit_9, Index="1", Wrap=True)
# 眼眶
srf_9 = Surface(item_74)
edges_11 = BrepEdges(Brep=srf_9)  # -> Naked, Interior, NonManifold
item_75 = ListItem(List=edges_11.Naked, Index=number_slider_8, Wrap=True)
swp2 = Sweep2(Rail1=item_73, Rail2=flip_4.Curve, Sections=item_75, SameHeight=False)
project_18 = Project(Curve=rectangle_11.Rectangle, Brep=srf_6, Direction="0,0,1")
project_19 = Project(Curve=rectangle_10.Rectangle, Brep=srf_6, Direction="0,0,1")
srfsplit_10 = SurfaceSplit(Surface=srf_6, Curves=project_18)
item_76 = ListItem(List=srfsplit_10, Index=number_slider_11, Wrap=True)
item_77 = ListItem(List=srfsplit_10, Index=Slider(1, range=0..5), Wrap=True)
srfsplit_11 = SurfaceSplit(Surface=item_77, Curves=project_19)
item_78 = ListItem(List=srfsplit_11, Index=number_slider_11, Wrap=True)
merge_10 = Merge(Data1=item_76, Data2=item_78)

mirror_8 = Mirror(Geometry=merge_10, Plane=PlaneYZ(0, 0, 0))  # -> Geometry, Transform

edges_12 = BrepEdges(Brep=srf_6)  # -> Naked, Interior, NonManifold
item_79 = ListItem(List=edges_12.Naked, Index=Slider(5, range=0..12), Wrap=True)

shatter_11 = Shatter(Curve=reparameterize(item_79), Parameters=panel_2)
item_80 = ListItem(List=shatter_11, Index="1", Wrap=True)
item_81 = ListItem(List=shatter_11, Index="0", Wrap=True)

crv_29 = Curve(item_81)
crv_30 = Curve(item_81)
shatter_12 = Shatter(Curve=reparameterize(crv_29), Parameters=panel_2)
shatter_13 = Shatter(Curve=reparameterize(crv_30), Parameters="0.5")
item_82 = ListItem(List=shatter_12, Index="0", Wrap=True)
item_83 = ListItem(List=shatter_13, Index=panel_4, Wrap=True)

flip_5 = FlipCurve(Curve=item_80)  # -> Curve, Flag
flip_6 = FlipCurve(Curve=item_81)  # -> Curve, Flag

loft = Loft(
    Curves=flatten([flip_5.Curve, item_64]),
    Options={Adjust=False, Closed=False, LoftEnds=0, LoftSimp=0, LoftType=0, Rebuild=10, Refit=0.01})

loft_2 = Loft(
    Curves=flatten([flip_2.Curve, item_82]),
    Options={Adjust=False, Closed=False, LoftEnds=0, LoftSimp=0, LoftType=0, Rebuild=10, Refit=0.01})
# 数字1
loft_3 = Loft(
    Curves=flatten([flip_3.Curve, item_83]),
    Options={Adjust=False, Closed=False, LoftEnds=0, LoftSimp=0, LoftType=0, Rebuild=10, Refit=0.01})

edges_13 = BrepEdges(Brep=loft_2)  # -> Naked, Interior, NonManifold
edges_14 = BrepEdges(Brep=srf_6)  # -> Naked, Interior, NonManifold
item_84 = ListItem(List=edges_13.Naked, Index=Slider(0, range=0..100), Wrap=True)
# 鼻子
item_85 = ListItem(List=edges_14.Naked, Index=Slider(10, range=0..100), Wrap=True)
loft_4 = Loft(
    Curves=flatten([item_84, item_85]),
    Options={Adjust=False, Closed=False, LoftEnds=0, LoftSimp=0, LoftType=0, Rebuild=10, Refit=0.01})

merge_11 = Merge(Data1=srf_9, Data2=srf_8, Data3=loft, Data4=loft_3, Data5=loft_2, Data6=loft_4, Data7=swp2)
join_15 = BrepJoin(Breps=flatten(merge_11))  # -> Breps, Closed
mirror_9 = Mirror(Geometry=join_15.Breps, Plane=PlaneYZ(0, 0, 0))  # -> Geometry, Transform

sunion_3 = SolidUnion(Breps=[srf_3, mirror_6.Geometry])
sunion_4 = SolidUnion(Breps=[mirror_9.Geometry, join_15.Breps])
sunion_5 = SolidUnion(Breps=[mirror_8.Geometry, merge_10])

edges_15 = BrepEdges(Brep=sunion_3)  # -> Naked, Interior, NonManifold
join_16 = JoinCurves(Curves=flatten(edges_15.Naked), Preserve=False)
item_86 = ListItem(List=join_16, Index=Slider(3, range=0..12), Wrap=True)
extr_5 = Extrude(Base=item_86, Direction=neg_33)

join_17 = BrepJoin(Breps=flatten([sunion_3, sunion_5, sunion_4, extr_5]))  # -> Breps, Closed

curvepoint_3 = PointOnCurve(line_8, parameter=0.426)
panel_37 = Panel(expression_21)
len_12 = Length(Curve=move_14.Geometry)
expression_54 = Expression(x=len_12, Expression="x/2")
X_15 = UnitX(Factor=panel_37)
Y_7 = UnitY(Factor=expression_54)
X_16 = UnitX(Factor=panel_12)
# 下部
neg_38 = Negative(Value=Y_7)
neg_39 = Negative(Value=X_16)
move_15 = Move(Geometry=move_14.Geometry, Motion=neg_38)  # -> Geometry, Transform
move_16 = Move(Geometry=move_15.Geometry, Motion=neg_39)  # -> Geometry, Transform
panel_38 = Panel("""0
1""")
neg_40 = Negative(Value=neg_37)

deplane_20 = DeconstructPlane(Plane=curvepoint_3)  # -> Origin, XAxis, YAxis, ZAxis
pl_11 = ConstructPlane(Origin=curvepoint_3, XAxis=deplane_20.ZAxis, YAxis=deplane_20.XAxis)

# ----
# 上
panel_39 = Panel("""2
3""")
# 下
panel_40 = Panel("""0
1
2
3""")
item_87 = ListItem(List=flatten(explode_5.Segments), Index=panel_40, Wrap=True)
item_88 = ListItem(List=flatten(explode_5.Segments), Index=panel_39, Wrap=True)
mirror_10 = Mirror(Geometry=item_87, Plane=pl_11)  # -> Geometry, Transform

item_89 = ListItem(List=flatten(mirror_10.Geometry), Index=Slider(0, range=0..10), Wrap=True)
# 数字6
join_18 = JoinCurves(Curves=item_88, Preserve=False)
join_19 = JoinCurves(Curves=mirror_10.Geometry, Preserve=False)
cp_9 = ControlPoints(Curve=join_19)  # -> Points, Weights, Knots
item_90 = ListItem(List=flatten(cp_9.Points), Index=panel_29, Wrap=True)
pline_5 = PolyLine(Vertices=item_90, Closed=False)
flip_7 = FlipCurve(Curve=join_19)  # -> Curve, Flag
move_17 = Move(Geometry=item_89, Motion=neg_18)  # -> Geometry, Transform
move_18 = Move(Geometry=pline_5, Motion=neg_15)  # -> Geometry, Transform
mirror_11 = Mirror(Geometry=join_11, Plane=pl_11)  # -> Geometry, Transform
explode_9 = Explode(Curve=mirror_11.Geometry, Recursive=True)  # -> Segments, Vertices

cp_10 = ControlPoints(Curve=mirror_11.Geometry)  # -> Points, Weights, Knots
panel_41 = Panel("""1
3""")
# 中线
item_91 = ListItem(List=flatten(cp_10.Points), Index=panel_41, Wrap=True)
pline_6 = PolyLine(Vertices=item_91, Closed=False)
scale_3 = Scale(Geometry=pline_6, Center=Point(0, 0, 0), Factor=Slider(0.93, range=0..1))  # -> Geometry, Transform

# ----
# 下
item_92 = ListItem(List=flatten(explode_9.Segments), Index=panel_33, Wrap=True)

offcrv_17 = OffsetCurve(Curve=item_43, Plane=PlaneXY(0, 0, 0), Distance=neg_16, BothSides=False, Kinks=0, CapType=1)
offcrv_18 = OffsetCurve(Curve=item_92, Plane=PlaneXY(0, 0, 0), Distance=neg_23, BothSides=False, Kinks=0, CapType=1)

item_93 = ListItem(List=flatten(explode_9.Segments), Index=Slider(1, range=0..10), Wrap=True)
rdiff_6 = RegionDifference(CurvesA=rotate_8.Geometry, CurvesB=offcrv_17)
mirror_12 = Mirror(Geometry=rdiff_6, Plane=pl_11)  # -> Geometry, Transform
move_19 = Move(Geometry=item_93, Motion=neg_24)  # -> Geometry, Transform
end_13 = EndPoints(Curve=move_19.Geometry)  # -> Start, End
offcrv_19 = OffsetCurve(Curve=scale_3.Geometry, Plane=PlaneXY(0, 0, 0), Distance=expression_37, BothSides=True, Kinks=0, CapType=1)
ccx_17 = CurveCurve(CurveA=move_19.Geometry, CurveB=offcrv_19)  # -> Points, ParamsA, ParamsB
item_94 = ListItem(List=ccx_17.Points, Index=Slider(2, range=0..10), Wrap=True)
ln_20 = Line(StartPoint=end_13.End, EndPoint=item_94)

offcrv_20 = OffsetCurve(Curve=move_8.Geometry, Plane=PlaneXY(0, 0, 0), Distance=neg_26, BothSides=False, Kinks=0, CapType=1)
rdiff_7 = RegionDifference(CurvesA=offcrv_18, CurvesB=join_11)
offcrv_21 = OffsetCurve(Curve=ln_20, Plane=PlaneXY(0, 0, 0), Distance=neg_25, BothSides=False, Kinks=0, CapType=1)

rdiff_8 = RegionDifference(CurvesA=offcrv_19, CurvesB=join_11)

runion_10 = RegionUnion(Curves=flatten([offcrv_17, offcrv_20]))
runion_11 = RegionUnion(Curves=flatten([rdiff_7, offcrv_21, rdiff_8]))

boundary_6 = BoundarySurfaces(Edges=[runion_10, runion_4, runion_11])
move_20 = Move(Geometry=boundary_6, Motion=Y_3)  # -> Geometry, Transform
move_21 = Move(Geometry=move_20.Geometry, Motion=X_12)  # -> Geometry, Transform

mirror_13 = Mirror(Geometry=crv_24, Plane=pl_11)  # -> Geometry, Transform
ccx_18 = CurveCurve(CurveA=mirror_13.Geometry, CurveB=move_16.Geometry)  # -> Points, ParamsA, ParamsB
item_95 = ListItem(List=ccx_18.Points, Index=panel_38, Wrap=True)
pline_7 = PolyLine(Vertices=item_95, Closed=False)
move_22 = Move(Geometry=pline_7, Motion=X_15)  # -> Geometry, Transform
ccx_19 = CurveCurve(CurveA=mirror_13.Geometry, CurveB=move_22.Geometry)  # -> Points, ParamsA, ParamsB
pline_8 = PolyLine(Vertices=ccx_19.Points, Closed=False)

offcrv_22 = OffsetCurve(Curve=pline_7, Plane=PlaneXY(0, 0, 0), Distance=neg_40, BothSides=False, Kinks=0, CapType=1)
offcrv_23 = OffsetCurve(Curve=pline_8, Plane=PlaneXY(0, 0, 0), Distance=neg_40, BothSides=False, Kinks=0, CapType=1)
crv_31 = Curve(mirror_13.Geometry)

merge_12 = Merge(Data1=crv_31, Data2=offcrv_22, Data3=offcrv_23)

runion_12 = RegionUnion(Curves=flatten(merge_12))

rdiff_9 = RegionDifference(CurvesA=runion_12, CurvesB=graft(clscrv_2.Closed))
rdiff_10 = RegionDifference(CurvesA=runion_8, CurvesB=mirror_4.Geometry)

boundary_7 = BoundarySurfaces(Edges=runion_12)
cp_11 = ControlPoints(Curve=rdiff_10)  # -> Points, Weights, Knots
boundary_8 = BoundarySurfaces(Edges=rdiff_10)
sdiff = SolidDifference(BrepsA=boundary_7, BrepsB=clscrv_2.Closed)
item_96 = ListItem(List=flatten(cp_11.Points), Index=Slider(5, range=0..100), Wrap=True)
rectangle_13 = Rectangle(Plane=item_96, XSize=panel_18, YSize=neg_8, Radius=0)  # -> Rectangle, Length
ccx_20 = CurveCurve(CurveA=rdiff_10, CurveB=rectangle_13.Rectangle)  # -> Points, ParamsA, ParamsB
points_4 = PointList(Points=ccx_20.Points, Size=panel_18)
item_97 = ListItem(List=ccx_20.Points, Index=panel_19, Wrap=True)
pline_9 = PolyLine(Vertices=flatten(item_97), Closed=True)
# 合
boundary_9 = BoundarySurfaces(Edges=pline_9)
debrep = DeconstructBrep(Brep=sdiff)  # -> Faces, Edges, Vertices
item_98 = ListItem(List=debrep.Faces, Index=Slider(0, range=0..10), Wrap=True)
merge_13 = Merge(Data1=boundary_8, Data2=item_98, Data3=boundary_9)
move_23 = Move(Geometry=merge_13, Motion=Y_3)  # -> Geometry, Transform
move_24 = Move(Geometry=move_23.Geometry, Motion=X_8)  # -> Geometry, Transform
cp_12 = ControlPoints(Curve=crv_31)  # -> Points, Weights, Knots
cp_13 = ControlPoints(Curve=mirror_13.Geometry)  # -> Points, Weights, Knots
item_99 = ListItem(List=flatten(cp_13.Points), Index=Slider(7, range=0..10), Wrap=True)
ln_21 = Line(StartPoint=item_46, EndPoint=item_99)
midpt_11 = CurveMiddle(Curve=ln_21)

# ----
# 坐标转换
deplane_21 = DeconstructPlane(Plane=midpt_11)  # -> Origin, XAxis, YAxis, ZAxis
pl_12 = ConstructPlane(Origin=midpt_11, XAxis=deplane_21.YAxis, YAxis=deplane_21.ZAxis)

rotate_12 = Rotate(Geometry=pl_12, Angle=degrees(Slider(90, range=0..100)), Plane=PlaneXY(0, 0, 0))  # -> Geometry, Transform

crv_32 = Curve(ln_21)
panel_42 = Panel("""1
3""")
# 中线
item_100 = ListItem(List=flatten(cp_7.Points), Index=panel_42, Wrap=True)
pline_10 = PolyLine(Vertices=item_100, Closed=False)
midpt_12 = CurveMiddle(Curve=crv_32)
midpt_13 = CurveMiddle(Curve=pline_10)
move2pt = MoveToPoint(Geometry=pline_10, PointA=midpt_13, PointB=midpt_12)  # -> Moved, Vector, Transform

# ----
# 数字0
end_14 = EndPoints(Curve=crv_32)  # -> Start, End
end_15 = EndPoints(Curve=move2pt.Moved)  # -> Start, End
ln_22 = Line(StartPoint=end_15.Start, EndPoint=end_14.Start)
ln_23 = Line(StartPoint=end_14.End, EndPoint=end_15.Start)
ln_24 = Line(StartPoint=end_15.End, EndPoint=end_14.End)
ln_25 = Line(StartPoint=end_14.Start, EndPoint=end_15.End)
merge_14 = Merge(Data1=ln_22, Data2=ln_23, Data3=ln_24, Data4=ln_25)

join_20 = JoinCurves(Curves=merge_14, Preserve=False)
scale_4 = Scale(Geometry=join_20, Center=midpt_12, Factor=0.5)  # -> Geometry, Transform

offcrv_24 = OffsetCurve(Curve=join_20, Plane=PlaneXY(0, 0, 0), Distance=neg_16, BothSides=False, Kinks=0, CapType=1)
cp_14 = ControlPoints(Curve=offcrv_24)  # -> Points, Weights, Knots
item_101 = ListItem(List=flatten(cp_14.Points), Index=Slider(2, range=0..10), Wrap=True)
offcrv_25 = OffsetCurve(Curve=scale_4.Geometry, Plane=PlaneXY(0, 0, 0), Distance=neg_26, BothSides=False, Kinks=0, CapType=1)

number_slider_19 = Slider(0.85, range=0..10)
expression_55 = Expression(x=panel_21, Expression="x/25")

expression_56 = Expression(x=panel_21, y=number_slider_19, Expression="x*y")
dom_17 = ConstructDomain(DomainStart=expr("x", expression_55), DomainEnd=expr("-x", expression_55))
rectangle_14 = Rectangle(Plane=end_7.End, XSize=expression_56, YSize=dom_17, Radius=0)  # -> Rectangle, Length
explode_10 = Explode(Curve=rectangle_14.Rectangle, Recursive=True)  # -> Segments, Vertices
item_102 = ListItem(List=explode_10.Segments, Index=Slider(1, range=0..10), Wrap=True)
len_13 = Length(Curve=item_102)
end_16 = EndPoints(Curve=item_102)  # -> Start, End
merge_15 = Merge(Data1=pt_6, Data2=end_16.Start, Data3=end_16.End)
pline_11 = PolyLine(Vertices=flatten(merge_15), Closed=True)
expression_57 = Expression(x=number_slider_12, y=expression_55, Expression="x*y")
expression_58 = Expression(x=expression_55, y=number_slider_19, Expression="x*y")
arrpolar = PolarArray(Geometry=pline_11, Plane=pt_6, Count=number_slider_13, Angle=6.283185307)  # -> Geometry, Transform
expression_59 = Expression(x=expression_58, y=Slider(0.55, range=0..10), Expression="x*y")
offcrv_26 = OffsetCurve(Curve=join_10, Plane=PlaneXY(0, 0, 0), Distance=expression_59, BothSides=False, Kinks=0, CapType=1)
boundary_10 = BoundarySurfaces(Edges=flatten([offcrv_26, join_10]))
rdiff_11 = RegionDifference(CurvesA=arrpolar.Geometry, CurvesB=join_10)
Z_7 = UnitZ(Factor=expression_57)
boundary_11 = BoundarySurfaces(Edges=rdiff_11)
Z_8 = UnitZ(Factor=expression_55)
Z_9 = UnitZ(Factor=expression_59)
extr_6 = Extrude(Base=flatten(boundary_10), Direction=Z_5)
extr_7 = Extrude(Base=flatten(boundary_3), Direction=Z_9)

explode_11 = Explode(Curve=pline_11, Recursive=True)  # -> Segments, Vertices
item_103 = ListItem(List=explode_11.Segments, Index=Slider(0, range=0..10), Wrap=True)

pframes_9 = PerpFrames(Curve=item_103, Count=Slider(1, range=0..10), Align=True)  # -> Frames, Parameters
item_104 = ListItem(List=pframes_9.Frames, Index="1", Wrap=True)

curvepoint_4 = PointOnCurve(item_103, parameter=0.799)

# ----
# 坐标转换
deplane_22 = DeconstructPlane(Plane=item_104)  # -> Origin, XAxis, YAxis, ZAxis
pl_13 = ConstructPlane(Origin=curvepoint_4, XAxis=deplane_22.YAxis, YAxis=deplane_22.ZAxis)

deplane_23 = DeconstructPlane(Plane=pl_13)  # -> Origin, XAxis, YAxis, ZAxis
line_12 = LineSDL(Start=curvepoint_4, Direction=deplane_23.XAxis, Length=len_13)
end_17 = EndPoints(Curve=line_12)  # -> Start, End
merge_16 = Merge(Data1=end_17.Start, Data2=end_17.End, Data3=pt_6)

pline_12 = PolyLine(Vertices=flatten(merge_16), Closed=True)
arrpolar_2 = PolarArray(Geometry=pline_12, Plane=pt_6, Count=number_slider_13, Angle=6.283185307)  # -> Geometry, Transform
rdiff_12 = RegionDifference(CurvesA=arrpolar_2.Geometry, CurvesB=join_10)
mirror_14 = Mirror(Geometry=rdiff_12, Plane=xz_3)  # -> Geometry, Transform
boundary_12 = BoundarySurfaces(Edges=rdiff_12)
boundary_13 = BoundarySurfaces(Edges=mirror_14.Geometry)

explode_12 = Explode(Curve=pline_12, Recursive=True)  # -> Segments, Vertices
item_105 = ListItem(List=explode_12.Segments, Index=Slider(2, range=0..10), Wrap=True)

curvepoint_5 = PointOnCurve(item_105, parameter=0.089)

pframes_10 = PerpFrames(Curve=item_105, Count=Slider(1, range=0..10), Align=True)  # -> Frames, Parameters
item_106 = ListItem(List=pframes_10.Frames, Index="1", Wrap=True)

deplane_24 = DeconstructPlane(Plane=item_106)  # -> Origin, XAxis, YAxis, ZAxis
pl_14 = ConstructPlane(Origin=curvepoint_5, XAxis=deplane_24.YAxis, YAxis=deplane_24.ZAxis)

deplane_25 = DeconstructPlane(Plane=pl_14)  # -> Origin, XAxis, YAxis, ZAxis

neg_41 = Negative(Value=deplane_25.XAxis)

line_13 = LineSDL(Start=curvepoint_5, Direction=neg_41, Length=len_13)
end_18 = EndPoints(Curve=line_13)  # -> Start, End
merge_17 = Merge(Data1=end_18.Start, Data2=end_18.End, Data3=pt_6)

pline_13 = PolyLine(Vertices=flatten(merge_17), Closed=True)
arrpolar_3 = PolarArray(Geometry=pline_13, Plane=pt_6, Count=number_slider_13, Angle=6.283185307)  # -> Geometry, Transform
rdiff_13 = RegionDifference(CurvesA=arrpolar_3.Geometry, CurvesB=join_10)
mirror_15 = Mirror(Geometry=rdiff_13, Plane=xz_4)  # -> Geometry, Transform
boundary_14 = BoundarySurfaces(Edges=rdiff_13)
boundary_15 = BoundarySurfaces(Edges=mirror_15.Geometry)

extr_8 = Extrude(Base=boundary_11, Direction=Z_7)
extr_9 = Extrude(Base=flatten([boundary_13, boundary_12]), Direction=Z_8)
extr_10 = Extrude(Base=flatten([boundary_14, boundary_15]), Direction=Z_9)

merge_18 = Merge(Data1=extr_8, Data2=extr_9, Data3=extr_10, Data4=extr_7, Data5=extr_6)
sunion_6 = SolidUnion(Breps=flatten(merge_18))
brep_9 = Brep(sunion_6)

# ----
# 调节高度
number_slider_20 = Slider(3.91, range=0..100)

X_17 = UnitX(Factor=number_slider_20)
move_25 = Move(Geometry=end_8.End, Motion=X_17)  # -> Geometry, Transform
expression_60 = Expression(x=Slider(14.4, range=0..100), y=number_slider_20, Expression="x-y")

expression_61 = Expression(x=len_11, Expression="(x)*6")
# 移动
neg_42 = Negative(Value=Y_3)
X_18 = UnitX(Factor=expression_61)

neg_43 = Negative(Value=panel_23)

line_14 = LineSDL(Start=move_25.Geometry, Direction="0,1,0", Length=number_slider)

curvepoint_6 = PointOnCurve(line_14, parameter=0.333)

pframes_11 = PerpFrames(Curve=line_14, Count=Slider(1, range=0..10), Align=True)  # -> Frames, Parameters
item_107 = ListItem(List=pframes_11.Frames, Index="1", Wrap=True)

deplane_26 = DeconstructPlane(Plane=item_107)  # -> Origin, XAxis, YAxis, ZAxis
pl_15 = ConstructPlane(Origin=item_107, XAxis=deplane_26.YAxis, YAxis=deplane_26.ZAxis)

rotate_13 = Rotate(Geometry=pl_15, Angle=degrees(Slider(50.02, range=-180..180)), Plane=deplane_26.Origin)  # -> Geometry, Transform
deplane_27 = DeconstructPlane(Plane=rotate_13.Geometry)  # -> Origin, XAxis, YAxis, ZAxis
neg_44 = Negative(Value=deplane_27.XAxis)
line_15 = LineSDL(Start=item_107, Direction=neg_44, Length=panel_22)
line_16 = LineSDL(Start=curvepoint_6, Direction="-1,0,0", Length=panel_22)
ccx_21 = CurveCurve(CurveA=line_15, CurveB=line_16)  # -> Points, ParamsA, ParamsB
ln_26 = Line(StartPoint=ccx_21.Points, EndPoint=curvepoint_6)

ln_27 = Line(StartPoint=item_107, EndPoint=ccx_21.Points)
ext_2 = ExtendCurve(Curve=ln_26, Type=0, Start="0", End=expression_60)

crv_33 = Curve(ext_2)
flip_8 = FlipCurve(Curve=crv_33)  # -> Curve, Flag

# ----
# 裁剪
end_19 = EndPoints(Curve=ln_27)  # -> Start, End
rectangle_15 = Rectangle(Plane=end_19.End, XSize=neg_43, YSize=panel_23, Radius=0)  # -> Rectangle, Length

move_26 = Move(Geometry=line_14, Motion=X_4)  # -> Geometry, Transform
move_27 = Move(Geometry=ext_2, Motion=neg_9)  # -> Geometry, Transform

ccx_22 = CurveCurve(CurveA=ln_27, CurveB=move_27.Geometry)  # -> Points, ParamsA, ParamsB
end_20 = EndPoints(Curve=move_27.Geometry)  # -> Start, End
end_21 = EndPoints(Curve=move_26.Geometry)  # -> Start, End

# ----
# 分隔
ln_28 = Line(StartPoint=end_20.End, EndPoint=ccx_22.Points)
end_22 = EndPoints(Curve=ln_28)  # -> Start, End
ccx_23 = CurveCurve(CurveA=ln_28, CurveB=line_14)  # -> Points, ParamsA, ParamsB
ln_29 = Line(StartPoint=end_22.Start, EndPoint=ccx_23.Points)

end_23 = EndPoints(Curve=flip_8.Curve)  # -> Start, End
ccx_24 = CurveCurve(CurveA=crv_33, CurveB=line_14)  # -> Points, ParamsA, ParamsB
ln_30 = Line(StartPoint=end_23.Start, EndPoint=ccx_24.Points)

flip_9 = FlipCurve(Curve=ln_30)  # -> Curve, Flag

offcrv_27 = OffsetCurve(Curve=line_14, Plane=PlaneXY(0, 0, 0), Distance=neg_10, BothSides=False, Kinks=0, CapType=1)
offcrv_28 = OffsetCurve(Curve=ln_27, Plane=PlaneXY(0, 0, 0), Distance=neg_6, BothSides=False, Kinks=0, CapType=1)

cp_15 = ControlPoints(Curve=offcrv_27)  # -> Points, Weights, Knots
item_108 = ListItem(List=cp_15.Points, Index=number_slider_15, Wrap=True)

ccx_25 = CurveCurve(CurveA=offcrv_28, CurveB=move_26.Geometry)  # -> Points, ParamsA, ParamsB
item_109 = ListItem(List=ccx_25.Points, Index="0", Wrap=True)
ln_31 = Line(StartPoint=item_109, EndPoint=end_21.Start)

ccx_26 = CurveCurve(CurveA=crv_33, CurveB=ln_31)  # -> Points, ParamsA, ParamsB
ln_32 = Line(StartPoint=ccx_26.Points, EndPoint=end_23.End)

ccx_27 = CurveCurve(CurveA=ln_28, CurveB=ln_31)  # -> Points, ParamsA, ParamsB
ln_33 = Line(StartPoint=ccx_27.Points, EndPoint=end_22.End)

flip_10 = FlipCurve(Curve=ln_32)  # -> Curve, Flag
merge_19 = Merge(Data1=ln_33, Data2=ln_29)
merge_20 = Merge(Data1=flip_10.Curve, Data2=flip_9.Curve)

offcrv_29 = OffsetCurve(Curve=merge_20, Plane=PlaneXY(0, 0, 0), Distance=panel_12, BothSides=False, Kinks=0, CapType=1)
offcrv_30 = OffsetCurve(Curve=merge_19, Plane=PlaneXY(0, 0, 0), Distance=neg_6, BothSides=False, Kinks=0, CapType=1)
offcrv_31 = OffsetCurve(Curve=ln_31, Plane=PlaneXY(0, 0, 0), Distance=panel_12, BothSides=False, Kinks=0, CapType=1)

cp_16 = ControlPoints(Curve=offcrv_30)  # -> Points, Weights, Knots
item_110 = ListItem(List=flatten(cp_16.Points), Index=Slider(3, range=0..10), Wrap=True)

offcrv_32 = OffsetCurve(Curve=ln_33, Plane=PlaneXY(0, 0, 0), Distance=neg_6, BothSides=False, Kinks=0, CapType=1)
rdiff_14 = RegionDifference(CurvesA=offcrv_28, CurvesB=rectangle_15.Rectangle)
expression_62 = Expression(x=expression_48, y=Slider(3.677936, range=0..10), Expression="(x+y)")
Y_8 = UnitY(Factor=expression_62)
neg_45 = Negative(Value=Y_8)

item_111 = ListItem(List=flatten(explode_5.Segments), Index="1", Wrap=True)
end_24 = EndPoints(Curve=ln_14)  # -> Start, End
end_25 = EndPoints(Curve=item_111)  # -> Start, End

panel_43 = Panel(expression_25)
neg_46 = Negative(Value=panel_43)
neg_47 = Negative(Value=panel_43)

end_26 = EndPoints(Curve=item_39)  # -> Start, End

devec_3 = DeconstructVector(Vector=end_26.Start)  # -> XComponent, YComponent, ZComponent
panel_44 = Panel(devec_3.XComponent)
line_17 = LineSDL(Start=end_9.End, Direction="1,0,0", Length=panel_44)

mirror_16 = Mirror(Geometry=line_17, Plane=PlaneYZ(0, 0, 0))  # -> Geometry, Transform
# 边长长度
join_21 = JoinCurves(Curves=flatten([line_17, mirror_16.Geometry]), Preserve=False)
move2pt_2 = MoveToPoint(Geometry=join_21, PointA=end_24.End, PointB=end_25.End)  # -> Moved, Vector, Transform

crv_34 = Curve(move2pt_2.Moved)
# 外框
len_14 = Length(Curve=crv_34)
expression_63 = Expression(x=len_14, Expression="x/2")
dom_18 = ConstructDomain(DomainStart=expr("x", expression_63), DomainEnd=expr("-x", expression_63))
neg_48 = Negative(Value=panel_30)
midpt_14 = CurveMiddle(Curve=crv_34)
rectangle_16 = Rectangle(Plane=midpt_14, XSize=dom_18, YSize=neg_48, Radius=0)  # -> Rectangle, Length
explode_13 = Explode(Curve=rectangle_16.Rectangle, Recursive=True)  # -> Segments, Vertices
# 数字7
item_112 = ListItem(List=flatten(explode_13.Segments), Index=Slider(2, range=0..10), Wrap=True)
Y_9 = UnitY(Factor=panel_25)

# ----
# 调节高度
number_slider_21 = Slider(64.37, range=-180..180)
curvepoint_7 = PointOnCurve(crv_34, parameter=0.025)

midpt_15 = CurveMiddle(Curve=item_112)
item_113 = ListItem(List=cp_12.Points, Index=Slider(7, range=0..100), Wrap=True)
pdecon_4 = Deconstruct(Point=midpt_15)  # -> XComponent, YComponent, ZComponent
pdecon_5 = Deconstruct(Point=item_113)  # -> XComponent, YComponent, ZComponent
panel_45 = Panel(pdecon_4.YComponent)
panel_46 = Panel(pdecon_5.YComponent)
expression_64 = Expression(x=panel_45, y=panel_46, Expression="x-y")
neg_49 = Negative(Value=expression_64)

end_27 = EndPoints(Curve=crv_34)  # -> Start, End
ln_34 = Line(StartPoint=curvepoint_7, EndPoint=end_27.End)

pframes_12 = PerpFrames(Curve=ln_34, Count=Slider(1, range=0..10), Align=True)  # -> Frames, Parameters
item_114 = ListItem(List=pframes_12.Frames, Index="0", Wrap=True)

# ----
# 坐标转换
# 正方形坐标
deplane_28 = DeconstructPlane(Plane=item_114)  # -> Origin, XAxis, YAxis, ZAxis
pl_16 = ConstructPlane(Origin=item_114, XAxis=deplane_28.YAxis, YAxis=deplane_28.ZAxis)

rotate_14 = Rotate(Geometry=pl_16, Angle=degrees(Slider(120, range=-180..180)), Plane=pl_16)  # -> Geometry, Transform
deplane_29 = DeconstructPlane(Plane=rotate_14.Geometry)  # -> Origin, XAxis, YAxis, ZAxis
# 裁切方形
neg_50 = Negative(Value=neg_49)
expression_65 = Expression(x=panel_26, y=Slider(3, range=0..10), Expression="-x*y")

# ----
# 小点
end_28 = EndPoints(Curve=join_18)  # -> Start, End
line_18 = LineSDL(Start=end_28.Start, Direction="0,1,0", Length=expression_65)

offcrv_33 = OffsetCurve(Curve=line_18, Plane=PlaneXY(0, 0, 0), Distance=neg_20, BothSides=False, Kinks=0, CapType=1)
line_19 = LineSDL(Start=curvepoint_7, Direction=deplane_29.YAxis, Length=expression_65)
move_28 = Move(Geometry=item_112, Motion=Y_9)  # -> Geometry, Transform
end_29 = EndPoints(Curve=move_28.Geometry)  # -> Start, End

rectangle_17 = Rectangle(Plane=rotate_14.Geometry, XSize=neg_49, YSize=dom_18, Radius=0)  # -> Rectangle, Length
rectangle_18 = Rectangle(Plane=end_29.Start, XSize=dom_18, YSize=neg_50, Radius=0)  # -> Rectangle, Length
rectangle_19 = Rectangle(Plane=item_113, XSize=neg_49, YSize=neg_49, Radius=0)  # -> Rectangle, Length

rectangle_20 = Rectangle(Plane=midpt_14, XSize=dom_18, YSize=neg_49, Radius=0)  # -> Rectangle, Length
flip_11 = FlipCurve(Curve=move_28.Geometry)  # -> Curve, Flag

pframes_13 = PerpFrames(Curve=flip_11.Curve, Count=Slider(1, range=0..10), Align=True)  # -> Frames, Parameters
item_115 = ListItem(List=pframes_13.Frames, Index="1", Wrap=True)

# ----
# 坐标转换
# 正方形坐标
deplane_30 = DeconstructPlane(Plane=item_115)  # -> Origin, XAxis, YAxis, ZAxis
pl_17 = ConstructPlane(Origin=item_115, XAxis=deplane_30.YAxis, YAxis=deplane_30.ZAxis)

rotate_15 = Rotate(Geometry=pl_17, Angle=degrees(number_slider_21), Plane=pl_17)  # -> Geometry, Transform
deplane_31 = DeconstructPlane(Plane=rotate_15.Geometry)  # -> Origin, XAxis, YAxis, ZAxis
deplane_32 = DeconstructPlane(Plane=rotate_15.Geometry)  # -> Origin, XAxis, YAxis, ZAxis
multiplication_16 = Multiplication(A=deplane_31.XAxis, B=panel_25)

line_20 = LineSDL(Start=deplane_32.Origin, Direction=deplane_32.YAxis, Length=expression_35)
ln_35 = Line(StartPoint=end_27.End, EndPoint=end_29.Start)
crv_35 = Curve(crv_34)

move_29 = Move(Geometry=line_20, Motion=multiplication_16)  # -> Geometry, Transform
join_22 = JoinCurves(Curves=flatten([crv_35, ln_35, line_20]), Preserve=False)
flip_12 = FlipCurve(Curve=join_22)  # -> Curve, Flag
expression_66 = Expression(x=expression_65, Expression="x")
panel_47 = Panel(expression_66)
expression_67 = Expression(x=panel_47, Expression="x*.8")

# ----
# 调节高度
rectangle_21 = Rectangle(Plane=item_108, XSize=expression_67, YSize=panel_31, Radius=0)  # -> Rectangle, Length
rectangle_22 = Rectangle(Plane=item_110, XSize=neg_22, YSize=expression_67, Radius=0)  # -> Rectangle, Length

merge_21 = Merge(
    Data1=offcrv_27,
    Data2=rdiff_14,
    Data3=offcrv_29,
    Data4=offcrv_30,
    Data5=offcrv_31,
    Data6=rectangle_21.Rectangle,
    Data7=rectangle_22.Rectangle)
runion_13 = RegionUnion(Curves=flatten(merge_21))
boundary_16 = BoundarySurfaces(Edges=runion_13)

move_30 = Move(Geometry=boundary_16, Motion=neg_42)  # -> Geometry, Transform

move_31 = Move(Geometry=move_30.Geometry, Motion=X_18)  # -> Geometry, Transform

offcrv_34 = OffsetCurve(Curve=move_28.Geometry, Plane=PlaneXY(0, 0, 0), Distance=panel_12, BothSides=False, Kinks=0, CapType=1)
offcrv_35 = OffsetCurve(Curve=flip_12.Curve, Plane=PlaneXY(0, 0, 0), Distance=neg_16, BothSides=False, Kinks=0, CapType=1)
offcrv_36 = OffsetCurve(Curve=move_29.Geometry, Plane=PlaneXY(0, 0, 0), Distance=neg_21, BothSides=False, Kinks=0, CapType=1)

ccx_28 = CurveCurve(CurveA=offcrv_35, CurveB=rectangle_19.Rectangle)  # -> Points, ParamsA, ParamsB
item_116 = ListItem(List=ccx_28.Points, Index=Slider(1, range=0..1), Wrap=True)
rdiff_15 = RegionDifference(CurvesA=offcrv_36, CurvesB=rectangle_18.Rectangle)
rdiff_16 = RegionDifference(CurvesA=offcrv_34, CurvesB=rectangle_17.Rectangle)
rdiff_17 = RegionDifference(CurvesA=offcrv_35, CurvesB=rectangle_17.Rectangle)
rectangle_23 = Rectangle(Plane=item_116, XSize=expression_66, YSize=expression_36, Radius=0)  # -> Rectangle, Length

rdiff_18 = RegionDifference(CurvesA=rdiff_17, CurvesB=rectangle_19.Rectangle)
rdiff_19 = RegionDifference(CurvesA=rdiff_15, CurvesB=rectangle_19.Rectangle)
crv_36 = Curve(rdiff_16)

offcrv_37 = OffsetCurve(Curve=line_19, Plane=PlaneXY(0, 0, 0), Distance=neg_19, BothSides=False, Kinks=0, CapType=1)
runion_14 = RegionUnion(Curves=flatten([crv_36, rdiff_18, rdiff_19, offcrv_37, rectangle_23.Rectangle]))
boundary_17 = BoundarySurfaces(Edges=runion_14)
move_32 = Move(Geometry=boundary_17, Motion=Y_3)  # -> Geometry, Transform
move_33 = Move(Geometry=move_32.Geometry, Motion=X_11)  # -> Geometry, Transform
panel_48 = Panel(expression_65)
neg_51 = Negative(Value=panel_48)
expression_68 = Expression(x=neg_51, y=Slider(2, range=0..10), Expression="x*y")
line_21 = LineSDL(Start=item_101, Direction="1,0,0", Length=expression_68)
offcrv_38 = OffsetCurve(Curve=line_21, Plane=PlaneXY(0, 0, 0), Distance=expression_38, BothSides=True, Kinks=0, CapType=1)
rint = RegionIntersection(CurvesA=offcrv_24, CurvesB=offcrv_38)

rdiff_20 = RegionDifference(CurvesA=join_20, CurvesB=offcrv_24)
rdiff_21 = RegionDifference(CurvesA=offcrv_25, CurvesB=scale_4.Geometry)
rdiff_22 = RegionDifference(CurvesA=rint, CurvesB=offcrv_25)
rint_2 = RegionIntersection(CurvesA=scale_4.Geometry, CurvesB=offcrv_38)

boundary_18 = BoundarySurfaces(Edges=rdiff_22)
boundary_19 = BoundarySurfaces(Edges=rint_2)

boundary_20 = BoundarySurfaces(Edges=rdiff_20)
boundary_21 = BoundarySurfaces(Edges=rdiff_21)

merge_22 = Merge(Data1=boundary_20, Data2=boundary_21, Data3=boundary_18, Data4=boundary_19)
move_34 = Move(Geometry=merge_22, Motion=Y_3)  # -> Geometry, Transform
move_35 = Move(Geometry=move_34.Geometry, Motion=X_14)  # -> Geometry, Transform

move_36 = Move(Geometry=move2pt_2.Moved, Motion=Y_5)  # -> Geometry, Transform

end_30 = EndPoints(Curve=move_36.Geometry)  # -> Start, End
ln_36 = Line(StartPoint=end_26.Start, EndPoint=end_30.Start)

curvepoint_8 = PointOnCurve(move_36.Geometry, parameter=0.928)
curvepoint_9 = PointOnCurve(ln_36, parameter=0.667)

move2pt_3 = MoveToPoint(Geometry=item_39, PointA=end_26.Start, PointB=curvepoint_9)  # -> Moved, Vector, Transform

end_31 = EndPoints(Curve=move2pt_3.Moved)  # -> Start, End
ln_37 = Line(StartPoint=end_30.Start, EndPoint=end_31.Start)
move_37 = Move(Geometry=move_36.Geometry, Motion=neg_11)  # -> Geometry, Transform

pframes_14 = PerpFrames(Curve=move_36.Geometry, Count=Slider(1, range=0..10), Align=True)  # -> Frames, Parameters
item_117 = ListItem(List=pframes_14.Frames, Index="1", Wrap=True)

# ----
# 坐标转换
# 正方形坐标
deplane_33 = DeconstructPlane(Plane=item_117)  # -> Origin, XAxis, YAxis, ZAxis
pl_18 = ConstructPlane(Origin=curvepoint_8, XAxis=deplane_33.YAxis, YAxis=deplane_33.ZAxis)

join_23 = JoinCurves(Curves=flatten([move_36.Geometry, ln_36]), Preserve=False)
move_38 = Move(Geometry=ln_36, Motion=X_5)  # -> Geometry, Transform

ccx_29 = CurveCurve(CurveA=move2pt_3.Moved, CurveB=move_38.Geometry)  # -> Points, ParamsA, ParamsB
ccx_30 = CurveCurve(CurveA=move_37.Geometry, CurveB=move_38.Geometry)  # -> Points, ParamsA, ParamsB

ln_38 = Line(StartPoint=ccx_29.Points, EndPoint=ccx_30.Points)
ln_39 = Line(StartPoint=end_31.End, EndPoint=ccx_29.Points)

join_24 = JoinCurves(Curves=flatten([ln_38, ln_39]), Preserve=False)
end_32 = EndPoints(Curve=ln_39)  # -> Start, End

rectangle_24 = Rectangle(Plane=ccx_29.Points, XSize=neg_46, YSize=neg_47, Radius=0)  # -> Rectangle, Length
rectangle_25 = Rectangle(Plane=end_32.Start, XSize=panel_43, YSize=panel_43, Radius=0)  # -> Rectangle, Length

rotate_16 = Rotate(Geometry=pl_18, Angle=degrees(Slider(45, range=-180..180)), Plane=pl_18)  # -> Geometry, Transform
deplane_34 = DeconstructPlane(Plane=rotate_16.Geometry)  # -> Origin, XAxis, YAxis, ZAxis
line_22 = LineSDL(Start=deplane_34.Origin, Direction=deplane_34.YAxis, Length=expression_32)

offcrv_39 = OffsetCurve(Curve=join_24, Plane=PlaneXY(0, 0, 0), Distance=panel_12, BothSides=False, Kinks=0, CapType=1)
offcrv_40 = OffsetCurve(Curve=join_23, Plane=PlaneXY(0, 0, 0), Distance=neg_10, BothSides=False, Kinks=0, CapType=1)

offcrv_41 = OffsetCurve(Curve=line_22, Plane=PlaneXY(0, 0, 0), Distance=neg_12, BothSides=False, Kinks=0, CapType=1)
offcrv_42 = OffsetCurve(Curve=move_37.Geometry, Plane=PlaneXY(0, 0, 0), Distance=panel_12, BothSides=False, Kinks=0, CapType=1)
rdiff_23 = RegionDifference(CurvesA=offcrv_40, CurvesB=rectangle_24.Rectangle)
rdiff_24 = RegionDifference(CurvesA=offcrv_39, CurvesB=rectangle_25.Rectangle)

move_39 = Move(Geometry=mirror_5.Geometry, Motion=neg_45)  # -> Geometry, Transform

# ----
# 小转角
number_slider_22 = Slider(0, range=0..100)
crv_37 = Curve(move_7.Geometry)
expression_69 = Expression(x=panel_25, y=panel_30, Expression="(-x)-y")
expression_70 = Expression(x=expression_69, y=neg_19, Expression="x-y")
multiplication_17 = Multiplication(A=expression_70, B=deplane_10.YAxis)

move_40 = Move(Geometry=item_40, Motion=multiplication_17)  # -> Geometry, Transform
end_33 = EndPoints(Curve=move_40.Geometry)  # -> Start, End

expression_71 = Expression(x=number_slider, Expression="x/2")
expression_72 = Expression(x=number_slider, Expression="x/2")
end_34 = EndPoints(Curve=join_18)  # -> Start, End
neg_52 = Negative(Value=expression_72)
rectangle_26 = Rectangle(Plane=end_34.Start, XSize=expression_71, YSize=neg_52, Radius=0)  # -> Rectangle, Length

panel_49 = Panel(expression_71)
dom_19 = ConstructDomain(DomainStart=expr("-x", panel_49), DomainEnd=expr("x", panel_49))
rectangle_27 = Rectangle(Plane=rotate_16.Geometry, XSize=panel_49, YSize=dom_19, Radius=0)  # -> Rectangle, Length
rdiff_25 = RegionDifference(CurvesA=offcrv_42, CurvesB=rectangle_27.Rectangle)
rdiff_26 = RegionDifference(CurvesA=rdiff_23, CurvesB=rectangle_27.Rectangle)
merge_23 = Merge(Data1=rdiff_26, Data2=rdiff_24, Data3=rdiff_25, Data4=offcrv_41)

runion_15 = RegionUnion(Curves=flatten(merge_23))

boundary_22 = BoundarySurfaces(Edges=flatten([runion_15, move_39.Geometry]))
join_25 = BrepJoin(Breps=boundary_22)  # -> Breps, Closed
move_41 = Move(Geometry=join_25.Breps, Motion=X_9)  # -> Geometry, Transform

ext_3 = ExtendCurve(Curve=crv_37, Type=0, Start=number_slider_22, End=expression_71)

end_35 = EndPoints(Curve=ext_3)  # -> Start, End
ccx_31 = CurveCurve(CurveA=move_40.Geometry, CurveB=ext_3)  # -> Points, ParamsA, ParamsB
ln_40 = Line(StartPoint=ccx_31.Points, EndPoint=end_35.Start)
ln_41 = Line(StartPoint=ccx_31.Points, EndPoint=end_33.End)
join_26 = JoinCurves(Curves=flatten([ln_40, ln_41]), Preserve=False)

offcrv_43 = OffsetCurve(Curve=join_18, Plane=PlaneXY(0, 0, 0), Distance=neg_16, BothSides=False, Kinks=0, CapType=1)
offcrv_44 = OffsetCurve(Curve=move_17.Geometry, Plane=PlaneXY(0, 0, 0), Distance=neg_17, BothSides=False, Kinks=0, CapType=1)
offcrv_45 = OffsetCurve(Curve=flip_7.Curve, Plane=PlaneXY(0, 0, 0), Distance=neg_16, BothSides=False, Kinks=0, CapType=1)
offcrv_46 = OffsetCurve(Curve=join_26, Plane=PlaneXY(0, 0, 0), Distance=panel_12, BothSides=False, Kinks=0, CapType=1)

# ----
# 裁切方形
ccx_32 = CurveCurve(CurveA=offcrv_43, CurveB=flip_7.Curve)  # -> Points, ParamsA, ParamsB
item_118 = ListItem(List=flatten(ccx_32.Points), Index=Slider(0, range=0..1), Wrap=True)
pl_19 = ConstructPlane(Origin=item_118, XAxis=deplane_9.YAxis, YAxis=deplane_9.ZAxis)
ccx_33 = CurveCurve(CurveA=offcrv_45, CurveB=move_18.Geometry)  # -> Points, ParamsA, ParamsB

item_119 = ListItem(List=flatten(ccx_33.Points), Index="1", Wrap=True)
rectangle_28 = Rectangle(Plane=item_119, XSize=expression_71, YSize=expression_72, Radius=0)  # -> Rectangle, Length

rectangle_29 = Rectangle(Plane=pl_19, XSize=neg_14, YSize=neg_13, Radius=0)  # -> Rectangle, Length
pline_14 = PolyLine(Vertices=ccx_33.Points, Closed=False)
runion_16 = RegionUnion(Curves=flatten([rectangle_29.Rectangle, offcrv_45]))

offcrv_47 = OffsetCurve(Curve=pline_14, Plane=PlaneXY(0, 0, 0), Distance=panel_12, BothSides=False, Kinks=0, CapType=1)

rdiff_27 = RegionDifference(CurvesA=offcrv_43, CurvesB=rectangle_28.Rectangle)
rdiff_28 = RegionDifference(CurvesA=offcrv_46, CurvesB=rectangle_28.Rectangle)

rdiff_29 = RegionDifference(CurvesA=rdiff_27, CurvesB=rectangle_26.Rectangle)
rdiff_30 = RegionDifference(CurvesA=rdiff_28, CurvesB=rectangle_26.Rectangle)
merge_24 = Merge(Data1=offcrv_45, Data2=flip_7.Curve)
crv_38 = Curve(offcrv_44)
crv_39 = Curve(offcrv_47)

rdiff_31 = RegionDifference(CurvesA=flip_7.Curve, CurvesB=runion_16)
merge_25 = Merge(Data1=rdiff_31, Data2=crv_38, Data3=crv_39, Data4=rdiff_29, Data5=rdiff_30, Data6=offcrv_33)
runion_17 = RegionUnion(Curves=flatten(merge_25))
boundary_23 = BoundarySurfaces(Edges=runion_17)
move_42 = Move(Geometry=boundary_23, Motion=Y_3)  # -> Geometry, Transform
move_43 = Move(Geometry=move_42.Geometry, Motion=X_10)  # -> Geometry, Transform
mirror_17 = Mirror(Geometry=boundary_23, Plane=PlaneYZ(0, 0, 0))  # -> Geometry, Transform
mirror_18 = Mirror(Geometry=mirror_17.Geometry, Plane=rotate_12.Geometry)  # -> Geometry, Transform
move_44 = Move(Geometry=mirror_18.Geometry, Motion=Y_3)  # -> Geometry, Transform
move_45 = Move(Geometry=move_44.Geometry, Motion=X_13)  # -> Geometry, Transform
